# Grasshopper definition CustomSpaceTypes_FullBuilding.gh (Grasshopper 1.0.7)

panel = Panel("""85
85
85
85
85
85
85
85
85
85
85
85
85
85
85
85
85
85
85
85
85
85
85
85""")
panel_2 = Panel("""0
0
0
0
0
0
0
0
0
0
0
0
0
0
0
0
0
0
0
0
0
0
0
0""")
_10am_6pm = Panel("""85
85
85
85
85
85
85
85
73
73
73
73
73
73
73
73
73
73
73
73
85
85
85
85""")
_10am_6pm_2 = Panel("""0
0
0
0
0
0
0
0
0.1
0.3
0.95
0.95
0.5
0.95
0.95
0.95
0.95
0.7
0.4
0.1
0
0
0
0""")
_1pm_8pm = Panel("""85
85
85
85
85
85
85
85
85
85
85
85
73
73
73
73
73
73
73
73
73
73
85
85""")
# Schedule from google map
_1pm_8pm_2 = Panel("""0
0
0
0
0
0
0
0
0
0
0
0
0.1
0.5
0.95
0.95
0.95
0.95
0.95
0.7
0.4
0.1
0
0""")
f2c = Ladybug_F2C(F=_10am_6pm)  # -> C; plug-in component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
f2c_2 = Ladybug_F2C(F=panel)  # -> C; plug-in component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
f2c_3 = Ladybug_F2C(F=_1pm_8pm)  # -> C; plug-in component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
annualschedule = Honeybee_AnnualSchedule(
    sun=f2c_2,
    mon=f2c,
    tue=f2c_3,
    wed=f2c,
    thu=f2c,
    fri=f2c,
    sat=f2c,
    scheduleName="Lib_ClgSetpt",
    schedTypeLimits="Temperature",
    runIt=Toggle(True))  # -> readMe, port, schedule, port_2, weekSched, schedIDFText; plug-in component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
annualschedule_2 = Honeybee_AnnualSchedule(
    sun=panel_2,
    mon=_10am_6pm_2,
    tue=_1pm_8pm_2,
    wed=_10am_6pm_2,
    thu=_10am_6pm_2,
    fri=_10am_6pm_2,
    sat=_10am_6pm_2,
    scheduleName="Lib_Occ",
    runIt=Toggle(True))  # -> readMe, port, schedule, port_2, weekSched, schedIDFText; plug-in component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
panel_3 = Panel("""60
60
60
60
60
60
60
60
60
60
60
60
60
60
60
60
60
60
60
60
60
60
60
60""")
_10am_6pm_3 = Panel("""60
60
60
60
60
60
60
60
68
68
68
68
68
68
68
68
68
68
68
68
60
60
60
60""")
_1pm_8pm_3 = Panel("""60
60
60
60
60
60
60
60
60
60
60
60
68
68
68
68
68
68
68
68
68
68
60
60""")
f2c_4 = Ladybug_F2C(F=_10am_6pm_3)  # -> C; plug-in component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
f2c_5 = Ladybug_F2C(F=panel_3)  # -> C; plug-in component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
f2c_6 = Ladybug_F2C(F=_1pm_8pm_3)  # -> C; plug-in component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
annualschedule_3 = Honeybee_AnnualSchedule(
    sun=f2c_5,
    mon=f2c_4,
    tue=f2c_6,
    wed=f2c_4,
    thu=f2c_4,
    fri=f2c_4,
    sat=f2c_4,
    scheduleName="Lib_HtgSetpt",
    schedTypeLimits="Temperature",
    runIt=Toggle(True))  # -> readMe, port, schedule, port_2, weekSched, schedIDFText; plug-in component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

data = Data(flatten(["ClassRmMultiPurp", "Corridor", "Meeting", "MEP", "Office", "OpenSeating", "Restroom", "Stair", "Storage", "unused", "Vestibule", "WelcomeZone"]))
concat = Concatenate(FragmentA=data, FragmentB="_PC")
conditioned = Panel("""1
0
1
0
1
1
1
0
0
0
0
1""")
panel_4 = Panel(concat)
name = Panel(data)
occ = Panel("""Lib_Occ
Lib_Occ
Lib_Occ
Lib_Occ
Lib_Occ
Lib_Occ
Lib_Occ
Lib_Occ
Lib_Occ
Lib_Occ
Lib_Occ
Lib_Occ""")
ladybug = Ladybug_Ladybug()  # -> Vviiiiiiiiiizzz; plug-in component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
honeybee = Honeybee_Honeybee()  # -> Vviiiiiiiiiizzz; plug-in component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
ref_type = Panel("""Office::Conference
Office::Corridor
Office::OpenOffice
Office::Elec/MechRoom
Office::ClosedOffice
Office::OpenOffice
Office::Restroom
Office::Stair
Office::Storage
Office::Storage
Office::Lobby
Office::Lobby""")
cooling_stp = Panel("""Lib_ClgSetpt
Lib_ClgSetpt
Lib_ClgSetpt

Lib_ClgSetpt
Lib_ClgSetpt
Lib_ClgSetpt




Lib_ClgSetpt""")
eqp_w_sf = Panel("""0.93
0.16
0.37
0.27
0.64
0.93
0.07
0
0
0
0
0.27""")
heating_stp = Panel("""Lib_HtgSetpt
Lib_HtgSetpt
Lib_HtgSetpt

Lib_HtgSetpt
Lib_HtgSetpt
Lib_HtgSetpt




Lib_HtgSetpt""")
multiplication = Multiplication(A=eqp_w_sf, B="10.7639104")

# ---- group: from SD lighting report
lpd_pc_60_of_2016 = Panel("""0.63
0.396
0.63
0
0.54
0.45
0.51
0.348
0.27
0
0.6
0.6""")

# ----
lpd_bc_w_sf = Panel("""1.23
0.66
1.24
0.95
0.98
0.93
0.98
0.69
0.63
0
0.64
1""")
multiplication_2 = Multiplication(A=lpd_bc_w_sf, B="10.7639104")

# ---- group: from SD MEP report
ppl_1000sf = Panel("""50
0
35
0
20
20
20
0
30
0
0
20""")
multiplication_3 = Multiplication(A=ppl_1000sf, B=0.01076)
cfm_sf = Panel("""0.06
0
0.06
0.06
0.06
0.12
0
0
0.06
0
0
0.06""")
cfm2m3s = Ladybug_Cfm2M3s(cfm=cfm_sf)  # -> m3_s; plug-in component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
multiplication_4 = Multiplication(A=cfm2m3s, B=10.76)
cfm_ppl = Panel("""7.5
0
5
0
5
5
0
0
0
0
0
5""")
cfm2m3s_2 = Ladybug_Cfm2M3s(cfm=cfm_ppl)  # -> m3_s; plug-in component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

# ----
multiplication_5 = Multiplication(A=lpd_pc_60_of_2016, B="10.7639104")
customspacetypes = CustomSpaceTypes(
    name=graft(name),
    refSpaceType=graft(ref_type),
    equipmentLoadPerArea=graft(multiplication),
    lightingDensityPerArea=graft(multiplication_2),
    numOfPeoplePerArea=graft(multiplication_3),
    ventilationPerArea=graft(multiplication_4),
    occupancySchedules=graft(occ),
    heatingSetPtSchedules=graft(heating_stp),
    coolingSetPtSchedules=graft(cooling_stp),
    lightingSchedules=graft(occ),
    equipmentSchedules=graft(occ))  # -> out, flatten(zP)
# ---------- customspacetypes: Python ----------
import scriptcontext as sc
import Grasshopper.Kernel as gh
import copy
bldgProgram, zoneProgram = refSpaceType_.split("::")
openStudioStandardLib = sc.sticky ["honeybee_OpenStudioStandardsFile"]
schedulesAndLoads = openStudioStandardLib['space_types']['90.1-2007']['ClimateZone 1-8'][bldgProgram][zoneProgram]
#print(str(schedulesAndLoads))

u_schedulesAndLoads = copy.deepcopy(schedulesAndLoads)
if equipmentLoadPerArea_ != None:
    u_schedulesAndLoads['elec_equip_per_area'] = equipmentLoadPerArea_/10.763961
if infiltrationRatePerArea_ != None:
    u_schedulesAndLoads['infiltration_per_area_ext'] =infiltrationRatePerArea_/0.00508001
if lightingDensityPerArea_ != None:
    u_schedulesAndLoads['lighting_w_per_area'] =lightingDensityPerArea_/10.763961
if numOfPeoplePerArea_ != None:
    u_schedulesAndLoads[ 'occupancy_per_area'] =numOfPeoplePerArea_/(10.763961 /1000)
if ventilationPerArea_ != None:
    u_schedulesAndLoads['ventilation_per_area'] = ventilationPerArea_/ 0.00508001
if ventilationPerPerson_ != None:
    u_schedulesAndLoads[ 'ventilation_per_person'] = ventilationPerPerson_/0.0004719
if occupancySchedules_ != None and occupancySchedules_ != "":
    u_schedulesAndLoads['occupancy_sch']=occupancySchedules_
if occupancyActivitySchs_ != None and occupancyActivitySchs_ != "":
    u_schedulesAndLoads['occupancy_activity_sch'] = occupancyActivitySchs_
if heatingSetPtSchedules_ != None and heatingSetPtSchedules_ != "":
    u_schedulesAndLoads['heating_setpoint_sch']=heatingSetPtSchedules_
if coolingSetPtSchedules_ != None and coolingSetPtSchedules_ != "":
    u_schedulesAndLoads['cooling_setpoint_sch']=coolingSetPtSchedules_
if lightingSchedules_ != None and lightingSchedules_ != "":
    u_schedulesAndLoads['lighting_sch']=lightingSchedules_
if equipmentSchedules_ != None and equipmentSchedules_ != "":
    u_schedulesAndLoads['elec_equip_sch']=equipmentSchedules_
if infiltrationSchedules_ != None and infiltrationSchedules_ != "":
    u_schedulesAndLoads['infiltration_sch']=infiltrationSchedules_

u_zoneProgram = _name
u_lib = openStudioStandardLib['space_types']['90.1-2007']['ClimateZone 1-8']

if not 'UserBuilding' in u_lib.keys():
    u_lib['UserBuilding'] = {}

u_lib['UserBuilding'][u_zoneProgram] = u_schedulesAndLoads
zP = 'UserBuilding::'+_name
# ---------- end customspacetypes ----------
customspacetypes_2 = CustomSpaceTypes(name=graft(panel_4), refSpaceType=graft(customspacetypes.zP), lightingDensityPerArea=graft(multiplication_5))  # -> out, flatten(zP); same code as customspacetypes
# Proposed Case
panel_5 = Panel(customspacetypes_2.zP)
# Baseline
panel_6 = Panel(customspacetypes.zP)
