# Grasshopper definition WWR-optimization-final-site2.gh (Grasshopper 1.0.7)
# plug-ins: Bifocals, MetaHopper

number_slider = Slider(30, range=0..40)  # disabled
pt = Point(<point referenced from the Rhino model>)  # disabled
Z = UnitZ(Factor=number_slider)  # disabled
xy = XYPlane(Origin=pt)  # disabled
number_slider_2 = Slider(50, range=0..100)  # disabled
move = Move(Geometry=xy, Motion=Z)  # -> Geometry, Transform; disabled
msphere = MeshSphere(Base=move.Geometry, Radius=10, UCount=number_slider_2, VCount=number_slider_2)  # disabled
tri = Triangulate(Mesh=msphere)  # -> Mesh, Count; disabled
# foliage density
number_slider_3 = Slider(0.15, range=0..1)  # disabled
demesh = DeconstructMesh(Mesh=tri.Mesh)  # -> Vertices, Faces, Colours, Normals; disabled
lng = ListLength(List=demesh.Faces)  # disabled
multiplication = Multiplication(A=lng, B=number_slider_3)  # disabled
series = Series(Start=0, Step=1, Count=lng)  # disabled
reduce = RandomReduce(List=series, Reduction=multiplication, Seed=1)  # disabled
python = PythonScript(x=series, y=reduce)  # -> a; inputs x: list, y: list; disabled
# ---------- python: Python ----------
a = (i in y for i in x)
# ---------- end python ----------
cullf = CullFaces(Mesh=tri.Mesh, Pattern=python)  # disabled
swatch = ColourSwatch(SwatchColor=RGB(51, 149, 66))  # disabled
preview = CustomPreview(Geometry=cullf, Shader=swatch)  # disabled

# ----
# site address:
panel = Panel("328 17th Ave")

# ----
# Weather Data
panel_2 = Panel("http://climate.onebuilding.org/WMO_Region_4_North_and_Central_America/USA_United_States_of_America/WA_Washington/USA_WA_Seattle-King.County.Intl.AP-Boeing.Field.727935_TMY3.zip")
downloadepw = LBDownloadWeather(weather_URL=panel_2)  # -> epw_file, stat_file, ddy_file; plug-in component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

# ----
# input geometry
# manually select back edge
# of existing dwelling:
index = Slider(55, range=0..100)
box_input = Brep(<brep referenced from the Rhino model>)
crv = Curve(<curve referenced from the Rhino model>)

height_ft = Panel("12")

# ----
# context
pipeline = GeometryPipeline(
    GroupByLayer=False,
    GroupByType=False,
    IncludeHidden=True,
    IncludeLocked=True,
    LayerFilter="context",
    NameFilter="*",
    SublayerFiltering=True,
    TypeFilter=1073741848)
data = Data(pipeline)

selobj = GetSelectedObjects(AllObjects_Object=annualloads)  # -> ComponentObjects, ParamObjects, OtherObjects
docinfo = DocumentInfo(AutoUpdate=False, Recursive=Toggle(True))  # -> DocumentName, DocumentFilePath, Components, Params, _3rdPartyAssemblies
msgs = GetRuntimeMessages(Objects=[selobj.ComponentObjects, selobj.ParamObjects])  # -> flatten(Errors), flatten(Warnings)
panel_3 = Panel(msgs.Errors)
panel_4 = Panel(docinfo._3rdPartyAssemblies)
panel_5 = Panel(msgs.Warnings)
panel_6 = Panel(docinfo.DocumentName)
panel_7 = Panel()
sametype = GetObjectsOfSameType(Objects=panel_7)
setgroup = SetGroupProperties(Group="Grasshopper.Kernel.Types.GH_ObjectWrapper", Color=ColourSwatch(SwatchColor=RGBA(255, 255, 255, 152)))  # disabled
setpanel = SetPanelProperties(Panel=sametype, Color=ColourSwatch(SwatchColor=RGB(255, 255, 255)))

cluster = Cluster(C=crv, B=box_input, existing_dwelling_back_curve=index)  # -> i, i_2, i_3, i_4, i_5, i_6, i_7, i_8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
area_ft2 = Panel(cluster.R)

# ----
# massing
panel_8 = Panel("1_zonename")
panel_9 = Panel("2_zonename")
outsidecrvfromrhino = Curve(flatten([cluster.i_2, cluster.L_4, cluster.L, cluster.i_6]))
panel_10 = Panel("3_zonename")
panel_11 = Panel("4_zonename")
outsidecrvfromrhino_2 = Curve(flatten([cluster.i, cluster.L_3, cluster.L_4, cluster.i_5]))
outsidecrvfromrhino_3 = Curve(flatten([cluster.i_3, cluster.L, cluster.L_2, cluster.i_7]))
panel_12 = Panel("5_zonename")
adiabaticcrvfromrhino = Curve(flatten([cluster.i_5, cluster.i_6, cluster.i_7, cluster.i_8]))
outsidecrvfromrhino_4 = Curve(flatten([cluster.i_4, cluster.L_3, cluster.L_2, cluster.i_8]))

config = HBConfig()  # -> python_exe, py_lib_install, rad_install, os_install, ep_install, hb_os_gem, standards, asset_report, default_sim; plug-in component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
panel_13 = Panel(config.ep_install)
cluster_2 = FtToM(A=height_ft)

simoutput = HBSimulationOutput()  # -> out, sim_output; plug-in component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
simcontrol = HBSimulationControl(
    do_zone_sizing=Toggle(True),
    do_system_sizing=Toggle(False),
    do_plant_sizing=Toggle(False),
    for_sizing_period=Toggle(False),
    for_run_period=Toggle(False))  # -> sim_control; plug-in component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
simpar = HBSimulationParameter(output=simoutput.sim_output, timestep=Slider(1, range=0..10), terrain="Suburbs", sim_control=simcontrol)  # -> sim_par; plug-in component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
toggle = BooleanToggle(False)

# ----
# EUI total:
# EUI breakdown:
# cooling   :
# heating   :
# lighting  :
# equipment :
# hot water :
south_wwr = Slider(0.35, range=0..0.95)
east_wwr = Slider(0.24, range=0..0.95)
north_wwr = Slider(0.18, range=0..0.95)
west_wwr = Slider(0.19, range=0..0.95)
galapagos = Galapagos(fitness=division, gene=[north_wwr, east_wwr, south_wwr, west_wwr])

num = Number([north_wwr, east_wwr, south_wwr, west_wwr])

# ----
# ADU EUI Analysis via EnergyPlus
cluster_3 = Cluster_3(
    C=outsidecrvfromrhino_2,
    C_3=outsidecrvfromrhino,
    C_4=outsidecrvfromrhino_3,
    C_5=outsidecrvfromrhino_4,
    C_2=adiabaticcrvfromrhino,
    factor=cluster_2)
cluster_4 = Cluster_4(crv=[cluster.i, cluster.i_2, cluster.i_3, cluster.i_4])
cluster_5 = Cluster_5(C=[cluster.i, cluster.i_2, cluster.i_3, cluster.i_4], F=cluster_2)
cluster_6 = Cluster_2()  # -> constr_set, y
applyprogram = HBApplyProgramType(rooms=flatten(cluster_5), program=cluster_4)  # -> report, rooms; plug-in component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
applyconstrset = HBApplyConstructionSet(rooms=applyprogram.rooms, constr_set=cluster_6.constr_set)  # -> rooms; plug-in component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
shade = HBShade(geo=data)  # -> report, shades; plug-in component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
aperturesbyratio = HBAperturesByRatio(hb_objs=flatten(applyconstrset), ratio=num)  # -> report, hb_objs; plug-in component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
idealair = HBIdealAir(rooms=flatten(aperturesbyratio.hb_objs), economizer="NoEconomizer")  # -> report, rooms; plug-in component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
toggle_2 = BooleanToggle(True)
annualloads = HBAnnualLoads(
    rooms=idealair.rooms,
    shades=shade.shades,
    epw_file=downloadepw.epw_file,
    timestep=Slider(1, range=0..10),
    run_bal=toggle_2,
    run=toggle_2)  # -> report, total_load, cooling, heating, lighting, equip, hot_water, balance; plug-in component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
panel_14 = Panel(annualloads.total_load)
ma = MassAddition(Input=annualloads.total_load)  # -> Result, PartialResults
panel_15 = Panel(ma.Result)
multiplication_2 = Multiplication(A=panel_15, B="316.998")
division = Division(A=multiplication_2, B=Slider(1000, range=0..1000))
panel_16 = Panel(division)

# ----
# View Zones
allzones = Data(aperturesbyratio.hb_objs)
vizbytype = HBVisualizeByType(hb_objs=allzones)  # -> walls, interior_walls, roofs, ceilings, exterior_floors, interior_floors, air_walls, apertures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; plug-in component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

multiplication_3 = Multiplication(A=panel_14, B="316.998")
division_2 = Division(A=multiplication_3, B=Slider(1000, range=0..1000))
panel_17 = Panel(division_2)

wall_r_value = Panel(cluster_6.y)
panel_18 = Panel(panel_16)
panel_19 = Panel(panel_17)

model = HBModel(rooms=flatten(aperturesbyratio.hb_objs), shades=flatten(shade.shades))  # -> report, model; plug-in component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
modeltoosm = HBModelToOSM(
    model=model.model,
    epw_file=downloadepw.epw_file,
    sim_par=simpar,
    folder="C:\Users\papep\Documents\GitHub\597-GA-research\sim_output",
    write=toggle,
    run=toggle)  # -> report, jsons, osw, osm, idf, sql, zsz, rdd, html; plug-in component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

eui = HBEndUseIntensity(sql=modeltoosm.sql, ip=Toggle(True))  # -> eui, eui_end_use, end_uses, gross_floor; plug-in component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

panel_20 = Panel(eui.eui)

# ==== cluster Cluster
C = ClusterInput()
explode = Explode(Curve=C, Recursive=True)  # -> Segments, Vertices
B = ClusterInput()
item = ListItem(List=explode.Segments, Index=Slider(3, range=0..3), Wrap=True)
edges = BrepEdges(Brep=B)  # -> Naked, Interior, NonManifold
existing_dwelling_back_curve = ClusterInput()
item_2 = ListItem(List=explode.Segments, Index=Slider(0, range=0..3), Wrap=True)
item_3 = ListItem(List=explode.Segments, Index=Slider(2, range=0..3), Wrap=True)
item_4 = ListItem(List=explode.Segments, Index=Slider(1, range=0..3), Wrap=True)
item_5 = ListItem(List=edges.Interior, Index=existing_dwelling_back_curve, Wrap=True)
midpt = CurveMiddle(Curve=item_5)
midpt_2 = CurveMiddle(Curve=item_4)
ft_to_m = FtToM(A=Slider(16, range=0..100))
ft_to_m_2 = FtToM(A=Slider(14, range=0..100))
ft_to_m_3 = FtToM(A=Slider(5, range=0..100))
ft_to_m_4 = FtToM(A=Slider(5, range=0..100))
relay = Relay()
X = UnitX(Factor=ft_to_m_2)
X_2 = UnitX(Factor=ft_to_m)  # -> expr("-x", UnitVector)
Y = UnitY(Factor=ft_to_m_3)  # -> expr("-x", UnitVector)
Y_2 = UnitY(Factor=ft_to_m_4)
pdecon = Deconstruct(Point=midpt)  # -> XComponent, YComponent, ZComponent
pdecon_2 = Deconstruct(Point=midpt_2)  # -> XComponent, YComponent, ZComponent
move = Move(Geometry=item_4, Motion=X)  # -> Geometry, Transform
move_2 = Move(Geometry=item, Motion=X_2)  # -> Geometry, Transform
move_3 = Move(Geometry=item_3, Motion=Y_2)  # -> Geometry, Transform
move_4 = Move(Geometry=item_2, Motion=Y)  # -> Geometry, Transform
pt = ConstructPoint(XCoordinate=pdecon.XComponent, YCoordinate=pdecon_2.YComponent, ZCoordinate=0)
ptuvcrvs = IntersectCurves(CU=[move_2.Geometry, move.Geometry], CV=[move_4.Geometry, move_3.Geometry])
dist = Distance(PointA=pt, PointB=midpt_2)
ft_to_m_5 = FtToM(A=Slider(10, range=0..10))
subtraction = Subtraction(A=dist, B=ft_to_m_5)
X_3 = UnitX(Factor=subtraction)
item_6 = ListItem(List=flatten(ptuvcrvs), Index=Slider(3, range=0..4), Wrap=True)
item_7 = ListItem(List=flatten(ptuvcrvs), Index=Slider(0, range=0..4), Wrap=True)
move_5 = Move(Geometry=item_4, Motion=X_3)  # -> Geometry, Transform
end = EndPoints(Curve=move_5.Geometry)  # -> Start, End
pdecon_3 = Deconstruct(Point=end.Start)  # -> XComponent, YComponent, ZComponent
pdecon_4 = Deconstruct(Point=item_7)  # -> XComponent, YComponent, ZComponent
rec_2pt = Rectangle2Pt(Plane=PlaneXY(0, 0, 0), PointA=item_6, PointB=item_7, Radius=0)  # -> Rectangle, Length
pt_2 = ConstructPoint(XCoordinate=pdecon_3.XComponent, YCoordinate=pdecon_4.YComponent, ZCoordinate=0)
rec_2pt_2 = Rectangle2Pt(Plane=PlaneXY(0, 0, 0), PointA=pt_2, PointB=item_6, Radius=0)  # -> Rectangle, Length
crv = Curve(rec_2pt_2.Rectangle)
area = Area(Geometry=rec_2pt_2.Rectangle)  # -> Area, Centroid
explode_2 = Explode(Curve=crv, Recursive=True)  # -> Segments, Vertices
multiplication = Multiplication(A=area.Area, B="10.7639")
item_8 = ListItem(List=explode_2.Segments, Index=Slider(1, range=0..1), Wrap=True)
R = ClusterOutput(multiplication)
len = Length(Curve=item_8)
division = Division(A=len, B=Slider(-3.333, range=-10..10))
offset = OffsetCurve(Curve=crv, Distance=division, Plane=PlaneXY(0, 0, 0), Corners=1)
explode_3 = Explode(Curve=offset, Recursive=True)  # -> Segments, Vertices
item_9 = ListItem(List=explode_2.Vertices, Index=Slider(0, range=0..100), Wrap=True)
item_10 = ListItem(List=explode_2.Vertices, Index=Slider(1, range=0..100), Wrap=True)
item_11 = ListItem(List=explode_2.Vertices, Index=Slider(2, range=0..100), Wrap=True)
item_12 = ListItem(List=explode_2.Vertices, Index=Slider(3, range=0..100), Wrap=True)
item_13 = ListItem(List=explode_3.Vertices, Index=Slider(0, range=0..100), Wrap=True)
item_14 = ListItem(List=explode_3.Vertices, Index=Slider(1, range=0..100), Wrap=True)
item_15 = ListItem(List=explode_3.Vertices, Index=Slider(2, range=0..100), Wrap=True)
item_16 = ListItem(List=explode_3.Vertices, Index=Slider(3, range=0..100), Wrap=True)
item_17 = ListItem(List=explode_2.Segments, Index=Slider(0, range=0..100), Wrap=True)
item_18 = ListItem(List=explode_2.Segments, Index=Slider(1, range=0..100), Wrap=True)
item_19 = ListItem(List=explode_2.Segments, Index=Slider(2, range=0..100), Wrap=True)
item_20 = ListItem(List=explode_2.Segments, Index=Slider(3, range=0..100), Wrap=True)
ln = Line(StartPoint=item_11, EndPoint=item_15)
ln_2 = Line(StartPoint=item_12, EndPoint=item_16)
item_21 = ListItem(List=explode_3.Segments, Index=Slider(0, range=0..100), Wrap=True)
item_22 = ListItem(List=explode_3.Segments, Index=Slider(1, range=0..100), Wrap=True)
ln_3 = Line(StartPoint=item_9, EndPoint=item_13)
ln_4 = Line(StartPoint=item_10, EndPoint=item_14)
item_23 = ListItem(List=explode_3.Segments, Index=Slider(2, range=0..100), Wrap=True)
item_24 = ListItem(List=explode_3.Segments, Index=Slider(3, range=0..100), Wrap=True)
i = ClusterOutput(item_17)
i_2 = ClusterOutput(item_18)
i_3 = ClusterOutput(item_19)
i_4 = ClusterOutput(item_20)
L = ClusterOutput(ln)
L_2 = ClusterOutput(ln_2)
L_3 = ClusterOutput(ln_3)
L_4 = ClusterOutput(ln_4)
i_5 = ClusterOutput(item_21)
i_6 = ClusterOutput(item_22)
i_7 = ClusterOutput(item_23)
i_8 = ClusterOutput(item_24)

# ==== cluster Cluster_2
r_per_in = Slider(4, range=0..10)
multiplication = Multiplication(A=r_per_in, InsulationThickness=Slider(1, range=0..1))
division = Division(A=multiplication, B=5.67826)
opaquematnomass = HBOpaqueMaterialNoMass(name="ContExtInsulation", r_value=division)  # -> mat; plug-in component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
number_slider = Slider(0.0254, range=0..0.1)
division_2 = Division(A=Slider(0.5, range=0..1), B="39.37")
opaquematnomass_2 = HBOpaqueMaterialNoMass(name="AirGap", r_value=Slider(0.42, range=0..1))  # -> flatten(mat); plug-in component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
opaquemat = HBOpaqueMaterial(
    name="2x6 wall framing",
    thickness=Slider(0.0889, range=0..0.1),
    conductivity=Slider(0.041, range=0..0.1),
    density=Slider(141.25, range=0..1000),
    spec_heat=Slider(1500, range=0..10000))  # -> mat; plug-in component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
opaquemat_2 = HBOpaqueMaterial(
    name="Gypsum Board",
    thickness=division_2,
    conductivity=Slider(0.16, range=0..1),
    density=Slider(800, range=0..1000),
    spec_heat=Slider(109, range=0..1000))  # -> mat; plug-in component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
opaquemat_3 = HBOpaqueMaterial(
    name="Wood Exterior Cladding",
    thickness=Slider(0.0191, range=0..0.1),
    conductivity=Slider(0.116, range=0..1),
    density=Slider(540, range=0..1000),
    spec_heat=Slider(1210, range=0..10000))  # -> flatten(mat); plug-in component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
opaquemat_4 = HBOpaqueMaterial(
    name="ContExtInsulation",
    thickness=Slider(0.051, range=0..0.1),
    conductivity=Slider(0.036, range=0..0.1),
    density=Slider(40, range=0..100),
    spec_heat=Slider(1210, range=0..10000))  # -> mat; plug-in component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
clean = CleanTree(
    RemoveNulls=True,
    RemoveInvalid=True,
    RemoveEmpty=False,
    Tree=flatten([opaquemat_3, opaquematnomass_2, opaquemat_4, opaquemat, opaquemat_2]))
opaqueconstr = HBOpaqueConstruction(name="ExteriorWall", materials=clean)  # -> constr; plug-in component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
decnstrconstr = HBDeconstructConstruction(constr=opaqueconstr)  # -> materials, layers, r_val_si, r_val_ip, u_fac_si, u_fac_ip, t_sol, t_vis; plug-in component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
panel = Panel(clean)
one_over_x = OneOverX(Value=decnstrconstr.u_fac_ip)
r_value_of_wall_construction = Panel(one_over_x)
constructiontypes = HBConstructionTypes({"SteelFramed", "WoodFramed", "Mass", "Metal Building"}, selected="WoodFramed")
climatezones = HBClimateZones({"1 - Very Hot": "1", "2 - Hot": "2", "3 - Warm": "3", "4 - Mixed": "4", "5 - Cool": "5", "6 - Cold": "6", "7 - Very Cold": "7", "8 - Subarctic": "8"}, selected="4 - Mixed")
y = ClusterOutput(one_over_x)
constrsetclimate = HBConstructionSetByClimate(climate_zone=climatezones, constr_type=constructiontypes)  # -> constr_set; plug-in component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
list = ItemSelector(constrsetclimate, {"2013::ClimateZone4::WoodFramed"}, selected="2013::ClimateZone4::WoodFramed")
windowmat = HBWindowMaterial(name="ADU_Glazing", u_factor=flatten(".40"), shgc=flatten(".40"), t_vis=flatten(".63"))  # -> mat; plug-in component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
windowconstr = HBWindowConstruction(name="ADU_Glazing", materials=flatten(windowmat))  # -> constr; plug-in component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
decnstrconstrset = HBDeconstructConstructionSet(constr_set=list)  # -> exterior_wall, exterior_roof, exposed_floor, ground_wall, ground_roof, ground_floor, window, skylight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; plug-in component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
panel_2 = Panel(decnstrconstrset.exterior_roof)
panel_3 = Panel(opaqueconstr)
subfacesubset = HBSubfaceSubset(window=windowconstr, skylight=windowconstr, operable=windowconstr, glass_door=windowconstr)  # -> subface_set; plug-in component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
exteriorsubset = HBExteriorConstructionSubset(exterior_wall=opaqueconstr, exterior_roof=decnstrconstrset.exterior_roof, exposed_floor=decnstrconstrset.exposed_floor)  # -> exterior_set; plug-in component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
constructionset = HBConstructionSet(name="CustomConstructionSet", base_constr_set=list, exterior_subset=exteriorsubset, subface_subset=subfacesubset)  # -> constr_set; plug-in component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
constr_set = ClusterOutput(constructionset)

# ==== cluster Cluster_3
factor = ClusterInput()
C = ClusterInput()
C_2 = ClusterInput()
C_3 = ClusterInput()
C_4 = ClusterInput()
C_5 = ClusterInput()

# ----
# Geometry
unit_z = UnitZ(Factor=factor)
join = JoinCurves(Curves=C, Preserve=False)
join_2 = JoinCurves(Curves=C_2, Preserve=False)
join_3 = JoinCurves(Curves=C_3, Preserve=False)
join_4 = JoinCurves(Curves=C_4, Preserve=False)
join_5 = JoinCurves(Curves=C_5, Preserve=False)
crv = Curve([join, join_3, join_4, join_5, join_2])
extrude = Extrude(Base=crv, Direction=unit_z)
cap_holes = CapHoles(Brep=extrude)
intsolid = HBIntersectSolids(solids=flatten(cap_holes), run=Toggle(True))  # -> int_solids; plug-in component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
roomsolid = HBRoomFromSolid(geo=flatten(intsolid), conditioned=True)  # -> report, rooms; plug-in component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
solveadj = HBSolveAdjacency(rooms=flatten(roomsolid.rooms), air_boundary=Toggle(True), run=Toggle(True))  # -> report, adj_rooms; plug-in component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

adj_rooms = ClusterOutput(solveadj.adj_rooms)

# ==== cluster Cluster_4
hb_building_programs = HBBuildingPrograms({"LargeOffice", "MediumOffice", "SmallOffice", "MidriseApartment", "HighriseApartment", "Retail", "StripMall", "PrimarySchool", "SecondarySchool", "SmallHotel", "LargeHotel", "Hospital", "Outpatient", "Laboratory", "Warehouse", "SuperMarket", "FullServiceRestaurant", "QuickServiceRestaurant", "Courthouse", "LargeDataCenterHighITE", "LargeDataCenterLowITE", "SmallDataCenterHighITE", "SmallDataCenterLowITE"}, selected="MidriseApartment")
searchprog = HBSearchPrograms(bldg_prog=hb_building_programs)  # -> room_prog; plug-in component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
item_selector = ItemSelector(
    searchprog,
    {"2013::MidriseApartment::Apartment", "2013::MidriseApartment::Corridor", "2013::MidriseApartment::Office"}, selected="2013::MidriseApartment::Apartment")
crv = ClusterInput()
crv_2 = Curve(crv)
deconstrprogram = HBDeconstructProgramType(program=item_selector)  # -> people, lighting, electric_equip, gas_equip, hot_water, infiltration, ventilation, setpoint; plug-in component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
join = JoinCurves(Curves=crv_2, Preserve=False)
area = Area(Geometry=join)  # -> Area, Centroid
decnstrpeople = HBDeconstructPeople(people=deconstrprogram.people)  # -> name, ppl_per_area, occupancy_sch, activity_sch; plug-in component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
decnstrequipment = HBDeconstructEquipment(equip=deconstrprogram.electric_equip)  # -> name, watts_per_area, schedule, radiant_fract, latent_fract, lost_fract, is_gas; plug-in component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
division = Division(A=area.Area, B="10.764")
division_2 = Division(A=Slider(2, range=0..10), B=division)
equipment = HBEquipment(
    name="ADU_Plug Load",
    watts_per_area="5.278592375366569",
    schedule=decnstrequipment.schedule,
    radiant_fract=decnstrequipment.radiant_fract,
    latent_fract=decnstrequipment.latent_fract,
    lost_fract=decnstrequipment.lost_fract,
    gas=Toggle(False))  # -> equip; plug-in component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
people = HBPeople(
    name="ADU_People",
    ppl_per_area=division_2,
    occupancy_sch=decnstrpeople.occupancy_sch,
    activity_sch=decnstrpeople.activity_sch)  # -> people; plug-in component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
programtype = HBProgramType(
    name="ADU",
    people=people,
    lighting=deconstrprogram.lighting,
    electric_equip=equipment,
    gas_equip=deconstrprogram.gas_equip,
    hot_water=deconstrprogram.hot_water,
    infiltration=deconstrprogram.infiltration,
    ventilation=deconstrprogram.ventilation,
    setpoint=deconstrprogram.setpoint)  # -> program; plug-in component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
program = ClusterOutput(programtype)

# ==== cluster Cluster_5
C = ClusterInput()
F = ClusterInput()
join = JoinCurves(Curves=C, Preserve=False)
Z = UnitZ(Factor=F)
extr = Extrude(Base=join, Direction=Z)
cap = CapHoles(Brep=extr)
roomsolid = HBRoomFromSolid(geo=flatten(cap), conditioned=True)  # -> report, rooms; plug-in component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
rooms = ClusterOutput(roomsolid.rooms)

# ==== cluster FtToM
A = ClusterInput()
division = Division(A=A, B="3.281")
R = ClusterOutput(division)
