# Grasshopper definition WWR-optimization-final.gh (Grasshopper 1.0.7)
# plug-ins: Human, Bifocals

# ---- group: generate trees for radiance
number_slider = Slider(50, range=0..100)  # disabled
mesh_sphere = MeshSphere(Base=PlaneXY(0, 0, 0), Radius=10, UCount=number_slider, VCount=number_slider)  # disabled
triangulate = Triangulate(Mesh=mesh_sphere)  # -> Mesh, Count; disabled
number_slider_2 = Slider(0.27, range=0..1)  # disabled
deconstruct_mesh = DeconstructMesh(Mesh=triangulate.Mesh)  # -> Vertices, Faces, Colours, Normals; disabled
list_length = ListLength(List=deconstruct_mesh.Faces)  # disabled
multiplication = Multiplication(A=list_length, B=number_slider_2)  # disabled
series = Series(Start=0, Step=1, Count=list_length)  # disabled
random_reduce = RandomReduce(List=series, Reduction=multiplication, Seed=1)  # disabled
ghpython_script = PythonScript(x=series, y=random_reduce)  # -> a; inputs x: list, y: list; disabled
# ---------- ghpython_script: Python ----------
a = (i in y for i in x)
# ---------- end ghpython_script ----------
cull_faces = CullFaces(Mesh=triangulate.Mesh, Pattern=ghpython_script)  # disabled
colour_swatch = ColourSwatch(SwatchColor=RGB(51, 149, 66))  # disabled
custom_preview = CustomPreview(Geometry=cull_faces, Shader=colour_swatch)  # disabled

# ----
# Scenario:
panel = Panel("961 20th Ave")
galapagos = Galapagos(fitness=ma, gene=[north_wwr, east_wwr, south_wwr, west_wwr])
east_wwr = Slider(0.78, range=0..0.95)
north_wwr = Slider(0.21, range=0..0.95)
south_wwr = Slider(0.95, range=0..0.95)
west_wwr = Slider(0, range=0..0.95)

# ----
# Weather Data
panel_2 = Panel("http://climate.onebuilding.org/WMO_Region_4_North_and_Central_America/USA_United_States_of_America/WA_Washington/USA_WA_Seattle-King.County.Intl.AP-Boeing.Field.727935_TMY3.zip")
downloadepw = LBDownloadWeather(weather_URL=panel_2)  # -> epw_file, stat_file, ddy_file; plug-in component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

number_slider_3 = Slider(3081.173748, range=0..10000)
box_input = Brep(<brep referenced from the Rhino model>)
crv = Curve(<curve referenced from the Rhino model>)
cluster = Cluster(C=crv, B=box_input)  # -> i, i_2, i_3, i_4, i_5, i_6, i_7, i_8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

# ----
# Add Context
pipeline = GeometryPipeline(
    GroupByLayer=False,
    GroupByType=False,
    IncludeHidden=True,
    IncludeLocked=True,
    LayerFilter="context",
    NameFilter="*",
    SublayerFiltering=True,
    TypeFilter=1073741848)
data = Data(pipeline)

# ----
# Massing
# Geometry
panel_3 = Panel("1_zonename")
panel_4 = Panel("4_zonename")
height_ft = Panel("10")
panel_5 = Panel("2_zonename")
panel_6 = Panel("3_zonename")
outsidecrvfromrhino = Curve(flatten([cluster.i, cluster.L_3, cluster.L_4, cluster.i_5]))
outsidecrvfromrhino_2 = Curve(flatten([cluster.i_2, cluster.L_4, cluster.L, cluster.i_6]))
outsidecrvfromrhino_3 = Curve(flatten([cluster.i_3, cluster.L, cluster.L_2, cluster.i_7]))
panel_7 = Panel("5_zonename")
adiabaticcrvfromrhino = Curve(flatten([cluster.i_5, cluster.i_6, cluster.i_7, cluster.i_8]))
outsidecrvfromrhino_4 = Curve(flatten([cluster.i_4, cluster.L_3, cluster.L_2, cluster.i_8]))

cluster_2 = Cluster_3(
    C=outsidecrvfromrhino,
    C_3=outsidecrvfromrhino_2,
    C_4=outsidecrvfromrhino_3,
    C_5=outsidecrvfromrhino_4,
    C_2=adiabaticcrvfromrhino,
    factor=height_ft)
crv_2 = Curve([<curve referenced from the Rhino model> x5])
Z = UnitZ(Factor=Slider(10, range=0..10))
cluster_3 = Cluster_4(crv=[cluster.i, cluster.i_2, cluster.i_3, cluster.i_4])
cluster_4 = Cluster_5(crv=[cluster.i, cluster.i_2, cluster.i_3, cluster.i_4])
cluster_5 = Cluster_2()  # -> constr_set, y
wall_r_value = Panel(cluster_5.y)
extr = Extrude(Base=crv_2, Direction=Z)
cap = CapHoles(Brep=extr)
applyprogram = HBApplyProgramType(rooms=flatten(cluster_4), program=cluster_3)  # -> report, rooms; plug-in component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
applyconstrset = HBApplyConstructionSet(rooms=applyprogram.rooms, constr_set=cluster_5.constr_set)  # -> rooms; plug-in component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
roomsolid = HBRoomFromSolid(geo=flatten(cap), conditioned=True)  # -> report, rooms; plug-in component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
aperturesbyratio = HBAperturesByRatio(hb_objs=flatten(applyconstrset), ratio=[north_wwr, east_wwr, south_wwr, west_wwr])  # -> report, hb_objs; plug-in component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

# ----
# View Zones
allzones = Data(aperturesbyratio.hb_objs)
vizbytype = HBVisualizeByType(hb_objs=allzones)  # -> walls, interior_walls, roofs, ceilings, exterior_floors, interior_floors, air_walls, apertures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; plug-in component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

boolean_toggle = BooleanToggle(False)
shade = HBShade(geo=data)  # -> report, shades; plug-in component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
annualloads = HBAnnualLoads(
    rooms=aperturesbyratio.hb_objs,
    shades=shade.shades,
    epw_file=downloadepw.epw_file,
    timestep=Slider(1, range=0..10),
    run_bal=boolean_toggle,
    run=boolean_toggle)  # -> report, total_load, cooling, heating, lighting, equip, hot_water, balance; plug-in component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
panel_8 = Panel(annualloads.total_load)
ma = MassAddition(Input=annualloads.total_load)  # -> Result, PartialResults
panel_9 = Panel(ma.Result)
model = HBModel(rooms=flatten(aperturesbyratio.hb_objs))  # -> report, model; plug-in component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

# ----
# Simulation Inputs
# Simulation Folder Name:
# Simulation Name:
# .sql Filepath:
path = GhPythonScript()  # -> out, path
# ---------- path: Python ----------
__author__ = "tmendeze"


import studio2021

path = studio2021.TEMP
# ---------- end path ----------
panel_10 = Panel(panel)
panel_11 = Panel(path.path)
time_stamp = GhPythonScript(name=panel_10)  # -> out, name
# ---------- time_stamp: Python ----------
__author__ = "tmendeze"

import rhinoscriptsyntax as rs
if run:
    import datetime
    time = datetime.datetime.now().strftime('%Y%m%d%H%M')
    name_ = '{}_{}'.format(name, time)
    print(name_)
else:
    name_=name
# ---------- end time_stamp ----------
csv_path = GhPythonScript(path=path.path, sim_name=time_stamp.name)  # -> out, sql_path
# ---------- csv_path: Python ----------
__author__ = "tmendeze"
__version__ = "2021.03.02"

import rhinoscriptsyntax as rs
import os
sql = os.path.join('OpenStudio','run','eplusout.sql')
sql_path = os.path.join(path, sim_name, sql)
# ---------- end csv_path ----------
panel_12 = Panel(csv_path.sql_path)

toggle = BooleanToggle(False)
solveadj = HBSolveAdjacency(rooms=flatten(roomsolid.rooms), air_boundary=Toggle(True), run=Toggle(True))  # -> report, adj_rooms; plug-in component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
modeltoosm = HBModelToOSM(model=model.model, epw_file=downloadepw.epw_file, write=toggle, run=toggle)  # -> report, jsons, osw, osm, idf, sql, zsz, rdd, html; plug-in component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
bldgprograms = HBBuildingPrograms({"LargeOffice", "MediumOffice", "SmallOffice", "MidriseApartment", "HighriseApartment", "Retail", "StripMall", "PrimarySchool", "SecondarySchool", "SmallHotel", "LargeHotel", "Hospital", "Outpatient", "Laboratory", "Warehouse", "SuperMarket", "FullServiceRestaurant", "QuickServiceRestaurant", "Courthouse", "LargeDataCenterHighITE", "LargeDataCenterLowITE", "SmallDataCenterHighITE", "SmallDataCenterLowITE"}, selected="MidriseApartment")
faceenergyattr = HBFaceEnergyAttributes({"Construction": "properties.energy.construction.display_name", "Materials": "properties.energy.construction.layers", "R-Value": "properties.energy.construction.r_value", "U-Value": "properties.energy.construction.u_value", "U-Factor": "properties.energy.construction.u_factor", "Solar Transmitance [Unshaded]": "properties.energy.construction.solar_transmittance", "Solar Reflectance [Outside]": "properties.energy.construction.outside_solar_reflectance", "Solar Reflectance [Inside]": "properties.energy.construction.inside_solar_reflectance", "Fraction Area Operable": "properties.energy.vent_opening.fraction_area_operable", "Fraction Height Operable": "properties.energy.vent_opening.fraction_height_operable", "Discharge Coefficient": "properties.energy.vent_opening.discharge_coefficient", "Cross Ventilation": "properties.energy.vent_opening.wind_cross_vent"}, selected="U-Factor")
faceattr = HBFaceAttributes({"Display Name": "display_name", "Simulation Name (Identifier)": "identifier", "Boundary Condition": "boundary_condition", "Has Parent": "has_parent", "Parent": "parent", "Area": "area", "Perimeter": "perimeter", "Face Type": "type", "Aperture Is Operable": "is_operable", "Door Is Glass": "is_glass"}, selected="Boundary Condition")
searchmats = HBSearchMaterials(keywords="Concrete")  # -> opaque_mats, window_mats; plug-in component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
eui = HBEndUseIntensity(sql=modeltoosm.sql, ip=Toggle(True))  # -> eui, eui_end_use, end_uses, gross_floor; plug-in component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
searchprog = HBSearchPrograms(bldg_prog=bldgprograms)  # -> room_prog; plug-in component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
lablefaces = HBLabelFaces(hb_objs=flatten(model.model), attribute=faceattr)  # -> label_text, base_pts, labels, wire_frame; plug-in component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

# ----
# Simulation Outputs
# Output Folder Name:
csv_path_2 = GhPythonScript(path=path.path, sim_name=time_stamp.name)  # -> out, csv_path
# ---------- csv_path_2: Python ----------
__author__ = "tmendeze"
__version__ = "2021.03.02"

import rhinoscriptsyntax as rs
import os
csv_path = os.path.join(path, sim_name+".csv")
# ---------- end csv_path_2 ----------
panel_13 = Panel(csv_path_2.csv_path)

list = ItemSelector(
    searchmats.opaque_mats,
    {"100mm Normalweight concrete floor", "12 in. Normalweight Concrete Floor", "4 in. Normalweight Concrete Floor", "4 in. Normalweight Concrete Wall", "6 in. Heavyweight Concrete Roof", "6 in. Normalweight Concrete Floor", "8 in. Concrete Block Basement Wall", "8 in. Concrete Block Wall", "8 in. Normalweight Concrete Floor", "8 in. Normalweight Concrete Wall", "8IN CONCRETE HW RefBldg", "8IN Concrete HW", "Generic HW Concrete", "Generic LW Concrete", "HW CONCRETE", "HW CONCRETE 8 in", "M11 100mm lightweight concrete", "M15 200mm heavyweight concrete", "MAT-CC05 4 HW CONCRETE", "MAT-CC05 8 HW CONCRETE", "NACM_Concrete 4in_140lb/ft3"}, selected="100mm Normalweight concrete floor")
list_2 = ItemSelector(
    searchprog,
    {"2013::MidriseApartment::Apartment", "2013::MidriseApartment::Corridor", "2013::MidriseApartment::Office"}, selected="2013::MidriseApartment::Apartment")
panel_14 = Panel(eui.eui)
panel_15 = Panel("77.671")
panel_16 = Panel("80.723")
panel_17 = Panel(modeltoosm.report)
opaqueconstr = HBOpaqueConstruction(materials=list)  # -> constr; plug-in component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
deconstrprogram = HBDeconstructProgramType(program=list_2)  # -> people, lighting, electric_equip, gas_equip, hot_water, infiltration, ventilation, setpoint; plug-in component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
exteriorsubset = HBExteriorConstructionSubset(exposed_floor=opaqueconstr)  # -> exterior_set; plug-in component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
decnstrequipment = HBDeconstructEquipment(equip=deconstrprogram.electric_equip)  # -> name, watts_per_area, schedule, radiant_fract, latent_fract, lost_fract, is_gas; plug-in component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
constructionset = HBConstructionSet(exterior_subset=exteriorsubset)  # -> constr_set; plug-in component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
equipment = HBEquipment(
    name="NewEQ",
    watts_per_area=Slider(3, range=0..10),
    schedule=decnstrequipment.schedule,
    radiant_fract=decnstrequipment.radiant_fract,
    latent_fract=decnstrequipment.latent_fract,
    lost_fract=decnstrequipment.lost_fract,
    gas=decnstrequipment.is_gas)  # -> equip; plug-in component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
programtype = HBProgramType(name="NewProgram", base_program=list_2, electric_equip=equipment)  # -> program; plug-in component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
applyprogram_2 = HBApplyProgramType(rooms=flatten(solveadj.adj_rooms), program=list_2)  # -> report, rooms; plug-in component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
aperturesbyratio_2 = HBAperturesByRatio(
    hb_objs=flatten(applyprogram_2.rooms),
    ratio=[Slider(0.5, range=0..1), Slider(0.2, range=0..1), Slider(0.4, range=0..1), Slider(0.4, range=0..1)])  # -> report, hb_objs; plug-in component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
vizbytype_2 = HBVisualizeByType(hb_objs=aperturesbyratio_2.hb_objs)  # -> walls, interior_walls, roofs, ceilings, exterior_floors, interior_floors, air_walls, apertures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; plug-in component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
annualloads_2 = HBAnnualLoads(rooms=aperturesbyratio_2.hb_objs, run=Toggle(True))  # -> report, total_load, cooling, heating, lighting, equip, hot_water, balance; plug-in component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
model_2 = HBModel(rooms=flatten(aperturesbyratio_2.hb_objs))  # -> report, model; plug-in component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
toggle_2 = BooleanToggle(True)
modeltoosm_2 = HBModelToOSM(model=model_2.model, write=toggle_2, run=toggle_2)  # -> report, jsons, osw, osm, idf, sql, zsz, rdd, html; plug-in component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
faceenergyattr_2 = HBFaceEnergyAttributes({"Construction": "properties.energy.construction.display_name", "Materials": "properties.energy.construction.layers", "R-Value": "properties.energy.construction.r_value", "U-Value": "properties.energy.construction.u_value", "U-Factor": "properties.energy.construction.u_factor", "Solar Transmitance [Unshaded]": "properties.energy.construction.solar_transmittance", "Solar Reflectance [Outside]": "properties.energy.construction.outside_solar_reflectance", "Solar Reflectance [Inside]": "properties.energy.construction.inside_solar_reflectance", "Fraction Area Operable": "properties.energy.vent_opening.fraction_area_operable", "Fraction Height Operable": "properties.energy.vent_opening.fraction_height_operable", "Discharge Coefficient": "properties.energy.vent_opening.discharge_coefficient", "Cross Ventilation": "properties.energy.vent_opening.wind_cross_vent"}, selected="U-Factor")
faceattr_2 = HBFaceAttributes({"Display Name": "display_name", "Simulation Name (Identifier)": "identifier", "Boundary Condition": "boundary_condition", "Has Parent": "has_parent", "Parent": "parent", "Area": "area", "Perimeter": "perimeter", "Face Type": "type", "Aperture Is Operable": "is_operable", "Door Is Glass": "is_glass"}, selected="Boundary Condition")
eui_2 = HBEndUseIntensity(sql=modeltoosm_2.sql, ip=Toggle(True))  # -> eui, eui_end_use, end_uses, gross_floor; plug-in component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
lablefaces_2 = HBLabelFaces(hb_objs=flatten(model_2.model), attribute=faceattr_2)  # -> label_text, base_pts, labels, wire_frame; plug-in component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
panel_18 = Panel(eui_2.eui)
panel_19 = Panel(modeltoosm_2.report)

# ==== cluster Cluster
C = ClusterInput()
explode = Explode(Curve=C, Recursive=True)  # -> Segments, Vertices
B = ClusterInput()
item = ListItem(List=explode.Segments, Index=Slider(1, range=0..3), Wrap=True)
edges = BrepEdges(Brep=B)  # -> Naked, Interior, NonManifold
item_2 = ListItem(List=explode.Segments, Index=Slider(0, range=0..3), Wrap=True)
item_3 = ListItem(List=explode.Segments, Index=Slider(2, range=0..3), Wrap=True)
item_4 = ListItem(List=explode.Segments, Index=Slider(3, range=0..3), Wrap=True)
item_5 = ListItem(List=edges.Interior, Index=0, Wrap=True)
midpt = CurveMiddle(Curve=item_5)
midpt_2 = CurveMiddle(Curve=item_4)
X = UnitX(Factor=Slider(8, range=0..100))
X_2 = UnitX(Factor=Slider(20, range=0..100))  # -> expr("-x", UnitVector)
Y = UnitY(Factor=Slider(5, range=0..100))  # -> expr("-x", UnitVector)
Y_2 = UnitY(Factor=Slider(5, range=0..100))
move = Move(Geometry=item_4, Motion=X)  # -> Geometry, Transform
move_2 = Move(Geometry=item, Motion=X_2)  # -> Geometry, Transform
move_3 = Move(Geometry=item_2, Motion=Y_2)  # -> Geometry, Transform
move_4 = Move(Geometry=item_3, Motion=Y)  # -> Geometry, Transform
pdecon = Deconstruct(Point=midpt)  # -> XComponent, YComponent, ZComponent
pdecon_2 = Deconstruct(Point=midpt_2)  # -> XComponent, YComponent, ZComponent
pt = ConstructPoint(XCoordinate=pdecon.XComponent, YCoordinate=pdecon_2.YComponent, ZCoordinate=0)
ptuvcrvs = IntersectCurves(CU=[move_2.Geometry, move.Geometry], CV=[move_4.Geometry, move_3.Geometry])
dist = Distance(PointA=pt, PointB=midpt_2)
subtraction = Subtraction(A=dist, B=Slider(5, range=0..10))
X_3 = UnitX(Factor=subtraction)
item_6 = ListItem(List=flatten(ptuvcrvs), Index=Slider(3, range=0..4), Wrap=True)
item_7 = ListItem(List=flatten(ptuvcrvs), Index=Slider(0, range=0..4), Wrap=True)
move_5 = Move(Geometry=item_4, Motion=X_3)  # -> Geometry, Transform
end = EndPoints(Curve=move_5.Geometry)  # -> Start, End
pdecon_3 = Deconstruct(Point=end.Start)  # -> XComponent, YComponent, ZComponent
pdecon_4 = Deconstruct(Point=item_7)  # -> XComponent, YComponent, ZComponent
rec_2pt = Rectangle2Pt(Plane=PlaneXY(0, 0, 0), PointA=item_6, PointB=item_7, Radius=0)  # -> Rectangle, Length
pt_2 = ConstructPoint(XCoordinate=pdecon_3.XComponent, YCoordinate=pdecon_4.YComponent, ZCoordinate=0)
rec_2pt_2 = Rectangle2Pt(Plane=PlaneXY(0, 0, 0), PointA=pt_2, PointB=item_6, Radius=0)  # -> Rectangle, Length
crv = Curve(rec_2pt_2.Rectangle)
explode_2 = Explode(Curve=crv, Recursive=True)  # -> Segments, Vertices
item_8 = ListItem(List=explode_2.Segments, Index=Slider(1, range=0..1), Wrap=True)
len = Length(Curve=item_8)
division = Division(A=len, B=Slider(-3.333, range=-10..10))
offset = OffsetCurve(Curve=crv, Distance=division, Plane=PlaneXY(0, 0, 0), Corners=1)
explode_3 = Explode(Curve=offset, Recursive=True)  # -> Segments, Vertices
item_9 = ListItem(List=explode_2.Vertices, Index=Slider(0, range=0..100), Wrap=True)
item_10 = ListItem(List=explode_2.Vertices, Index=Slider(1, range=0..100), Wrap=True)
item_11 = ListItem(List=explode_2.Vertices, Index=Slider(2, range=0..100), Wrap=True)
item_12 = ListItem(List=explode_2.Vertices, Index=Slider(3, range=0..100), Wrap=True)
item_13 = ListItem(List=explode_3.Vertices, Index=Slider(0, range=0..100), Wrap=True)
item_14 = ListItem(List=explode_3.Vertices, Index=Slider(1, range=0..100), Wrap=True)
item_15 = ListItem(List=explode_3.Vertices, Index=Slider(2, range=0..100), Wrap=True)
item_16 = ListItem(List=explode_3.Vertices, Index=Slider(3, range=0..100), Wrap=True)
item_17 = ListItem(List=explode_2.Segments, Index=Slider(0, range=0..100), Wrap=True)
item_18 = ListItem(List=explode_2.Segments, Index=Slider(1, range=0..100), Wrap=True)
item_19 = ListItem(List=explode_2.Segments, Index=Slider(2, range=0..100), Wrap=True)
item_20 = ListItem(List=explode_2.Segments, Index=Slider(3, range=0..100), Wrap=True)
ln = Line(StartPoint=item_11, EndPoint=item_15)
ln_2 = Line(StartPoint=item_12, EndPoint=item_16)
item_21 = ListItem(List=explode_3.Segments, Index=Slider(0, range=0..100), Wrap=True)
item_22 = ListItem(List=explode_3.Segments, Index=Slider(1, range=0..100), Wrap=True)
ln_3 = Line(StartPoint=item_9, EndPoint=item_13)
ln_4 = Line(StartPoint=item_10, EndPoint=item_14)
item_23 = ListItem(List=explode_3.Segments, Index=Slider(2, range=0..100), Wrap=True)
item_24 = ListItem(List=explode_3.Segments, Index=Slider(3, range=0..100), Wrap=True)
i = ClusterOutput(item_17)
i_2 = ClusterOutput(item_18)
i_3 = ClusterOutput(item_19)
i_4 = ClusterOutput(item_20)
L = ClusterOutput(ln)
L_2 = ClusterOutput(ln_2)
L_3 = ClusterOutput(ln_3)
L_4 = ClusterOutput(ln_4)
i_5 = ClusterOutput(item_21)
i_6 = ClusterOutput(item_22)
i_7 = ClusterOutput(item_23)
i_8 = ClusterOutput(item_24)

# ==== cluster Cluster_2
r_per_in = Slider(4, range=0..10)
multiplication = Multiplication(A=r_per_in, InsulationThickness=Slider(1, range=0..1))
division = Division(A=multiplication, B=5.67826)
opaquematnomass = HBOpaqueMaterialNoMass(name="AirGap", r_value=Slider(1, range=0..1))  # -> flatten(mat); plug-in component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
opaquematnomass_2 = HBOpaqueMaterialNoMass(name="ContExtInsulation", r_value=division)  # -> mat; plug-in component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
opaquemat = HBOpaqueMaterial(
    name="2x6 wall framing",
    thickness=Slider(0.0889, range=0..0.1),
    conductivity=Slider(0.041, range=0..0.1),
    density=Slider(141.25, range=0..1000),
    spec_heat=Slider(2300, range=0..10000))  # -> mat; plug-in component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
opaquemat_2 = HBOpaqueMaterial(
    name="Gypsum Board",
    thickness=Slider(0.5, range=0..1),
    conductivity=Slider(0.16, range=0..1),
    density=Slider(800, range=0..1000),
    spec_heat=Slider(109, range=0..1000))  # -> mat; plug-in component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
opaquemat_3 = HBOpaqueMaterial(
    name="Wood Exterior Cladding",
    thickness=Slider(0.0191, range=0..0.1),
    conductivity=Slider(0.116, range=0..1),
    density=Slider(540, range=0..1000),
    spec_heat=Slider(1210, range=0..10000))  # -> flatten(mat); plug-in component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
clean = CleanTree(
    RemoveNulls=True,
    RemoveInvalid=True,
    RemoveEmpty=False,
    Tree=flatten([opaquemat_3, opaquematnomass, opaquematnomass_2, opaquemat, opaquemat_2]))
opaqueconstr = HBOpaqueConstruction(name="ExteriorWall", materials=clean)  # -> constr; plug-in component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
decnstrconstr = HBDeconstructConstruction(constr=opaqueconstr)  # -> materials, layers, r_val_si, r_val_ip, u_fac_si, u_fac_ip, t_sol, t_vis; plug-in component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
panel = Panel(clean)
one_over_x = OneOverX(Value=decnstrconstr.u_fac_ip)
r_value_of_wall_construction = Panel(one_over_x)
constructiontypes = HBConstructionTypes({"SteelFramed", "WoodFramed", "Mass", "Metal Building"}, selected="WoodFramed")
climatezones = HBClimateZones({"1 - Very Hot": "1", "2 - Hot": "2", "3 - Warm": "3", "4 - Mixed": "4", "5 - Cool": "5", "6 - Cold": "6", "7 - Very Cold": "7", "8 - Subarctic": "8"}, selected="4 - Mixed")
y = ClusterOutput(one_over_x)
constrsetclimate = HBConstructionSetByClimate(climate_zone=climatezones, constr_type=constructiontypes)  # -> constr_set; plug-in component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
list = ItemSelector(constrsetclimate, {"2013::ClimateZone4::WoodFramed"}, selected="2013::ClimateZone4::WoodFramed")
windowmat = HBWindowMaterial(name="ADU_Glazing", u_factor=flatten(".40"), shgc=flatten(".40"), t_vis=flatten(".63"))  # -> mat; plug-in component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
windowconstr = HBWindowConstruction(name="ADU_Glazing", materials=flatten(windowmat))  # -> constr; plug-in component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
decnstrconstrset = HBDeconstructConstructionSet(constr_set=list)  # -> exterior_wall, exterior_roof, exposed_floor, ground_wall, ground_roof, ground_floor, window, skylight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; plug-in component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
panel_2 = Panel(decnstrconstrset.exterior_roof)
exteriorsubset = HBExteriorConstructionSubset(exterior_wall=opaqueconstr, exterior_roof=decnstrconstrset.exterior_roof, exposed_floor=decnstrconstrset.exposed_floor)  # -> exterior_set; plug-in component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
groundsubset = HBGroundConstructionSubset(
    ground_wall=decnstrconstrset.ground_wall,
    ground_roof=decnstrconstrset.ground_roof,
    ground_floor=decnstrconstrset.ground_floor)  # -> ground_set; plug-in component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
subfacesubset = HBSubfaceSubset(window=windowconstr, skylight=windowconstr, operable=windowconstr, glass_door=windowconstr)  # -> subface_set; plug-in component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
constructionset = HBConstructionSet(
    name="CustomConstructionSet",
    base_constr_set=list,
    exterior_subset=exteriorsubset,
    ground_subset=groundsubset,
    subface_subset=subfacesubset)  # -> constr_set; plug-in component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
constr_set = ClusterOutput(constructionset)

# ==== cluster Cluster_3
factor = ClusterInput()
C = ClusterInput()
C_2 = ClusterInput()
C_3 = ClusterInput()
C_4 = ClusterInput()
C_5 = ClusterInput()

# ----
# Geometry
unit_z = UnitZ(Factor=factor)
join = JoinCurves(Curves=C, Preserve=False)
join_2 = JoinCurves(Curves=C_2, Preserve=False)
join_3 = JoinCurves(Curves=C_3, Preserve=False)
join_4 = JoinCurves(Curves=C_4, Preserve=False)
join_5 = JoinCurves(Curves=C_5, Preserve=False)
crv = Curve([join, join_3, join_4, join_5, join_2])
extrude = Extrude(Base=crv, Direction=unit_z)
cap_holes = CapHoles(Brep=extrude)
roomsolid = HBRoomFromSolid(geo=flatten(cap_holes), conditioned=True)  # -> report, rooms; plug-in component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
solveadj = HBSolveAdjacency(rooms=flatten(roomsolid.rooms), air_boundary=Toggle(True), run=Toggle(True))  # -> report, adj_rooms; plug-in component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

adj_rooms = ClusterOutput(solveadj.adj_rooms)

# ==== cluster Cluster_4
hb_building_programs = HBBuildingPrograms({"LargeOffice", "MediumOffice", "SmallOffice", "MidriseApartment", "HighriseApartment", "Retail", "StripMall", "PrimarySchool", "SecondarySchool", "SmallHotel", "LargeHotel", "Hospital", "Outpatient", "Laboratory", "Warehouse", "SuperMarket", "FullServiceRestaurant", "QuickServiceRestaurant", "Courthouse", "LargeDataCenterHighITE", "LargeDataCenterLowITE", "SmallDataCenterHighITE", "SmallDataCenterLowITE"}, selected="MidriseApartment")
searchprog = HBSearchPrograms(bldg_prog=hb_building_programs)  # -> room_prog; plug-in component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
item_selector = ItemSelector(
    searchprog,
    {"2013::MidriseApartment::Apartment", "2013::MidriseApartment::Corridor", "2013::MidriseApartment::Office"}, selected="2013::MidriseApartment::Apartment")
crv = ClusterInput()
crv_2 = Curve(crv)
deconstrprogram = HBDeconstructProgramType(program=item_selector)  # -> people, lighting, electric_equip, gas_equip, hot_water, infiltration, ventilation, setpoint; plug-in component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
join = JoinCurves(Curves=crv_2, Preserve=False)
area = Area(Geometry=join)  # -> Area, Centroid
decnstrpeople = HBDeconstructPeople(people=deconstrprogram.people)  # -> name, ppl_per_area, occupancy_sch, activity_sch; plug-in component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
decnstrequipment = HBDeconstructEquipment(equip=deconstrprogram.electric_equip)  # -> name, watts_per_area, schedule, radiant_fract, latent_fract, lost_fract, is_gas; plug-in component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
division = Division(A=area.Area, B="10.764")
division_2 = Division(A=Slider(2, range=0..10), B=division)
equipment = HBEquipment(
    name="ADU_Plug Load",
    watts_per_area="5.278592375366569",
    schedule=decnstrequipment.schedule,
    radiant_fract=decnstrequipment.radiant_fract,
    latent_fract=decnstrequipment.latent_fract,
    lost_fract=decnstrequipment.lost_fract,
    gas=Toggle(False))  # -> equip; plug-in component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
people = HBPeople(
    name="ADU_People",
    ppl_per_area=division_2,
    occupancy_sch=decnstrpeople.occupancy_sch,
    activity_sch=decnstrpeople.activity_sch)  # -> people; plug-in component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
programtype = HBProgramType(
    name="ADU",
    people=people,
    lighting=deconstrprogram.lighting,
    electric_equip=equipment,
    gas_equip=deconstrprogram.gas_equip,
    hot_water=deconstrprogram.hot_water,
    infiltration=deconstrprogram.infiltration,
    ventilation=deconstrprogram.ventilation,
    setpoint=deconstrprogram.setpoint)  # -> program; plug-in component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
item_selector_2 = ClusterOutput(item_selector)

# ==== cluster Cluster_5
crv = ClusterInput()
crv_2 = Curve(crv)
join = JoinCurves(Curves=crv_2, Preserve=False)
Z = UnitZ(Factor=Slider(10, range=0..10))
extr = Extrude(Base=join, Direction=Z)
cap = CapHoles(Brep=extr)
roomsolid = HBRoomFromSolid(geo=flatten(cap), conditioned=True)  # -> report, rooms; plug-in component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
rooms = ClusterOutput(roomsolid.rooms)
