# Grasshopper definition galapagos-final.gh (Grasshopper 1.0.7)
# plug-ins: Human

panel = Panel("""0
10
10
10
10
10
10
12
10
10
10
10
10
10""")
panel_2 = Panel("""0
10
15
22
20
15
20
20
15""")
line = Line(Line((340.7623143, -35.22194176, 0), (362.6008838, -35.22194176, 0)))
line_2 = Line(Line((340.5992306, -34.76613074, 0), (340.5992306, -26.76912765, 0)))
pt = Point(Point(341.1505179, -34.02616586, 0))
make_grid = GhPythonScript(
    sp=pt,
    span_x=panel,
    span_y=panel_2,
    xaxis=line,
    yaxis=line_2,
    height=Slider(1.03, range=0..20),
    core=[Slider(5, range=0..10), Slider(6, range=0..10), Slider(6, range=0..10), Slider(1, range=0..10)])  # -> out, columns, beams_x, beams_y, cores; inputs span_x: list, span_y: list, core: list of Int32
# ---------- make_grid: Python ----------
import rhinoscriptsyntax as rs

from studio2021.functions import make_grid
reload(make_grid)
from studio2021.functions.make_grid import make_grid_structure


columns, beams_x, beams_y, cores = make_grid_structure(sp,
                                                       span_x,
                                                       span_y,
                                                       xaxis,
                                                       yaxis,
                                                       height,
                                                       core)
# ---------- end make_grid ----------
crv = Curve([<curve referenced from the Rhino model> x2])
num_floors_above = Slider(10, range=0..10)
trim_grid = GhPythonScript(polyline=crv, columns=make_grid.columns, beams_x=make_grid.beams_x, beams_y=make_grid.beams_y)  # -> out, columns, beams_x, beams_y, cores; inputs polyline: list, columns: list, beams_x: list, beams_y: list, cores: list
# ---------- trim_grid: Python ----------
import rhinoscriptsyntax as rs

from studio2021.functions import make_grid
reload(make_grid)
from studio2021.functions.make_grid import trim_structure


columns, beams_x, beams_y, cores = trim_structure(polyline,
                                                  columns,
                                                  beams_x,
                                                  beams_y,
                                                  cores)
# ---------- end trim_grid ----------
building_type = ValueList({"Type 3", "Type 4A", "Type 4B", "Type 4C", "Type 5"}, selected="Type 4A")
composite_slab = BooleanToggle(True)
beams_x = Curve(trim_grid.beams_x)
beams_y = Curve(trim_grid.beams_y)
columns = Curve(trim_grid.columns)
cores = Curve(trim_grid.cores)
core_from_rhino = Curve(flatten(<curve referenced from the Rhino model>))
columns_from_rhino = Curve(flatten([<curve referenced from the Rhino model> x42]))
beams_y_from_rhino = Curve(flatten([<curve referenced from the Rhino model> x36]))
beams_x_from_rhino = Curve(flatten([<curve referenced from the Rhino model> x35]))
panel_3 = Panel(trim_grid.out)
beams_x_2 = Curve(flatten(beams_x))
core = Curve(flatten(cores))
columns_2 = Curve(flatten(columns))
beams_y_2 = Curve(flatten(beams_y))

# ---- group: generate trees for radiance
# % to keep
number_slider = Slider(50, range=0..100)  # disabled
mesh_sphere = MeshSphere(Base=PlaneXY(0, 0, 0), Radius=10, UCount=number_slider, VCount=number_slider)  # disabled
triangulate = Triangulate(Mesh=mesh_sphere)  # -> Mesh, Count; disabled
number_slider_2 = Slider(0.27, range=0..1)  # disabled
deconstruct_mesh = DeconstructMesh(Mesh=triangulate.Mesh)  # -> Vertices, Faces, Colours, Normals; disabled
list_length = ListLength(List=deconstruct_mesh.Faces)  # disabled
multiplication = Multiplication(A=list_length, B=number_slider_2)  # disabled
series = Series(Start=0, Step=1, Count=list_length)  # disabled
random_reduce = RandomReduce(List=series, Reduction=multiplication, Seed=1)  # disabled
ghpython_script = PythonScript(x=series, y=random_reduce)  # -> a; inputs x: list, y: list; disabled
# ---------- ghpython_script: Python ----------
a = (i in y for i in x)
# ---------- end ghpython_script ----------
cull_faces = CullFaces(Mesh=triangulate.Mesh, Pattern=ghpython_script)  # disabled
colour_swatch = ColourSwatch(SwatchColor=RGB(51, 149, 66))  # disabled
custom_preview = CustomPreview(Geometry=cull_faces, Shader=colour_swatch)  # disabled

# ----
box_input = Brep(<brep referenced from the Rhino model>)
crv_2 = Curve(<curve referenced from the Rhino model>)
findbuildablearea = FindBuildableArea(C=crv_2, B=box_input)
crv_3 = Curve(findbuildablearea)
explode = Explode(Curve=crv_3, Recursive=True)  # -> Segments, Vertices
item = ListItem(List=explode.Segments, Index=Slider(1, range=0..1), Wrap=True)
len = Length(Curve=item)
division = Division(A=len, B=Slider(-3.333, range=-10..10))
offset = OffsetCurve(Curve=crv_3, Distance=division, Plane=PlaneXY(0, 0, 0), Corners=1)
explode_2 = Explode(Curve=offset, Recursive=True)  # -> Segments, Vertices
item_2 = ListItem(List=explode.Vertices, Index=Slider(0, range=0..100), Wrap=True)
item_3 = ListItem(List=explode.Vertices, Index=Slider(1, range=0..100), Wrap=True)
item_4 = ListItem(List=explode.Vertices, Index=Slider(2, range=0..100), Wrap=True)
item_5 = ListItem(List=explode.Vertices, Index=Slider(3, range=0..100), Wrap=True)
# custom building program- what to use for ADU?
# 
# 1 zone or 5 zones?
# 
# if window shade values are all set to zero, can i ignore that portion as well?
# -will they generate nothing and count as nothing towards simulation?
# 
# data visualization//analysis?
# -should i try and make use of plotly and the csv output still or has progress been made on the json i/o?
# 
# what is assembly of ceiling/roof?
# 
# R value of slab on grade?
number_slider_3 = Slider(0, range=0..100)
item_6 = ListItem(List=explode_2.Vertices, Index=Slider(0, range=0..100), Wrap=True)
item_7 = ListItem(List=explode_2.Vertices, Index=Slider(1, range=0..100), Wrap=True)
item_8 = ListItem(List=explode_2.Vertices, Index=Slider(2, range=0..100), Wrap=True)
item_9 = ListItem(List=explode_2.Vertices, Index=Slider(3, range=0..100), Wrap=True)
item_10 = ListItem(List=explode.Segments, Index=number_slider_3, Wrap=True)
item_11 = ListItem(List=explode.Segments, Index=Slider(1, range=0..100), Wrap=True)
item_12 = ListItem(List=explode.Segments, Index=Slider(2, range=0..100), Wrap=True)
item_13 = ListItem(List=explode.Segments, Index=Slider(3, range=0..100), Wrap=True)
ln = Line(StartPoint=item_4, EndPoint=item_8)
ln_2 = Line(StartPoint=item_5, EndPoint=item_9)
item_14 = ListItem(List=explode_2.Segments, Index=Slider(0, range=0..100), Wrap=True)
item_15 = ListItem(List=explode_2.Segments, Index=Slider(1, range=0..100), Wrap=True)
ln_3 = Line(StartPoint=item_2, EndPoint=item_6)
ln_4 = Line(StartPoint=item_3, EndPoint=item_7)
item_16 = ListItem(List=explode_2.Segments, Index=Slider(2, range=0..100), Wrap=True)
item_17 = ListItem(List=explode_2.Segments, Index=Slider(3, range=0..100), Wrap=True)

# ----
# Massing
# Geometry
adiabaticcrvfromrhino = Curve(item_16)
adiabaticcrvfromrhino_2 = Curve(item_14)
adiabaticcrvfromrhino_3 = Curve(item_15)
adiabaticcrvfromrhino_4 = Curve(item_17)
outsidecrvfromrhino = Curve([item_13, ln_3, ln_2])
outsidecrvfromrhino_2 = Curve([item_10, ln_3, ln_4])
outsidecrvfromrhino_3 = Curve([item_12, ln, ln_2])
outsidecrvfromrhino_4 = Curve([item_11, ln_4, ln])
adiabaticcrvfromrhino_5 = Curve([item_14, item_15, item_16, item_17])
height_ft = Panel("10")

# ----
# Choose
# Location!
list = ValueList({"Seattle, WA": 0, "Milwaukee, WI": 1, "San Antonio, TX": 2}, selected="Seattle, WA")

# ----
# Scenario:
panel_4 = Panel("961 20th Ave")
ext_insulation_thickness_in = Slider(0, range=0..12)
int_insulation = ValueList({"Fiberglass", "Cellulose", "None"}, selected="Fiberglass")

# ----
# Construction Options
facade_cladding = ValueList({"Brick", "Fiber Cement", "Metal Panel": "Steel Panel", "Wood"}, selected="Wood")
ext_insulation = ValueList({"EPS", "Polyiso", "Rockwool"}, selected="EPS")
exterior_wall_framing = ValueList({"CLT", "Concrete", "2x4 Wood Studs", "2x6 Wood Studs", "2x8 Wood Studs", "2x10 Wood Studs", "2x12 Wood Studs"}, selected="2x8 Wood Studs")
interior_finish = ValueList({"Gyp", "None"}, selected="Gyp")

north_horizontal_shade_depth_in = Slider(0, range=0..100)
north_e_vertical_shade_depth_in = Slider(0, range=0..100)
north_w_vertical_shade_depth_in = Slider(0, range=0..100)
south_w_vertical_shade_depth_in = Slider(0, range=0..100)
south_horizontal_shade_depth_in = Slider(0, range=0..100)
south_e_vertical_shade_depth_in = Slider(0, range=0..100)
east_n_vertical_shade_depth_in = Slider(0, range=0..100)
east_shade_horizontal_depth_in = Slider(0, range=0..100)
east_s_vertical_shade_depth_in = Slider(0, range=0..100)
west_shade_horizontal_depth_in = Slider(0, range=0..100)
west_n_vertical_shade_depth_in = Slider(0, range=0..100)
west_s_vertical_shade_depth_in = Slider(0, range=0..100)

# ----
# INPUTS
# Run Energy
# Simulation
run_energy_simulation = BooleanToggle(False)

# ----
# Simulation Inputs
# Simulation Folder Name:
# multifamily apt - program type
# Simulation Name:
# .sql Filepath:
path = GhPythonScript()  # -> out, path
# ---------- path: Python ----------
__author__ = "tmendeze"


import studio2021

path = studio2021.TEMP
# ---------- end path ----------
panel_5 = Panel(panel_4)
panel_6 = Panel(path.path)
time_stamp = GhPythonScript(name=panel_5, run=run_energy_simulation)  # -> out, name
# ---------- time_stamp: Python ----------
__author__ = "tmendeze"

import rhinoscriptsyntax as rs
if run:
    import datetime
    time = datetime.datetime.now().strftime('%Y%m%d%H%M')
    name_ = '{}_{}'.format(name, time)
    print(name_)
else:
    name_=name
# ---------- end time_stamp ----------
csv_path = GhPythonScript(path=path.path, sim_name=time_stamp.name)  # -> out, sql_path
# ---------- csv_path: Python ----------
__author__ = "tmendeze"
__version__ = "2021.03.02"

import rhinoscriptsyntax as rs
import os
sql = os.path.join('OpenStudio','run','eplusout.sql')
sql_path = os.path.join(path, sim_name, sql)
# ---------- end csv_path ----------
panel_7 = Panel(csv_path.sql_path)

# ----
# Add Context
pipeline = GeometryPipeline(
    GroupByLayer=False,
    GroupByType=False,
    IncludeHidden=True,
    IncludeLocked=True,
    LayerFilter="context",
    NameFilter="*",
    SublayerFiltering=True,
    TypeFilter=1073741848)
context_geometry = Brep()
data = Data(pipeline)

# ----
# Simulation Outputs
# Output Folder Name:
csv_path_2 = GhPythonScript(path=path.path, sim_name=time_stamp.name)  # -> out, csv_path
# ---------- csv_path_2: Python ----------
__author__ = "tmendeze"
__version__ = "2021.03.02"

import rhinoscriptsyntax as rs
import os
csv_path = os.path.join(path, sim_name+".csv")
# ---------- end csv_path_2 ----------
panel_8 = Panel(csv_path_2.csv_path)

galapagos = Galapagos(gene=[north_wwr, south_wwr, east_wwr, west_wwr])

# ----
# Ceiling
# Condition
list_2 = ValueList({"Outdoors", "Adiabatic"}, selected="Outdoors")

# ----
# Floor
# Condition
list_3 = ValueList({"Adiabatic", "Ground"}, selected="Ground")

# ----
# Run Daylight
# Simulation
run_daylight_simulation = BooleanToggle(False)

# ----
# Set Zone Program
bldgprograms = HBBuildingPrograms({"LargeOffice", "MediumOffice", "SmallOffice", "MidriseApartment", "HighriseApartment", "Retail", "StripMall", "PrimarySchool", "SecondarySchool", "SmallHotel", "LargeHotel", "Hospital", "Outpatient", "Laboratory", "Warehouse", "SuperMarket", "FullServiceRestaurant", "QuickServiceRestaurant", "Courthouse", "LargeDataCenterHighITE", "LargeDataCenterLowITE", "SmallDataCenterHighITE", "SmallDataCenterLowITE"}, selected="MidriseApartment")
searchprog = HBSearchPrograms(bldg_prog=bldgprograms)  # -> room_prog; plug-in component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
list_4 = ItemSelector(
    searchprog,
    {"2013::MidriseApartment::Apartment", "2013::MidriseApartment::Corridor", "2013::MidriseApartment::Office"}, selected="2013::MidriseApartment::Apartment")

# ----
# Carbon Results
number_slider_4 = Slider(0, range=0..10)
pick_csv_file = GhPythonScript(i=number_slider_4)  # -> out, file; inputs i: Int32
# ---------- pick_csv_file: Python ----------
__author__ = "tmendeze"


import studio2021
import os


files = []
for f in os.listdir(os.path.join(studio2021.TEMP)):
    if f.endswith('.csv'):
        files.append(f)

file = files[i]
# ---------- end pick_csv_file ----------
panel_9 = Panel(pick_csv_file.file)
pie_maker = GhPythonScript(filename=panel_9, num_years=Slider(12, range=0..30))  # -> out, embodied, operational, emb_v_op
# ---------- pie_maker: Python ----------
__author__ = "tmendeze"


from studio2021.functions import pie_maker
reload(pie_maker)
from studio2021.functions.pie_maker import make_pies

data = make_pies(filename, num_years)

embodied, operational, emb_v_op, emb_ft2, op_ft2 = data

e = 'embodied {} kgCo2e/ft2'.format(round(emb_ft2, 2))
o = 'operational {} kgCo2e/ft2 yr'.format(round(op_ft2, 2))

print(e)
print(o)
# ---------- end pie_maker ----------
panel_10 = Panel(pie_maker.out)
pie = PieChart(pie_maker.embodied)
pie_2 = PieChart(pie_maker.emb_v_op)
pie_3 = PieChart(pie_maker.operational)

curve = Curve([<curve referenced from the Rhino model> x5])
unit_z = UnitZ(Factor=Slider(12, range=0..100))

r_per_in = Slider(4, range=0..10)
multiplication_2 = Multiplication(A=r_per_in, InsulationThickness=Slider(1, range=0..1))
division_2 = Division(A=multiplication_2, B=5.67826)
opaquematnomass = HBOpaqueMaterialNoMass(name="AirGap", r_value=Slider(1, range=0..1))  # -> flatten(mat); plug-in component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
opaquematnomass_2 = HBOpaqueMaterialNoMass(name="ContExtInsulation", r_value=division_2)  # -> mat; plug-in component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
opaquemat = HBOpaqueMaterial(
    name="2x6 wall framing",
    thickness=Slider(0.0889, range=0..0.1),
    conductivity=Slider(0.041, range=0..0.1),
    density=Slider(141.25, range=0..1000),
    spec_heat=Slider(2300, range=0..10000))  # -> mat; plug-in component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
opaquemat_2 = HBOpaqueMaterial(
    name="Gypsum Board",
    thickness=Slider(0.5, range=0..1),
    conductivity=Slider(0.16, range=0..1),
    density=Slider(800, range=0..1000),
    spec_heat=Slider(109, range=0..1000))  # -> mat; plug-in component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
opaquemat_3 = HBOpaqueMaterial(
    name="Wood Exterior Cladding",
    thickness=Slider(0.0191, range=0..0.1),
    conductivity=Slider(0.116, range=0..1),
    density=Slider(540, range=0..1000),
    spec_heat=Slider(1210, range=0..10000))  # -> flatten(mat); plug-in component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
clean = CleanTree(
    RemoveNulls=True,
    RemoveInvalid=True,
    RemoveEmpty=False,
    Tree=flatten([opaquemat_3, opaquematnomass, opaquematnomass_2, opaquemat, opaquemat_2]))
opaqueconstr = HBOpaqueConstruction(name="ExteriorWall", materials=flatten(clean))  # -> constr; plug-in component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
panel_11 = Panel(clean)
exteriorsubset = HBExteriorConstructionSubset(exterior_wall=opaqueconstr)  # -> exterior_set; plug-in component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
decnstrconstr = HBDeconstructConstruction(constr=opaqueconstr)  # -> materials, layers, r_val_si, r_val_ip, u_fac_si, u_fac_ip, t_sol, t_vis; plug-in component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
one_over_x = OneOverX(Value=decnstrconstr.u_fac_ip)
constructionset = HBConstructionSet(name="CustomConstructionSet", exterior_subset=exteriorsubset)  # -> constr_set; plug-in component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
r_value_of_wall_construction = Panel(one_over_x)

extrude = Extrude(Base=curve, Direction=unit_z)
cap_holes = CapHoles(Brep=extrude)
roomsolid = HBRoomFromSolid(geo=flatten(cap_holes), conditioned=True)  # -> out, rooms; plug-in component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
hb_building_programs = HBBuildingPrograms({"LargeOffice", "MediumOffice", "SmallOffice", "MidriseApartment", "HighriseApartment", "Retail", "StripMall", "PrimarySchool", "SecondarySchool", "SmallHotel", "LargeHotel", "Hospital", "Outpatient", "Laboratory", "Warehouse", "SuperMarket", "FullServiceRestaurant", "QuickServiceRestaurant", "Courthouse", "LargeDataCenterHighITE", "LargeDataCenterLowITE", "SmallDataCenterHighITE", "SmallDataCenterLowITE"}, selected="MidriseApartment")
solveadj = HBSolveAdjacency(rooms=flatten(roomsolid.rooms), air_boundary=Toggle(True), run=Toggle(True))  # -> out, adj_rooms; plug-in component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
searchprog_2 = HBSearchPrograms(bldg_prog=hb_building_programs)  # -> room_prog; plug-in component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
item_selector = ItemSelector(
    searchprog_2,
    {"2013::MidriseApartment::Apartment", "2013::MidriseApartment::Corridor", "2013::MidriseApartment::Office"}, selected="2013::MidriseApartment::Apartment")
deconstrprogram = HBDeconstructProgramType(program=item_selector)  # -> people, lighting, electric_equip, gas_equip, infiltration, ventilation, setpoint; plug-in component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
panel_12 = Panel(deconstrprogram.people)
decnstrpeople = HBDeconstructPeople(people=deconstrprogram.people)  # -> name, ppl_per_area, occupancy_sch, activity_sch; plug-in component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
decnstrequipment = HBDeconstructEquipment(equip=deconstrprogram.electric_equip)  # -> name, watts_per_area, schedule, radiant_fract, latent_fract, lost_fract, is_gas; plug-in component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
searchmats = HBSearchMaterials()  # -> opaque_mats, window_mats; plug-in component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
equipment = HBEquipment(
    watts_per_area=Slider(3, range=0..10),
    schedule=decnstrequipment.schedule,
    radiant_fract=decnstrequipment.radiant_fract,
    latent_fract=decnstrequipment.latent_fract,
    lost_fract=decnstrequipment.lost_fract,
    gas=decnstrequipment.is_gas)  # -> equip; plug-in component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
panel_13 = Panel("conc")
item_selector_2 = ItemSelector()
programtype = HBProgramType(electric_equip=equipment)  # -> program; plug-in component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
# adds air films itself, air gap still necessary
exteriorsubset_2 = HBExteriorConstructionSubset()  # -> exterior_set; plug-in component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
applyprogram = HBApplyProgramType(rooms=flatten(solveadj.adj_rooms), program=item_selector)  # -> out, rooms; plug-in component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
applyconstrset = HBApplyConstructionSet(rooms=applyprogram.rooms, constr_set=constructionset)  # -> rooms; plug-in component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
aperturesbyratio = HBAperturesByRatio(
    hb_objs=flatten(applyconstrset),
    ratio=[Slider(0.25, range=0..1), Slider(0.25, range=0..1), Slider(0.25, range=0..1), Slider(0.25, range=0..1)])  # -> out, hb_objs; plug-in component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
cities = GhPythonScript(city=list)  # -> out, city, weather_file, kgCo2e_kwh
# ---------- cities: Python ----------
__author__ = "tmendeze"

import rhinoscriptsyntax as rs

from studio2021.functions import city_carbon
reload(city_carbon)
from studio2021.functions.city_carbon import city_EUI
from studio2021.functions.city_carbon import weather

cities = {0: 'Seattle',
          1: 'Milwaukee',
          2: 'San Antonio'}

city = cities[city]
kgCo2e_kwh = city_EUI(city)['kg/kWh']
weather_file = weather(city)
# ---------- end cities ----------

# ----
# Sun Path & Shading Mask
number_slider_5 = Slider(3, range=1..12)  # disabled
number_slider_6 = Slider(12, range=1..24)  # disabled
number_slider_7 = Slider(21, range=1..31)  # disabled
join = JoinCurves(Curves=[outsidecrvfromrhino_2, outsidecrvfromrhino_4, outsidecrvfromrhino_3, outsidecrvfromrhino], Preserve=False)  # disabled
importloc = LBImportLocation(epw_file=cities.weather_file)  # -> location; disabled; plug-in component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
hoy = LBCalculateHOY(month=number_slider_5, day=number_slider_7, hour=number_slider_6)  # -> flatten(hoy), flatten(doy), flatten(date); disabled; plug-in component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
area = Area(Geometry=join)  # -> Area, Centroid; disabled
sunpath = LBSunPath(location=importloc, hoys=hoy.hoy, center_pt=area.Centroid, scale=1)  # -> report, vectors, altitudes, azimuths, hoys, sun_pts, analemma, daily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; disabled; plug-in component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
symask = LBSkyMask(context=data, center=area.Centroid)  # -> report, context_mask, orient_mask, strategy_mask, sky_mask, context_view, orient_view, strategy_view, sky_view; disabled; plug-in component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

# ----
# Chart Results
panel_14 = Panel("""Cooling
Heating
Lighting
Equipment
Hot Water
People Gain
Solar Gain
Total Energy""")
data_2 = Data(panel_14)
pick_sql_file = GhPythonScript(i=Slider(0, range=0..10))  # -> out, filepath; inputs i: Int32
# ---------- pick_sql_file: Python ----------
__author__ = "tmendeze"


import studio2021
import os


files = []
for f in os.listdir(os.path.join(studio2021.TEMP)):
    if f.endswith('.csv'):
        files.append(f)
        
file = files[i]

folder = os.path.splitext(file)[0]
filepath =os.path.join(studio2021.TEMP, folder)
filepath = os.path.join(filepath, 'OpenStudio')
filepath = os.path.join(filepath, 'run')
filepath = os.path.join(filepath, 'eplusout.sql')
print(file)
# ---------- end pick_sql_file ----------
list_5 = ItemSelector(
    data_2,
    {"Cooling", "Heating", "Lighting", "Equipment", "Hot Water", "People Gain", "Solar Gain", "Total Energy"}, selected="Cooling")
cluster = Cluster_2(sql=pick_sql_file.filepath)  # -> data_11, data_9, data_12, data_13, data_16, data_14, data_15, data_10
cluster_2 = Cluster_3(
    D=list_5,
    S=panel_14,
    _0=cluster.data_11,
    _1=cluster.data_9,
    _2=cluster.data_12,
    _3=cluster.data_13,
    _4=cluster.data_16,
    _5=cluster.data_14,
    _6=cluster.data_15,
    _7=cluster.data_10)  # -> E, s_0
vec = VectorXYZ(XComponent=Slider(472, range=0..1000), YComponent=0, ZComponent=0)  # -> Vector, Length
legendpar = LBLegendParameters(min=0, max=cluster_2.E)  # -> leg_par; plug-in component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
move = Move(Geometry=area.Centroid, Motion=vec.Vector)  # -> Geometry, Transform
hourlyplot = LBHourlyPlot(data=flatten(cluster_2.s_0), base_pt=move.Geometry, legend_par=legendpar)  # -> report, mesh, legend, borders, labels, title; plug-in component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

# ----
# CHECK FILE!
make_sure_this_is_the_right_file = Panel(pick_sql_file.out)
room = HBRoom(conditioned=True)  # -> out, room; plug-in component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
vizbytype = HBVisualizeByType(rooms=aperturesbyratio.hb_objs)  # -> walls, interior_walls, roofs, ceilings, exterior_floors, interior_floors, air_walls, apertures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; plug-in component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
annualloads = HBAnnualLoads(rooms=aperturesbyratio.hb_objs, epw_file=cities.weather_file, run=Toggle(True))  # -> out, total_load, cooling, heating, lighting, equip; plug-in component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
modeltoosm = HBModelToOSM()  # -> out, jsons, osw, osm, idf, sql, zsz, rdd, html; plug-in component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
hb_face_energy_attributes = HBFaceEnergyAttributes({"Construction": "properties.energy.construction.display_name", "Materials": "properties.energy.construction.layers", "R-Value": "properties.energy.construction.r_value", "U-Value": "properties.energy.construction.u_value", "U-Factor": "properties.energy.construction.u_factor", "Solar Transmitance [Unshaded]": "properties.energy.construction.solar_transmittance", "Solar Reflectance [Outside]": "properties.energy.construction.outside_solar_reflectance", "Solar Reflectance [Inside]": "properties.energy.construction.inside_solar_reflectance", "Fraction Area Operable": "properties.energy.vent_opening.fraction_area_operable", "Fraction Height Operable": "properties.energy.vent_opening.fraction_height_operable", "Discharge Coefficient": "properties.energy.vent_opening.discharge_coefficient", "Cross Ventilation": "properties.energy.vent_opening.wind_cross_vent"}, selected="Construction")
panel_15 = Panel(annualloads.total_load)
panel_16 = Panel(annualloads.out)
lablefaces = HBLabelFaces(attribute=hb_face_energy_attributes)  # -> label_text, base_pts, labels, wire_frame; plug-in component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

# ----
# Glazing
south_wwr = Slider(0.5, range=0..0.95)
east_wwr = Slider(0.5, range=0..0.95)
north_shgc = ValueList({"Low SHGC": 0.25, "High SHGC": 0.60}, selected="Low SHGC")
west_wwr = Slider(0.5, range=0..0.95)
north_wwr = Slider(0.5, range=0..0.95)
glazing = ValueList({"Aluminum Double", "Aluminum Triple", "Wood Double", "Wood Triple"}, selected="Wood Double")
south_shgc = ValueList({"Low SHGC": 0.25, "High SHGC": 0.60}, selected="Low SHGC")
east_shgc = ValueList({"Low SHGC": 0.25, "High SHGC": 0.60}, selected="Low SHGC")
west_shgc = ValueList({"Low SHGC": 0.25, "High SHGC": 0.60}, selected="Low SHGC")

black_box = BlackBox(
    city=cities.city,
    _0_0_2="1_zonename",
    _0_1_2="2_zonename",
    _0_2_2="3_zonename",
    _0_3_2="4_zonename",
    _0_0=panel_4,
    _0_1=height_ft,
    _0_4_2="5_zonename",
    _0_2=outsidecrvfromrhino_2,
    _0_3=adiabaticcrvfromrhino_2,
    _0_4=outsidecrvfromrhino_4,
    _0_5=adiabaticcrvfromrhino_3,
    _0_6=outsidecrvfromrhino_3,
    _0_7=adiabaticcrvfromrhino,
    _0_8=outsidecrvfromrhino,
    interior_insul_mat=int_insulation,
    _0_9=adiabaticcrvfromrhino_4,
    _0_10=adiabaticcrvfromrhino_5,
    _0_11=list_2,
    glazing_system=glazing,
    _0_12=list_3,
    simulation_name=time_stamp.name,
    _0_13=north_wwr,
    weather_file=cities.weather_file,
    _0_14=south_wwr,
    csv=panel_8,
    _0_15=east_wwr,
    sql_path=panel_7,
    _0_16=west_wwr,
    simulation_folder=path.path,
    _0_17=north_horizontal_shade_depth_in,
    run_simulation=run_energy_simulation,
    _0_18=south_horizontal_shade_depth_in,
    columns=columns_2,
    _0_19=east_shade_horizontal_depth_in,
    beams_x=beams_x_2,
    _0_20=west_shade_horizontal_depth_in,
    beams_y=beams_y_2,
    _0_21=north_w_vertical_shade_depth_in,
    _0_22=south_e_vertical_shade_depth_in,
    cores=core,
    _0_23=east_n_vertical_shade_depth_in,
    building_type=building_type,
    _0_24=west_n_vertical_shade_depth_in,
    num_floors_above=num_floors_above,
    _0_25=north_e_vertical_shade_depth_in,
    composite_slab=composite_slab,
    _0_26=south_w_vertical_shade_depth_in,
    _0_27=east_s_vertical_shade_depth_in,
    kgco2e_kwh=cities.kgCo2e_kwh,
    _0_28=west_s_vertical_shade_depth_in,
    _0_29=north_shgc,
    _0_30=south_shgc,
    context=data,
    _0_31=east_shgc,
    _0_32=west_shgc,
    _0_33=list_4,
    _0_34=facade_cladding,
    _0_35=ext_insulation,
    _0_36=ext_insulation_thickness_in,
    _0_37=exterior_wall_framing,
    _0_38=interior_finish)  # -> out, building_2

embodied = GhPythonScript(building=black_box.building_2)  # -> out, embodied_pie, total_embodied, embodied_ft2, building, envelope_report, slab_report, str_report
# ---------- embodied: Python ----------
__author__ = "tmendeze"

import rhinoscriptsyntax as rs

from studio2021.functions import pie_maker
reload(pie_maker)
from studio2021.functions.pie_maker import make_emb_pie

building.compute_structure_embodied()
building.compute_envelope_embodied()

embodied_pie, total_embodied, embodied_ft2 = make_emb_pie(building)

envelope_report = building.envelope.env_strings
slab_report = building.structure.slab_strings
str_report = [building.structure.beam_string]
str_report.append(building.structure.col_string)
# ---------- end embodied ----------
panel_17 = Panel(embodied.slab_report)
panel_18 = Panel(embodied.str_report)
panel_19 = Panel(embodied.envelope_report)
pie_4 = PieChart(embodied.embodied_pie)
kg_co2e_ft2 = Panel(embodied.embodied_ft2)
kg_co2e = Panel(embodied.total_embodied)

draw_structure = GhPythonScript(building=embodied.building)  # -> out, slabs, columns, beams, cores
# ---------- draw_structure: Python ----------
__author__ = "tmendeze"

import rhinoscriptsyntax as rs

slabs, columns, beams, cores = building.draw_structure()
# ---------- end draw_structure ----------
brep = Brep(draw_structure.slabs)
brep_2 = Brep(draw_structure.columns)
brep_3 = Brep(draw_structure.beams)
brep_4 = Brep(draw_structure.cores)

panel_20 = Panel(black_box.out)

operational = Operational(building=black_box.building_2)  # -> y, out, weather_file, i, s_1, out_2, building_2, sql

window_uvalue = Panel(operational.i)

wall_r_value = Panel(operational.y)
panel_21 = Panel(operational.out)

# ----
# Write To Excel
write_results = GhPythonScript(building=operational.building_2)  # -> out
# ---------- write_results: Python ----------
__author__ = "tmendeze"

building.write_results()
# ---------- end write_results ----------
panel_22 = Panel(write_results)

# ----
# Label Rooms
faceenergyattr = HBFaceEnergyAttributes({"Construction": "properties.energy.construction.display_name", "Materials": "properties.energy.construction.layers", "R-Value": "properties.energy.construction.r_value", "U-Value": "properties.energy.construction.u_value", "U-Factor": "properties.energy.construction.u_factor", "Solar Transmitance [Unshaded]": "properties.energy.construction.solar_transmittance", "Solar Reflectance [Outside]": "properties.energy.construction.outside_solar_reflectance", "Solar Reflectance [Inside]": "properties.energy.construction.inside_solar_reflectance", "Fraction Area Operable": "properties.energy.vent_opening.fraction_area_operable", "Fraction Height Operable": "properties.energy.vent_opening.fraction_height_operable", "Discharge Coefficient": "properties.energy.vent_opening.discharge_coefficient", "Cross Ventilation": "properties.energy.vent_opening.wind_cross_vent"}, selected="Construction")  # disabled
roomenergyattr = HBRoomEnergyAttributes({"Program": "properties.energy.program_type.display_name", "Construction Set": "properties.energy.construction_set.display_name", "Is Conditioned": "properties.energy.is_conditioned", "People per Area [ppl/m2]": "properties.energy.people.people_per_area", "Area per Person [m2/ppl]": "properties.energy.people.area_per_person", "Lighting per Area [W/m2]": "properties.energy.lighting.watts_per_area", "Electric Equipment per Area [W/m2]": "properties.energy.electric_equipment.watts_per_area", "Gas Equipment per Area [W/m2]": "properties.energy.gas_equipment.watts_per_area", "Infiltration per Exterior Area [m3/s-m2]": "properties.energy.infiltration.flow_per_exterior_area", "Ventilation per Person [m3/s-ppl]": "properties.energy.ventilation.flow_per_person"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}, selected="Ventilation per Person [m3/s-ppl]")  # disabled
allzones = Data(operational.s_1)  # disabled
labelrooms = HBLabelRooms(rooms_model=flatten(allzones), attribute=roomenergyattr)  # -> label_text, base_pts, labels, wire_frame; disabled; plug-in component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
lablefaces_2 = HBLabelFaces(hb_objs=flatten(allzones), attribute=faceenergyattr)  # -> label_text, base_pts, labels, wire_frame; disabled; plug-in component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

# ----
# View Zones
allzones_2 = Data(operational.s_1)
# RESULTS
vizbytype_2 = HBVisualizeByType(hb_objs=allzones_2)  # -> walls, interior_walls, roofs, ceilings, exterior_floors, interior_floors, air_walls, apertures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; plug-in component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

# ----
# Run Daylight
# Analysis
panel_23 = Panel("sDA:")
cluster_3 = Cluster(model=operational.s_1, run=run_daylight_simulation, epw_file=operational.weather_file, folder=path.path)  # -> R, da, T, leg_par

# ----
# Daylighting Results
sda = Panel(cluster_3.R)

join_2 = TextJoin(Text=sda, Join=panel_23)

heatmap = LBSpatialHeatmap(values=cluster_3.da, mesh=cluster_3.T, legend_par=cluster_3.leg_par, global_title=join_2)  # -> mesh, legend, title, colors, legend_par; plug-in component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

# ==== cluster Cluster
epw_file = ClusterInput()
rooms = ClusterInput()
wea = HBWeaFromEPW(epw_file=epw_file)  # -> wea; plug-in component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
gridrooms = HBSensorGridFromRooms(rooms=rooms, grid_size=Slider(5, range=0..10), quad_only=Toggle(True))  # -> grid, points, mesh; plug-in component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
folder = ClusterInput()
model = ClusterInput()
recipesettings = HBRecipeSettings(folder=folder, reload_old=False)  # -> settings; plug-in component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
assigngridsviews = HBAssignGridsAndViews(model=model, grids=gridrooms.grid)  # -> model; plug-in component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
graft = GraftTree(Tree=gridrooms.mesh, IncludeEmptyLists=True, IncludeNullItems=True)
T = ClusterOutput(graft)
run = ClusterInput()
annualdaylight = HBAnnualDaylight(model=assigngridsviews, wea=wea, run_settings=recipesettings, run=run)  # -> report, results, DA, cDA, UDI, UDI_low, UDI_up; plug-in component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
legendpar = LBLegendParameters(min=Slider(0, range=0..100), max=Slider(100, range=0..100))  # -> leg_par; plug-in component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
annualmetrics = HBAnnualDaylightMetrics(results=annualdaylight.results)  # -> report, DA, UDI; plug-in component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
leg_par = ClusterOutput(legendpar)
da = ClusterOutput(annualmetrics.DA)
larger = LargerThan(FirstNumber=flatten(annualmetrics.DA), SecondNumber=50)  # -> flatten(LargerThan), flatten(OrEqualTo)
lng = ListLength(List=flatten(annualmetrics.DA))
multiplication = Multiplication(A=larger.OrEqualTo, B=1)
ma = MassAddition(Input=multiplication)  # -> Result, PartialResults
division = Division(A=ma.Result, B=lng)
multiplication_2 = Multiplication(A=division, B=100)
expression = Expression(x=multiplication_2, Expression="Format(\"{0:0.0}%\", x)")
R = ClusterOutput(expression)

# ==== cluster Operational
building = ClusterInput()

trees_from_building = GhPythonScript(building=building)  # -> out, zones, facade_area_n, facade_area_s, facade_area_e, facade_area_w, window_areas_n, window_areas_s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
# ---------- trees_from_building: Python ----------
import rhinoscriptsyntax as rs
import ghpythonlib.treehelpers as th

data = building.to_gh_data()

zones                   = data['zones']
facade_area_n           = data['facade_areas']['n']
facade_area_s           = data['facade_areas']['s']
facade_area_e           = data['facade_areas']['e']
facade_area_w           = data['facade_areas']['w']
exterior_walls_n        = data['exterior_walls']['n']
exterior_walls_s        = data['exterior_walls']['s']
exterior_walls_e        = data['exterior_walls']['e']
exterior_walls_w        = data['exterior_walls']['w']
adiabatic_walls         = data['adiabatic_walls']
floor_surfaces          = data['floor_surfaces']
ceiling_surfaces        = data['ceiling_surfaces']
window_areas_n          = data['window_areas']['n']
window_areas_s          = data['window_areas']['s']
window_areas_e          = data['window_areas']['e']
window_areas_w          = data['window_areas']['w']
opaque_areas_n          = data['opaque_areas']['n']
opaque_areas_s          = data['opaque_areas']['s']
opaque_areas_e          = data['opaque_areas']['e']
opaque_areas_w          = data['opaque_areas']['w']
shade_gc                = data['shade_gc']
shade_depth_h           = data['shade_depth_h']
shade_depth_v1          = data['shade_depth_v1']
shade_depth_v2          = data['shade_depth_v2']
facade_cladding         = data['facade_cladding']
facade_cladding         = data['facade_cladding']
external_insulation     = data['external_insulation'] 
insulation_thickness    = data['insulation_thickness']
ewall_framing           = data['ewall_framing']
int_finish              = data['int_finish']
glazing_system          = data['glazing_system']
simulation_name         = data['simulation_name']
zone_program            = data['zone_program']
weather_file            = data['weather_file']
sql_path                = data['sql_path']
simulation_folder       = data['simulation_folder']
run_simulation          = data['run_simulation']
wwr                     = data['wwr'] 
ceiling_condition       = data['ceiling_condition']
floor_condition         = data['floor_condition']
height                  = data['height']
interior_insul_mat      = data['interior_insul_mat']
int_ins_thick           = data['int_ins_thick']
context                 = data['context']
# ---------- end trees_from_building ----------
clean = CleanTree(RemoveNulls=True, RemoveInvalid=True, RemoveEmpty=True, Tree=trees_from_building.exterior_walls_n)
clean_2 = CleanTree(RemoveNulls=True, RemoveInvalid=True, RemoveEmpty=True, Tree=trees_from_building.exterior_walls_s)
clean_3 = CleanTree(RemoveNulls=True, RemoveInvalid=True, RemoveEmpty=True, Tree=trees_from_building.exterior_walls_e)
clean_4 = CleanTree(RemoveNulls=True, RemoveInvalid=True, RemoveEmpty=True, Tree=trees_from_building.exterior_walls_w)
subtraction = Subtraction(A=trees_from_building.height, B=Slider(2, range=0..10))  # -> flatten(Result)

weather_file = ClusterOutput(trees_from_building.weather_file)
out = ClusterOutput(trees_from_building.out)
item = ListItem(List=trees_from_building.shade_gc, Index=0, Wrap=True)
item_2 = ListItem(List=trees_from_building.shade_depth_h, Index=0, Wrap=True)
item_3 = ListItem(List=trees_from_building.wwr, Index=0, Wrap=True)
item_4 = ListItem(List=trees_from_building.shade_depth_v1, Index=0, Wrap=True)
item_5 = ListItem(List=trees_from_building.shade_depth_v2, Index=0, Wrap=True)
vertical_depth_n_s_e_w = ExplodeTree(Data=item_4)  # -> Branch0, Branch1, Branch2, Branch3
flip_vertical_n_s_e_w = ExplodeTree(Data=item_5)  # -> Branch0, Branch1, Branch2, Branch3
number_slider = Slider(1, range=0..10)

join = TextJoin(Text=[trees_from_building.interior_insul_mat, trees_from_building.ewall_framing], Join=" ")
panel = Panel(join)
importmaterial = GhPythonScript(material_name=trees_from_building.external_insulation)  # -> r_per_in, embodied_carbon, type, thickness_in, thickness_m, conductivity, density, sp_heat, r_value
# ---------- importmaterial: Python ----------
__author__ = "preston"

import rhinoscriptsyntax as rs
import sys

studiopath = "/Users/preston/Documents/GitHub/studio2021/src"
sys.path.append(studiopath)
import studio2021

from studio2021.functions import read_materials

material = read_materials(material_name)

print(material.keys())

r_per_in = material["r_per_in"]
embodied_carbon = material["embodied_carbon"]
type = material["mtype"]
density = material["density"]
sp_heat = material["sp_heat"]
thickness_in = material["thickness_in"]
thickness_m = material["thickness_m"]
r_value = material["r_value"]
conductivity = material["conductivity"]
# ---------- end importmaterial ----------
importmaterial_2 = GhPythonScript(material_name=trees_from_building.ewall_framing)  # -> r_per_in, embodied_carbon, type, thickness_in, thickness_m, conductivity, density, sp_heat, r_value; same code as importmaterial
importmaterial_3 = GhPythonScript(material_name=join)  # -> r_per_in, embodied_carbon, type, thickness_in, thickness_m, conductivity, density, sp_heat, r_value; same code as importmaterial
importmaterial_4 = GhPythonScript(material_name=trees_from_building.int_finish)  # -> r_per_in, embodied_carbon, type, thickness_in, thickness_m, conductivity, density, sp_heat, r_value; same code as importmaterial
importmaterial_5 = GhPythonScript(material_name=trees_from_building.facade_cladding)  # -> r_per_in, embodied_carbon, type, thickness_in, thickness_m, conductivity, density, sp_heat, r_value; same code as importmaterial
subset = SubSet(SetA="CLT", SetB=trees_from_building.ewall_framing)
subset_2 = SubSet(SetA="Concrete", SetB=trees_from_building.ewall_framing)
multiplication = Multiplication(A=importmaterial.r_per_in, B=trees_from_building.insulation_thickness)
division = Division(A=importmaterial_3.r_value, B=5.67826)
addition = Addition(A=subset, B=subset_2)
division_2 = Division(A=multiplication, B=5.67826)
opaquemat = HBOpaqueMaterial(
    name="ExtFraming",
    thickness=importmaterial_2.thickness_m,
    conductivity=importmaterial_2.conductivity,
    density=importmaterial_2.density,
    spec_heat=importmaterial_2.sp_heat)  # -> mat; plug-in component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
opaquemat_2 = HBOpaqueMaterial(
    name="InteriorFinish",
    thickness=importmaterial_4.thickness_m,
    conductivity=importmaterial_4.conductivity,
    density=importmaterial_4.density,
    spec_heat=importmaterial_4.sp_heat)  # -> mat; plug-in component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
opaquematnomass = HBOpaqueMaterialNoMass(name="ExtFraming", r_value=division)  # -> mat; plug-in component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
larger = LargerThan(FirstNumber=addition, SecondNumber=1)  # -> LargerThan, OrEqualTo
equals = Equality(FirstNumber=trees_from_building.insulation_thickness, SecondNumber=0)  # -> Equality, Inequality
opaquematnomass_2 = HBOpaqueMaterialNoMass(name="ContExtInsulation", r_value=division_2)  # -> mat; plug-in component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
opaquematnomass_3 = HBOpaqueMaterialNoMass(name="AirGap", r_value=Slider(1, range=0..1))  # -> flatten(mat); plug-in component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
opaquemat_3 = HBOpaqueMaterial(
    name="FacadeCladding",
    thickness=importmaterial_5.thickness_m,
    conductivity=importmaterial_5.conductivity,
    density=importmaterial_5.density,
    spec_heat=importmaterial_5.sp_heat)  # -> flatten(mat); plug-in component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
subset_3 = SubSet(SetA="Gyp", SetB=trees_from_building.int_finish)
filter = StreamFilter(Gate=equals.Equality, Stream0=opaquematnomass_2)  # -> flatten(Stream)
filter_2 = StreamFilter(Gate=larger.OrEqualTo, Stream0=opaquematnomass, Stream1=opaquemat)  # -> flatten(Stream)
filter_3 = StreamFilter(Gate=subset_3, Stream1=opaquemat_2)  # -> flatten(Stream)
clean_5 = CleanTree(
    RemoveNulls=True,
    RemoveInvalid=True,
    RemoveEmpty=False,
    Tree=flatten([opaquemat_3, opaquematnomass_3, filter, filter_2, filter_3]))
opaqueconstr = HBOpaqueConstruction(name="ExteriorWall", materials=flatten(clean_5))  # -> constr; plug-in component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
decnstrconstr = HBDeconstructConstruction(constr=opaqueconstr)  # -> materials, layers, r_val_si, r_val_ip, u_fac_si, u_fac_ip, t_sol, t_vis; plug-in component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
exteriorsubset = HBExteriorConstructionSubset(exterior_wall=opaqueconstr)  # -> exterior_set; plug-in component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
decnstrmat = HBDeconstructMaterial(mat=opaqueconstr)  # -> values, attr_names, r_val_si, r_val_ip; plug-in component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
one_over_x = OneOverX(Value=decnstrconstr.u_fac_ip)
y = ClusterOutput(one_over_x)
r_value_of_wall_construction = Panel(one_over_x)
constructionset = HBConstructionSet(name="CustomConstructionSet", exterior_subset=exteriorsubset)  # -> constr_set; plug-in component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

r_per_in = Slider(4, range=0..10)
multiplication_2 = Multiplication(A=r_per_in, InsulationThickness=Slider(1, range=0..1))
division_3 = Division(A=multiplication_2, B=5.67826)
opaquematnomass_4 = HBOpaqueMaterialNoMass(name="AirGap", r_value=Slider(1, range=0..1))  # -> flatten(mat); plug-in component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
opaquematnomass_5 = HBOpaqueMaterialNoMass(name="ContExtInsulation", r_value=division_3)  # -> mat; plug-in component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
opaquemat_4 = HBOpaqueMaterial(
    name="2x6 wall framing",
    thickness=Slider(0.0889, range=0..0.1),
    conductivity=Slider(0.041, range=0..0.1),
    density=Slider(141.25, range=0..1000),
    spec_heat=Slider(2300, range=0..10000))  # -> mat; plug-in component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
opaquemat_5 = HBOpaqueMaterial(
    name="Gypsum Board",
    thickness=Slider(0.5, range=0..1),
    conductivity=Slider(0.16, range=0..1),
    density=Slider(800, range=0..1000),
    spec_heat=Slider(109, range=0..1000))  # -> mat; plug-in component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
opaquemat_6 = HBOpaqueMaterial(
    name="Wood Exterior Cladding",
    thickness=Slider(0.0191, range=0..0.1),
    conductivity=Slider(0.116, range=0..1),
    density=Slider(540, range=0..1000),
    spec_heat=Slider(1210, range=0..10000))  # -> flatten(mat); plug-in component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
clean_6 = CleanTree(
    RemoveNulls=True,
    RemoveInvalid=True,
    RemoveEmpty=False,
    Tree=flatten([opaquemat_6, opaquematnomass_4, opaquematnomass_5, opaquemat_4, opaquemat_5]))
opaqueconstr_2 = HBOpaqueConstruction(name="ExteriorWall", materials=flatten(clean_6))  # -> constr; plug-in component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
panel_2 = Panel(clean_6)
exteriorsubset_2 = HBExteriorConstructionSubset(exterior_wall=opaqueconstr_2)  # -> exterior_set; plug-in component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
decnstrconstr_2 = HBDeconstructConstruction(constr=opaqueconstr_2)  # -> materials, layers, r_val_si, r_val_ip, u_fac_si, u_fac_ip, t_sol, t_vis; plug-in component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
one_over_x_2 = OneOverX(Value=decnstrconstr_2.u_fac_ip)
constructionset_2 = HBConstructionSet(name="CustomConstructionSet", exterior_subset=exteriorsubset_2)  # -> constr_set; plug-in component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
r_value_of_wall_construction_2 = Panel(one_over_x_2)

face = HBFace(geo=trees_from_building.floor_surfaces, name="Floor", type="Floor", bc="Ground")  # -> report, faces; plug-in component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
match = MatchTree(Tree=face.faces, Guide=trees_from_building.floor_surfaces)

face_2 = HBFace(geo=trees_from_building.ceiling_surfaces, name="RoofCeiling", type="RoofCeiling", bc="Outdoors")  # -> report, faces; plug-in component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
match_2 = MatchTree(Tree=face_2.faces, Guide=match)

face_3 = HBFace(geo=trees_from_building.adiabatic_walls, name="Adiabatic Wall", type="AirBoundary", bc="Adiabatic")  # -> report, faces; plug-in component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
match_3 = MatchTree(Tree=face_3.faces, Guide=trees_from_building.adiabatic_walls)

panel_3 = Panel(clean_5)
larger_2 = LargerThan(FirstNumber=vertical_depth_n_s_e_w.Branch1, SecondNumber=0)  # -> LargerThan, OrEqualTo
larger_3 = LargerThan(FirstNumber=vertical_depth_n_s_e_w.Branch2, SecondNumber=0)  # -> LargerThan, OrEqualTo
larger_4 = LargerThan(FirstNumber=vertical_depth_n_s_e_w.Branch0, SecondNumber=0)  # -> LargerThan, OrEqualTo
larger_5 = LargerThan(FirstNumber=vertical_depth_n_s_e_w.Branch3, SecondNumber=0)  # -> LargerThan, OrEqualTo
larger_6 = LargerThan(FirstNumber=flip_vertical_n_s_e_w.Branch0, SecondNumber=0)  # -> LargerThan, OrEqualTo
larger_7 = LargerThan(FirstNumber=flip_vertical_n_s_e_w.Branch1, SecondNumber=0)  # -> LargerThan, OrEqualTo
larger_8 = LargerThan(FirstNumber=flip_vertical_n_s_e_w.Branch2, SecondNumber=0)  # -> LargerThan, OrEqualTo
larger_9 = LargerThan(FirstNumber=flip_vertical_n_s_e_w.Branch3, SecondNumber=0)  # -> LargerThan, OrEqualTo
roomattr = HBRoomAttributes({"Display Name": "display_name", "Simulation Name (Identifier)": "identifier", "Multiplier": "multiplier", "Story": "story", "Volume": "volume", "Gross Floor Area": "floor_area", "Exposed Area": "exposed_area", "Exterior Wall Area": "exterior_wall_area", "Exterior Aperture Area": "exterior_aperture_area", "Average Floor Elevation": "average_floor_height"}, selected="Simulation Name (Identifier)")
panel_4 = Panel("""  Daylighting:Controls,
  Test,     		   !- Name
  Zone_Name,               !- Zone Name
  SplitFlux,               !- Daylighting Method
  ,                        !- Availability Schedule Name
  Continuous,              !- Lighting Control Type
  0.3,                     !- Minimum Input Power Fraction for Continuous or ContinuousOff Dimming Control
  0.2,                     !- Minimum Light Output Fraction for Continuous or ContinuousOff Dimming Control
  ,                        !- Number of Stepped Control Steps
  1.0,                     !- Probability Lighting will be Reset When Needed in Manual Stepped Control
  DaylRefPt1,              !- Glare Calculation Daylighting Reference Point Name
  180.0,                   !- Glare Calculation Azimuth Angle of View Direction Clockwise from Zone y-Axis {deg}
  20.0,                    !- Maximum Allowable Discomfort Glare Index
  ,                        !- DElight Gridding Resolution {m2}
  DaylRefPt1,              !- Daylighting Reference Point 1 Name
  1.0,                     !- Fraction of Zone Controlled by Reference Point 1
  500.;                    !- Illuminance Setpoint at Reference Point 1 {lux}""")
area = Area(Geometry=trees_from_building.floor_surfaces)  # -> Area, Centroid
shade = HBShade(geo=trees_from_building.context)  # -> report, shades; plug-in component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
move = Move(Geometry=area.Centroid, Motion="{0,0,3}")  # -> Geometry, Transform
pdecon = Deconstruct(Point=move.Geometry)  # -> XComponent, YComponent, ZComponent
clean_7 = CleanTree(RemoveNulls=True, RemoveInvalid=True, RemoveEmpty=True, Tree=pdecon.XComponent)
clean_8 = CleanTree(RemoveNulls=True, RemoveInvalid=True, RemoveEmpty=True, Tree=pdecon.ZComponent)
panel_5 = Panel("""  Daylighting:ReferencePoint,
  DaylRefPt1,              !- Name
  Zone_Name,               !- Zone Name
  point1_x,                !- X-Coordinate of Reference Point {m}
  point1_y,                !- Y-Coordinate of Reference Point {m}
  point1_z;                !- Z-Coordinate of Reference Point {m}""")
clean_9 = CleanTree(RemoveNulls=True, RemoveInvalid=True, RemoveEmpty=True, Tree=pdecon.YComponent)
panel_6 = Panel("""Run1
Run2
Run3
Run4
Run5""")
panel_7 = Panel("""Point1
Point2
Point3
Point4
Point5""")

importglazing = GhPythonScript(glazing_name=trees_from_building.glazing_system)  # -> flatten(frame_type), glass_type, flatten(u_value), flatten(t_vis), embodied_carbon_metric, embodied_carbon_imperial
# ---------- importglazing: Python ----------
__author__ = "preston"

import rhinoscriptsyntax as rs
import sys

studiopath = "/Users/preston/Documents/GitHub/studio2021/src"
sys.path.append(studiopath)
import studio2021

from studio2021.functions import read_glazing

glazing = read_glazing(glazing_name)

print(glazing.keys())

frame_type = glazing['frame_type']
glass_type = glazing['glass_type']
u_value = glazing['u_value']
t_vis = glazing['t_vis']
embodied_carbon_metric = glazing['embodied_carbon_metric']
embodied_carbon_imperial = glazing['embodied_carbon_imperial']
# ---------- end importglazing ----------
shgc_n_s_e_w = ExplodeTree(Data=item)  # -> Branch0, Branch1, Branch2, Branch3
wwr_n_s_e_w = ExplodeTree(Data=item_3)  # -> Branch0, Branch1, Branch2, Branch3
shade_depth_n_s_e_w = ExplodeTree(Data=item_2)  # -> Branch0, Branch1, Branch2, Branch3

item_6 = ListItem(List=importglazing.u_value, Index=0, Wrap=True)
item_7 = ListItem(List=importglazing.t_vis, Index=0, Wrap=True)
item_8 = ListItem(List=importglazing.frame_type, Index=0, Wrap=True)
i = ClusterOutput(item_6)
multiplication_3 = Multiplication(A=item_6, B=Slider(5.678, range=0..10))
r_value_of_wall_construction_3 = Panel(multiplication_3)
larger_10 = LargerThan(FirstNumber=shade_depth_n_s_e_w.Branch1, SecondNumber=0)  # -> LargerThan, OrEqualTo
larger_11 = LargerThan(FirstNumber=shade_depth_n_s_e_w.Branch3, SecondNumber=0)  # -> LargerThan, OrEqualTo
larger_12 = LargerThan(FirstNumber=shade_depth_n_s_e_w.Branch2, SecondNumber=0)  # -> LargerThan, OrEqualTo
larger_13 = LargerThan(FirstNumber=shade_depth_n_s_e_w.Branch0, SecondNumber=0)  # -> LargerThan, OrEqualTo

face_4 = HBFace(geo=clean_4, name="Exposed Wall", type="Wall", bc="Outdoors")  # -> report, simplify(faces); plug-in component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
windowmat = HBWindowMaterial(name=item_8, u_factor=flatten(multiplication_3), shgc=flatten(shgc_n_s_e_w.Branch3), t_vis=flatten(item_7))  # -> mat; plug-in component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
windowconstr = HBWindowConstruction(name="WGlass", materials=flatten(windowmat))  # -> constr; plug-in component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

match_4 = MatchTree(Tree=face_4.faces, Guide=clean_4)

aperturesbyratio = HBAperturesByRatio(hb_objs=match_4, ratio=flatten(wwr_n_s_e_w.Branch3), win_height=subtraction, sill_height=number_slider)  # -> report, hb_objs; plug-in component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
applywindowconstr = HBApplyWindowConstruction(hb_objs=aperturesbyratio.hb_objs, constr=windowconstr)  # -> hb_objs; plug-in component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
louvershades = HBLouverShades(hb_objs=applywindowconstr, depth=flatten(shade_depth_n_s_e_w.Branch3), vertical=False)  # -> report, hb_objs; plug-in component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

filter_4 = StreamFilter(Gate=larger_11.LargerThan, Stream0=applywindowconstr, Stream1=louvershades.hb_objs)
louvershades_2 = HBLouverShades(hb_objs=filter_4, depth=flatten(vertical_depth_n_s_e_w.Branch3), vertical=True)  # -> report, hb_objs; plug-in component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
filter_5 = StreamFilter(Gate=larger_5.LargerThan, Stream0=filter_4, Stream1=louvershades_2.hb_objs)
louvershades_3 = HBLouverShades(hb_objs=filter_5, depth=flatten(flip_vertical_n_s_e_w.Branch3), vertical=True, flip_start=True)  # -> report, hb_objs; plug-in component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
filter_6 = StreamFilter(Gate=larger_9.LargerThan, Stream0=filter_5, Stream1=louvershades_3.hb_objs)

face_5 = HBFace(geo=clean_3, name="Exposed Wall", type="Wall", bc="Outdoors")  # -> report, simplify(faces); plug-in component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
windowmat_2 = HBWindowMaterial(name=item_8, u_factor=flatten(multiplication_3), shgc=flatten(shgc_n_s_e_w.Branch2), t_vis=flatten(item_7))  # -> mat; plug-in component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
windowconstr_2 = HBWindowConstruction(name="EGlass", materials=flatten(windowmat_2))  # -> constr; plug-in component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

match_5 = MatchTree(Tree=face_5.faces, Guide=clean_3)

aperturesbyratio_2 = HBAperturesByRatio(hb_objs=match_5, ratio=flatten(wwr_n_s_e_w.Branch2), win_height=subtraction, sill_height=number_slider)  # -> report, hb_objs; plug-in component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
applywindowconstr_2 = HBApplyWindowConstruction(hb_objs=aperturesbyratio_2.hb_objs, constr=windowconstr_2)  # -> hb_objs; plug-in component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
louvershades_4 = HBLouverShades(hb_objs=applywindowconstr_2, depth=flatten(shade_depth_n_s_e_w.Branch2), vertical=False)  # -> report, hb_objs; plug-in component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

filter_7 = StreamFilter(Gate=larger_12.LargerThan, Stream0=applywindowconstr_2, Stream1=louvershades_4.hb_objs)
louvershades_5 = HBLouverShades(hb_objs=filter_7, depth=flatten(vertical_depth_n_s_e_w.Branch2), vertical=True)  # -> report, hb_objs; plug-in component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
filter_8 = StreamFilter(Gate=larger_3.LargerThan, Stream0=filter_7, Stream1=louvershades_5.hb_objs)
louvershades_6 = HBLouverShades(hb_objs=filter_8, depth=flatten(flip_vertical_n_s_e_w.Branch2), vertical=True, flip_start=True)  # -> report, hb_objs; plug-in component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
filter_9 = StreamFilter(Gate=larger_8.LargerThan, Stream0=filter_8, Stream1=louvershades_6.hb_objs)

face_6 = HBFace(geo=clean, name="Exposed Wall", type="Wall", bc="Outdoors")  # -> report, simplify(faces); plug-in component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
windowmat_3 = HBWindowMaterial(name=item_8, u_factor=flatten(multiplication_3), shgc=flatten(shgc_n_s_e_w.Branch0), t_vis=flatten(item_7))  # -> mat; plug-in component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
windowconstr_3 = HBWindowConstruction(name="NGlass", materials=flatten(windowmat_3))  # -> constr; plug-in component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

match_6 = MatchTree(Tree=face_6.faces, Guide=clean)

aperturesbyratio_3 = HBAperturesByRatio(hb_objs=match_6, ratio=flatten(wwr_n_s_e_w.Branch0), win_height=subtraction, sill_height=number_slider)  # -> report, hb_objs; plug-in component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
applywindowconstr_3 = HBApplyWindowConstruction(hb_objs=aperturesbyratio_3.hb_objs, constr=windowconstr_3)  # -> hb_objs; plug-in component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
louvershades_7 = HBLouverShades(hb_objs=applywindowconstr_3, depth=flatten(shade_depth_n_s_e_w.Branch0))  # -> report, hb_objs; plug-in component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

decnstrconstr_3 = HBDeconstructConstruction(constr=windowconstr_3)  # -> materials, layers, r_val_si, r_val_ip, u_fac_si, u_fac_ip, t_sol, t_vis; plug-in component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
filter_10 = StreamFilter(Gate=larger_13.LargerThan, Stream0=applywindowconstr_3, Stream1=louvershades_7.hb_objs)
louvershades_8 = HBLouverShades(hb_objs=filter_10, depth=flatten(vertical_depth_n_s_e_w.Branch0), vertical=True)  # -> report, hb_objs; plug-in component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
filter_11 = StreamFilter(Gate=larger_4.LargerThan, Stream0=filter_10, Stream1=louvershades_8.hb_objs)
louvershades_9 = HBLouverShades(hb_objs=filter_11, depth=flatten(flip_vertical_n_s_e_w.Branch0), vertical=True, flip_start=True)  # -> report, hb_objs; plug-in component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
filter_12 = StreamFilter(Gate=larger_6.LargerThan, Stream0=filter_11, Stream1=louvershades_9.hb_objs)

face_7 = HBFace(geo=clean_2, name="Exposed Wall", type="Wall", bc="Outdoors")  # -> report, simplify(faces); plug-in component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
windowmat_4 = HBWindowMaterial(name=item_8, u_factor=flatten(multiplication_3), shgc=flatten(shgc_n_s_e_w.Branch1), t_vis=flatten(item_7))  # -> mat; plug-in component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
windowconstr_4 = HBWindowConstruction(name="SGlass", materials=flatten(windowmat_4))  # -> constr; plug-in component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

match_7 = MatchTree(Tree=face_7.faces, Guide=clean_2)

aperturesbyratio_4 = HBAperturesByRatio(hb_objs=match_7, ratio=flatten(wwr_n_s_e_w.Branch1), win_height=subtraction, sill_height=number_slider)  # -> report, hb_objs; plug-in component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
applywindowconstr_4 = HBApplyWindowConstruction(hb_objs=aperturesbyratio_4.hb_objs, constr=windowconstr_4)  # -> hb_objs; plug-in component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
louvershades_10 = HBLouverShades(hb_objs=applywindowconstr_4, depth=flatten(shade_depth_n_s_e_w.Branch1))  # -> report, hb_objs; plug-in component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

filter_13 = StreamFilter(Gate=larger_10.LargerThan, Stream0=applywindowconstr_4, Stream1=louvershades_10.hb_objs)
louvershades_11 = HBLouverShades(hb_objs=filter_13, depth=flatten(vertical_depth_n_s_e_w.Branch1), vertical=True)  # -> report, hb_objs; plug-in component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
filter_14 = StreamFilter(Gate=larger_2.LargerThan, Stream0=filter_13, Stream1=louvershades_11.hb_objs)
louvershades_12 = HBLouverShades(hb_objs=filter_14, depth=flatten(flip_vertical_n_s_e_w.Branch1), vertical=True, flip_start=True)  # -> report, hb_objs; plug-in component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
filter_15 = StreamFilter(Gate=larger_7.LargerThan, Stream0=filter_14, Stream1=louvershades_12.hb_objs)

n_s_e_w_exterior_walls = Merge(Data1=filter_12, Data2=filter_15, Data3=filter_9, Data4=filter_6)
remove_empy_zones = CleanTree(RemoveNulls=True, RemoveInvalid=True, RemoveEmpty=True, Tree=n_s_e_w_exterior_walls)

clean_10 = CleanTree(RemoveNulls=True, RemoveInvalid=True, RemoveEmpty=True, Tree=[remove_empy_zones, match_3, match, match_2])
tstat = TreeStatistics(Tree=clean_10)  # -> Paths, Length, Count
zone_names = TreeBranch(Tree=simplify(trees_from_building.zones), Path=tstat.Paths, MaintainPaths=True)
room = HBRoom(faces=clean_10, name=zone_names, program=trees_from_building.zone_program, conditioned=True)  # -> report, room; plug-in component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

clean_11 = CleanTree(RemoveNulls=True, RemoveInvalid=True, RemoveEmpty=False, Tree=room.room)  # -> flatten(Tree)
applyconstrset = HBApplyConstructionSet(rooms=clean_11, constr_set=constructionset)  # -> rooms; plug-in component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

labelrooms = HBLabelRooms(rooms_model=flatten(applyconstrset), attribute=roomattr)  # -> graft(label_text), base_pts, labels, wire_frame; plug-in component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
lng = ListLength(List=flatten(labelrooms.label_text))
model = HBModel(rooms=flatten(applyconstrset), name=trees_from_building.simulation_name)  # -> report, model; plug-in component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
panel_8 = Panel(lng)
split = SplitList(List=panel_6, Index=panel_8)  # -> ListA, ListB
rep = ReplaceText(Text=panel_4, Find="Zone_Name", Replace=simplify(labelrooms.label_text), RecursiveReplace=False)
rep_2 = ReplaceText(Text=rep, Find="Test", Replace=graft(split.ListA), RecursiveReplace=False)
split_2 = SplitList(List=panel_7, Index=panel_8)  # -> ListA, ListB
rep_3 = ReplaceText(Text=panel_5, Find="Zone_Name", Replace=simplify(labelrooms.label_text), RecursiveReplace=False)
rep_4 = ReplaceText(Text=rep_2, Find="DaylRefPt1", Replace=graft(split_2.ListA), RecursiveReplace=False)  # -> flatten(Result)
rep_5 = ReplaceText(Text=rep_3, Find="DaylRefPt1", Replace=graft(split_2.ListA), RecursiveReplace=False)
rep_6 = ReplaceText(Text=rep_5, Find="point1_x", Replace=clean_7, RecursiveReplace=False)
rep_7 = ReplaceText(Text=rep_6, Find="point1_y", Replace=clean_9, RecursiveReplace=False)
rep_8 = ReplaceText(Text=rep_7, Find="point1_z", Replace=clean_8, RecursiveReplace=False)  # -> flatten(Result)
join_2 = TextJoin(Text=rep_4)
join_3 = TextJoin(Text=rep_8)
join_4 = TextJoin(Text=[join_2, join_3])

# ----
# Energy Simulation
toggle = BooleanToggle(True)
simoutput = HBSimulationOutput(zone_energy_use=toggle, gains_and_losses=toggle)  # -> report, sim_output; plug-in component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
simpar = HBSimulationParameter(output=simoutput.sim_output, timestep=6)  # -> sim_par; plug-in component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
model_2 = HBModel(rooms=flatten(applyconstrset), shades=flatten(shade.shades), name=trees_from_building.simulation_name)  # -> report, model; plug-in component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

null = NullItem(Item=model_2.model)  # -> NullFlags, InvalidFlags, Description
filter_16 = StreamFilter(Gate=null.InvalidFlags, Stream0=model_2.model, Stream1=model.model)

modeltoosm = HBModelToOSM(
    model=filter_16,
    epw_file=trees_from_building.weather_file,
    sim_par=simpar,
    add_str=flatten(join_4),
    folder=trees_from_building.simulation_folder,
    write=trees_from_building.run_simulation,
    run=trees_from_building.run_simulation)  # -> report, jsons, osw, osm, idf, sql, zsz, rdd, html; plug-in component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
roomenergyresult = HBReadRoomEnergyResult(sql=modeltoosm.sql)  # -> cooling, heating, lighting, electric_equip, gas_equip, hot_water, fan_electric, pump_electric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; plug-in component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

s_1 = ClusterOutput(filter_16)
sql = ClusterOutput(modeltoosm.sql)
add_euis = GhPythonScript(
    building=trees_from_building.building,
    cooling=roomenergyresult.cooling,
    heating=roomenergyresult.heating,
    lighting=roomenergyresult.lighting,
    equipment=roomenergyresult.electric_equip,
    hot_water=roomenergyresult.hot_water,
    wall_r=one_over_x,
    window_u=decnstrconstr_3.u_fac_ip)  # -> out, building; inputs cooling: list, heating: list, lighting: list, equipment: list, hot_water: list
# ---------- add_euis: Python ----------
__author__ = "tmendeze"

building.add_eui_results(cooling,
                         heating,
                         lighting,
                         equipment,
                         hot_water,
                         wall_r,
                         window_u)
# ---------- end add_euis ----------
panel_9 = Panel(roomenergyresult.hot_water)
panel_10 = Panel(add_euis.out)
out_2 = ClusterOutput(add_euis.out)
building_2 = ClusterOutput(add_euis.building)
panel_11 = Panel(add_euis.building)

# ==== cluster BlackBox
_0_0 = ClusterInput()
_0_1 = ClusterInput()
_0_2 = ClusterInput()
_0_3 = ClusterInput()
_0_4 = ClusterInput()
_0_5 = ClusterInput()
_0_6 = ClusterInput()
_0_7 = ClusterInput()
_0_8 = ClusterInput()
_0_9 = ClusterInput()
_0_10 = ClusterInput()
_0_11 = ClusterInput()
_0_12 = ClusterInput()
_0_13 = ClusterInput()
_0_14 = ClusterInput()
_0_15 = ClusterInput()
_0_16 = ClusterInput()
_0_17 = ClusterInput()
_0_18 = ClusterInput()
_0_19 = ClusterInput()
_0_20 = ClusterInput()
_0_21 = ClusterInput()
_0_22 = ClusterInput()
_0_23 = ClusterInput()
_0_24 = ClusterInput()
_0_25 = ClusterInput()
_0_26 = ClusterInput()
_0_27 = ClusterInput()
_0_28 = ClusterInput()
_0_29 = ClusterInput()
_0_30 = ClusterInput()
_0_31 = ClusterInput()
_0_32 = ClusterInput()
_0_33 = ClusterInput()
_0_34 = ClusterInput()
_0_35 = ClusterInput()
_0_36 = ClusterInput()
_0_37 = ClusterInput()
_0_38 = ClusterInput()
gather_all_info_from_scenario = Entwine(
    Branch00=_0_0,
    Branch01=_0_1,
    Branch02=_0_2,
    Branch03=_0_3,
    Branch04=_0_4,
    Branch05=_0_5,
    Branch06=_0_6,
    Branch07=_0_7,
    Branch08=_0_8,
    Branch09=_0_9,
    Branch010=_0_10,
    Branch011=_0_11,
    Branch012=_0_12,
    Branch013=_0_13,
    Branch014=_0_14,
    Branch015=_0_15,
    Branch016=_0_16,
    Branch017=_0_17,
    Branch018=_0_18,
    Branch019=_0_19,
    Branch020=_0_20,
    Branch021=_0_21,
    Branch022=_0_22,
    Branch023=_0_23,
    Branch024=_0_24,
    Branch025=_0_25,
    Branch026=_0_26,
    Branch027=_0_27,
    Branch028=_0_28,
    Branch029=_0_29,
    Branch030=_0_30,
    Branch031=_0_31,
    Branch032=_0_32,
    Branch033=_0_33,
    Branch034=_0_34,
    Branch035=_0_35,
    Branch036=_0_36,
    Branch037=_0_37,
    Branch038=_0_38,
    FlattenInputs=True)  # -> simplify(Result)
filter = StreamFilter(Gate=Toggle(True), Stream1=gather_all_info_from_scenario)
_0_0_2 = ClusterInput()
_0_1_2 = ClusterInput()
_0_2_2 = ClusterInput()
_0_3_2 = ClusterInput()
_0_4_2 = ClusterInput()

merge = Merge(Data2=filter)
bang = ExplodeTree(Data=merge)  # -> Branch0, Branch1, Branch2, Branch3, Branch4, Branch5, Branch6, Branch7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
adiabaticcrv = Entwine(
    Branch00=bang.Branch3,
    Branch01=bang.Branch5,
    Branch02=bang.Branch7,
    Branch03=bang.Branch9,
    Branch04=bang.Branch10,
    FlattenInputs=True)  # -> simplify(Result)
outsidecrv = Entwine(Branch00=bang.Branch2, Branch01=bang.Branch4, Branch02=bang.Branch6, Branch03=bang.Branch8, FlattenInputs=True)  # -> simplify(Result)
zone = Entwine(Branch00=_0_0_2, Branch01=_0_1_2, Branch02=_0_2_2, Branch03=_0_3_2, Branch04=_0_4_2, FlattenInputs=True)  # -> simplify(Result)
vertical_shade_depth_direction_1 = Entwine(Branch00=bang.Branch21, Branch01=bang.Branch22, Branch02=bang.Branch23, Branch03=bang.Branch24, FlattenInputs=True)  # -> simplify(Result)
wwr = Entwine(Branch00=bang.Branch13, Branch01=bang.Branch14, Branch02=bang.Branch15, Branch03=bang.Branch16, FlattenInputs=True)  # -> simplify(Result)
horizontal_shade_depth = Entwine(Branch00=bang.Branch17, Branch01=bang.Branch18, Branch02=bang.Branch19, Branch03=bang.Branch20, FlattenInputs=True)  # -> simplify(Result)
shgc = Entwine(Branch00=bang.Branch29, Branch01=bang.Branch30, Branch02=bang.Branch31, Branch03=bang.Branch32, FlattenInputs=True)  # -> simplify(Result)
vertical_shade_depth_direction_2 = Entwine(Branch00=bang.Branch25, Branch01=bang.Branch26, Branch02=bang.Branch27, Branch03=bang.Branch28, FlattenInputs=True)  # -> simplify(Result)
division = Division(A=horizontal_shade_depth, B=12)
division_2 = Division(A=vertical_shade_depth_direction_1, B=12)
division_3 = Division(A=vertical_shade_depth_direction_2, B=12)

boundary = BoundarySurfaces(FloorCrvs=[outsidecrv, adiabaticcrv])  # -> simplify(Surfaces)
Z = UnitZ(Factor=bang.Branch1)
extr = Extrude(Base=boundary, Direction=Z)
extr_2 = Extrude(OutsideCrv=outsidecrv, Direction=Z)  # -> simplify(OutsideSrf)
debrep = DeconstructBrep(Brep=extr)  # -> simplify(Faces), Edges, Vertices
area = Area(Geometry=debrep.Faces)  # -> Area, Centroid
brep = Brep(debrep.Faces)
area_2 = Area(Geometry=extr_2)  # -> Area, Centroid
mindex = MemberIndex(Set=area.Centroid, Member=area_2.Centroid)  # -> Index, Count
srf = Surface([brep, extr_2])
trim = TrimTree(Tree=mindex.Index, Depth=1)
join = JoinCurves(Curves=[outsidecrv, adiabaticcrv], Preserve=False)  # -> simplify(Curves)
item = ListItem(List=srf, Index=trim, Wrap=True)
extr_3 = Extrude(AdiabaticCrv=adiabaticcrv, Direction=Z)  # -> simplify(AdiabaticSrf)
move = Move(Geometry=join, Motion=Z)  # -> Geometry, Transform
clean = CleanTree(RemoveNulls=True, RemoveInvalid=True, RemoveEmpty=True, Tree=item)  # -> simplify(Tree)
facen = FaceNormals(Mesh=clean)  # -> Centers, Normals
debrep_2 = DeconstructBrep(Brep=extr_3)  # -> Faces, Edges, Vertices
cullpt = CullDuplicates(Points=facen.Normals, Tolerance=0.1, CullMode=3)  # -> Points, Indices, Valence
join_2 = JoinCurves(Curves=debrep_2.Edges, Preserve=False)
devec = DeconstructVector(Vector=cullpt.Points)  # -> XComponent, YComponent, ZComponent
trim_2 = TrimTree(Tree=join_2, Depth=Slider(2, range=0..10))
larger = LargerThan(FirstNumber=devec.XComponent, SecondNumber="-0.707")  # -> LargerThan, OrEqualTo
smaller = SmallerThan(FirstNumber=devec.YComponent, SecondNumber="-0.707")  # -> SmallerThan, OrEqualTo
larger_2 = LargerThan(FirstNumber=devec.YComponent, SecondNumber="-1")  # -> LargerThan, OrEqualTo
smaller_2 = SmallerThan(FirstNumber=devec.YComponent, SecondNumber="1")  # -> SmallerThan, OrEqualTo
larger_3 = LargerThan(FirstNumber=devec.YComponent, SecondNumber="0.707")  # -> LargerThan, OrEqualTo
smaller_3 = SmallerThan(FirstNumber=devec.XComponent, SecondNumber="1")  # -> SmallerThan, OrEqualTo
smaller_4 = SmallerThan(FirstNumber=devec.XComponent, SecondNumber="0.707")  # -> SmallerThan, OrEqualTo
smaller_5 = SmallerThan(FirstNumber=devec.YComponent, SecondNumber="0.707")  # -> SmallerThan, OrEqualTo
larger_4 = LargerThan(FirstNumber=devec.YComponent, SecondNumber="-0.707")  # -> LargerThan, OrEqualTo
larger_5 = LargerThan(FirstNumber=devec.XComponent, SecondNumber="0.707")  # -> LargerThan, OrEqualTo
larger_6 = LargerThan(FirstNumber=devec.XComponent, SecondNumber="-1")  # -> LargerThan, OrEqualTo
smaller_6 = SmallerThan(FirstNumber=devec.XComponent, SecondNumber="-0.707")  # -> SmallerThan, OrEqualTo
and = GateAnd(A=larger.LargerThan, B=smaller_4.SmallerThan)
and_2 = GateAnd(A=larger_2.OrEqualTo, B=smaller.SmallerThan)
and_3 = GateAnd(A=larger_3.LargerThan, B=smaller_2.OrEqualTo)
and_4 = GateAnd(A=larger_5.LargerThan, B=smaller_3.OrEqualTo)
and_5 = GateAnd(A=larger_4.OrEqualTo, B=smaller_5.SmallerThan)
and_6 = GateAnd(A=larger_6.OrEqualTo, B=smaller_6.SmallerThan)
and_7 = GateAnd(A=and, B=and_3)
and_8 = GateAnd(A=and, B=and_2)
and_9 = GateAnd(A=and_5, B=and_6)
and_10 = GateAnd(A=and_4, B=and_5)
cull = CullPattern(List=graft(clean), CullPattern=and_8)
cull_2 = CullPattern(List=graft(clean), CullPattern=and_9)
cull_3 = CullPattern(List=graft(clean), CullPattern=and_10)
cull_4 = CullPattern(List=graft(clean), CullPattern=and_7)
pshift = ShiftPaths(Data=cull, Offset=-2)
pshift_2 = ShiftPaths(Data=cull_4, Offset=-2)
pshift_3 = ShiftPaths(Data=cull_2, Offset=-2)
pshift_4 = ShiftPaths(Data=cull_3, Offset=-2)
debrep_3 = DeconstructBrep(Brep=pshift_2)  # -> Faces, Edges, Vertices
debrep_4 = DeconstructBrep(Brep=pshift)  # -> Faces, Edges, Vertices
debrep_5 = DeconstructBrep(Brep=pshift_4)  # -> Faces, Edges, Vertices
debrep_6 = DeconstructBrep(Brep=pshift_3)  # -> Faces, Edges, Vertices
join_3 = JoinCurves(Curves=debrep_3.Edges, Preserve=False)
join_4 = JoinCurves(Curves=debrep_4.Edges, Preserve=False)
join_5 = JoinCurves(Curves=debrep_5.Edges, Preserve=False)
join_6 = JoinCurves(Curves=debrep_6.Edges, Preserve=False)
trim_3 = TrimTree(Tree=join_3, Depth=Slider(2, range=0..10))
trim_4 = TrimTree(Tree=join_4, Depth=Slider(2, range=0..10))
trim_5 = TrimTree(Tree=join_5, Depth=Slider(2, range=0..10))
trim_6 = TrimTree(Tree=join_6, Depth=Slider(2, range=0..10))
clean_2 = CleanTree(RemoveNulls=True, RemoveInvalid=True, RemoveEmpty=False, Tree=move.Geometry)
interior_insul_mat = ClusterInput()
building_type = ClusterInput()
num_floors_above = ClusterInput()
composite_slab = ClusterInput()
cores = ClusterInput()
glazing_system = ClusterInput()
city = ClusterInput()
simulation_name = ClusterInput()
weather_file = ClusterInput()
csv = ClusterInput()
sql_path = ClusterInput()
simulation_folder = ClusterInput()
run_simulation = ClusterInput()
columns = ClusterInput()
beams_x = ClusterInput()
beams_y = ClusterInput()
kgco2e_kwh = ClusterInput()
context = ClusterInput()
building = GhPythonScript(
    city=city,
    znames=zone,
    wwr=wwr,
    height=bang.Branch1,
    shade_gc=shgc,
    shade_depth_h=division,
    shade_depth_v1=division_2,
    shade_depth_v2=division_3,
    exterior_walls_n=trim_3,
    exterior_walls_s=trim_4,
    exterior_walls_e=trim_5,
    exterior_walls_w=trim_6,
    adiabatic_walls=trim_2,
    floor_surfaces=join,
    ceiling_surfaces=clean_2,
    facade_cladding=bang.Branch34,
    external_insulation=bang.Branch35,
    insulation_thickness=bang.Branch36,
    interior_insul_mat=interior_insul_mat,
    ewall_framing=bang.Branch37,
    int_finish=bang.Branch38,
    glazing_system=glazing_system,
    simulation_name=simulation_name,
    zone_program=bang.Branch33,
    weather_file=weather_file,
    csv=csv,
    sql_path=sql_path,
    simulation_folder=simulation_folder,
    run_simulation=run_simulation,
    columns=columns,
    beams_x=beams_x,
    beams_y=beams_y,
    cores=cores,
    building_type=building_type,
    num_floors_above=num_floors_above,
    composite_slab=composite_slab,
    ceiling_condition=bang.Branch11,
    floor_condition=bang.Branch12,
    kgco2e_kwh=kgco2e_kwh,
    context=context)  # -> out, building; inputs znames: tree, wwr: tree, shade_gc: tree, shade_depth_h: tree, shade_depth_v1: tree, shade_depth_v2: tree, exterior_walls_n: tree, exterior_walls_s: tree, exterior_walls_e: tree, exterior_walls_w: tree, adiabatic_walls: tree, floor_surfaces: tree, ceiling_surfaces: tree, columns: list, beams_x: list, beams_y: list, cores: list, context: list
# ---------- building: Python ----------
from studio2021.datastructures import building
reload(building)
from studio2021.datastructures.building import Building
import rhinoscriptsyntax as rs


columns = [[rs.CurveStartPoint(c), rs.CurveEndPoint(c)] for c in columns]
beams_x = [[rs.CurveStartPoint(b), rs.CurveEndPoint(b)] for b in beams_x]
beams_y = [[rs.CurveStartPoint(b), rs.CurveEndPoint(b)] for b in beams_y]
cores   = [rs.PolylineVertices(core) for core in cores]

context_ = []
for guid in context:
    if rs.IsSurface(guid):
        pt = [list(p) for p in rs.SurfacePoints(guid)]
        context_.append((pt[0], pt[1], pt[3], pt[2]))
    elif rs.IsBrep(guid):
        srfs = rs.ExplodePolysurfaces(guid)
        for srf in srfs:
            pt = [list(p) for p in rs.SurfacePoints(srf)]
            context_.append((pt[0], pt[1], pt[3], pt[2]))

data = {'city': city,
        'znames': znames,
        'exterior_walls_n': exterior_walls_n,
        'exterior_walls_s': exterior_walls_s,
        'exterior_walls_e': exterior_walls_e,
        'exterior_walls_w': exterior_walls_w,
        'adiabatic_walls': adiabatic_walls,
        'floor_surfaces': floor_surfaces,
        'ceiling_surfaces': ceiling_surfaces,
        'wwr':wwr,
        'height': height,
        'shade_gc':shade_gc,
        'shade_depth_h':shade_depth_h,
        'shade_depth_v1':shade_depth_v1,
        'shade_depth_v2':shade_depth_v2,
        'facade_cladding':facade_cladding,
        'external_insulation':external_insulation,
        'insulation_thickness':insulation_thickness,
        'interior_insul_mat':interior_insul_mat,
        'ewall_framing':ewall_framing,
        'int_finish':int_finish,
        'glazing_system':glazing_system,
        'simulation_name': simulation_name,
        'zone_program': zone_program,
        'weather_file': weather_file,
        'csv':csv,
        'sql_path': sql_path,
        'simulation_folder': simulation_folder,
        'run_simulation': run_simulation,
        'columns': columns,
        'beams_x': beams_x,
        'beams_y': beams_y,
        'cores':cores,
        'building_type':building_type,
        'num_floors_above':num_floors_above,
        'composite_slab':composite_slab,
        'ceiling_condition': ceiling_condition,
        'floor_condition': floor_condition,
        'kgco2e_kwh': kgco2e_kwh,
        'context':context_,
        }

building = Building.from_gh_data(data)
# ---------- end building ----------
out = ClusterOutput(building.out)
panel = Panel(building.out)
building_2 = ClusterOutput(building.building)

# ==== cluster Cluster_2
sql = ClusterInput()
roomenergyresult = HBReadRoomEnergyResult(sql=sql)  # -> cooling, heating, lighting, electric_equip, gas_equip, hot_water, fan_electric, pump_electric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; plug-in component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
toip = LBToIP(data_si=roomenergyresult.hot_water)  # -> data_ip; plug-in component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
toip_2 = LBToIP(data_si=roomenergyresult.electric_equip)  # -> data_ip; plug-in component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
toip_3 = LBToIP(data_si=roomenergyresult.people_gain)  # -> data_ip; plug-in component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
toip_4 = LBToIP(data_si=roomenergyresult.solar_gain)  # -> data_ip; plug-in component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
toip_5 = LBToIP(data_si=roomenergyresult.heating)  # -> data_ip; plug-in component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
toip_6 = LBToIP(data_si=roomenergyresult.lighting)  # -> data_ip; plug-in component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
toip_7 = LBToIP(data_si=roomenergyresult.cooling)  # -> data_ip; plug-in component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
xdata = LBDeconstructData(data=toip)  # -> header, values; plug-in component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
xdata_2 = LBDeconstructData(data=toip_2)  # -> header, values; plug-in component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
xdata_3 = LBDeconstructData(data=toip_4)  # -> header, values; plug-in component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
xdata_4 = LBDeconstructData(data=toip_3)  # -> header, values; plug-in component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
xdata_5 = LBDeconstructData(data=toip_5)  # -> header, values; plug-in component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
xdata_6 = LBDeconstructData(data=toip_6)  # -> header, values; plug-in component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
xdata_7 = LBDeconstructData(data=toip_7)  # -> header, values; plug-in component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
addition = Addition(A=xdata_7.values, B=xdata_5.values, C=xdata_6.values, D=xdata_2.values, E=xdata.values)
constrtype = LBConstructDataType(name="Heating", unit="kBtu")  # -> type; plug-in component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
constrtype_2 = LBConstructDataType(name="Cooling", unit="kBtu")  # -> type; plug-in component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
constrtype_3 = LBConstructDataType(name="Lighting", unit="kBtu")  # -> type; plug-in component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
constrtype_4 = LBConstructDataType(name="Equipment", unit="kBtu")  # -> type; plug-in component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
constrtype_5 = LBConstructDataType(name="Total Energy", unit="kBtu")  # -> type; plug-in component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
constrtype_6 = LBConstructDataType(name="People Gain", unit="kBtu")  # -> type; plug-in component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
constrtype_7 = LBConstructDataType(name="Solar Gain", unit="kBtu")  # -> type; plug-in component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
constrtype_8 = LBConstructDataType(name="Hot Water", unit="kBtu")  # -> type; plug-in component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
constrheader = LBConstructHeader(data_type=constrtype)  # -> header; plug-in component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
constrheader_2 = LBConstructHeader(data_type=constrtype_2)  # -> header; plug-in component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
constrheader_3 = LBConstructHeader(data_type=constrtype_4)  # -> header; plug-in component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
constrheader_4 = LBConstructHeader(data_type=constrtype_5)  # -> header; plug-in component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
constrheader_5 = LBConstructHeader(data_type=constrtype_3)  # -> header; plug-in component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
constrheader_6 = LBConstructHeader(data_type=constrtype_6)  # -> header; plug-in component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
constrheader_7 = LBConstructHeader(data_type=constrtype_7)  # -> header; plug-in component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
constrheader_8 = LBConstructHeader(data_type=constrtype_8)  # -> header; plug-in component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
data = LBConstructData(header=constrheader, values=xdata_5.values)  # -> data; plug-in component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
data_2 = LBConstructData(header=constrheader_2, values=xdata_7.values)  # -> data; plug-in component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
data_3 = LBConstructData(header=constrheader_4, values=addition)  # -> data; plug-in component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
data_4 = LBConstructData(header=constrheader_5, values=xdata_6.values)  # -> data; plug-in component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
data_5 = LBConstructData(header=constrheader_3, values=xdata_2.values)  # -> data; plug-in component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
data_6 = LBConstructData(header=constrheader_6, values=xdata_4.values)  # -> data; plug-in component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
data_7 = LBConstructData(header=constrheader_7, values=xdata_3.values)  # -> data; plug-in component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
data_8 = LBConstructData(header=constrheader_8, values=xdata.values)  # -> data; plug-in component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
data_9 = ClusterOutput(data)
data_10 = ClusterOutput(data_3)
data_11 = ClusterOutput(data_2)
data_12 = ClusterOutput(data_4)
data_13 = ClusterOutput(data_5)
data_14 = ClusterOutput(data_6)
data_15 = ClusterOutput(data_7)
data_16 = ClusterOutput(data_8)

# ==== cluster Cluster_3
D = ClusterInput()
S = ClusterInput()
fsim = FindSimilarMember(Data=D, Set=S)  # -> Hit, Index
_0 = ClusterInput()
_1 = ClusterInput()
_2 = ClusterInput()
_3 = ClusterInput()
_4 = ClusterInput()
_5 = ClusterInput()
_6 = ClusterInput()
_7 = ClusterInput()
filter = StreamFilter(Gate=fsim.Index, Stream0=_0, Stream1=_1, Stream2=_2, Stream3=_3, Stream4=_4, Stream5=_5, Stream6=_6, Stream7=_7)
s_0 = ClusterOutput(filter)
xdata = LBDeconstructData(data=filter)  # -> header, values; plug-in component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
bnd = Bounds(Numbers=flatten(xdata.values))
dedomain = DeconstructDomain(Domain=bnd)  # -> Start, End
E = ClusterOutput(dedomain.End)

# ==== cluster FindBuildableArea
C = ClusterInput()
explode = Explode(Curve=C, Recursive=True)  # -> Segments, Vertices
B = ClusterInput()
item = ListItem(List=explode.Segments, Index=Slider(1, range=0..3), Wrap=True)
edges = BrepEdges(Brep=B)  # -> Naked, Interior, NonManifold
item_2 = ListItem(List=explode.Segments, Index=Slider(0, range=0..3), Wrap=True)
item_3 = ListItem(List=explode.Segments, Index=Slider(2, range=0..3), Wrap=True)
item_4 = ListItem(List=explode.Segments, Index=Slider(3, range=0..3), Wrap=True)
item_5 = ListItem(List=edges.Interior, Index=0, Wrap=True)
midpt = CurveMiddle(Curve=item_5)
midpt_2 = CurveMiddle(Curve=item_4)
X = UnitX(Factor=Slider(8, range=0..100))
X_2 = UnitX(Factor=Slider(20, range=0..100))  # -> expr("-x", UnitVector)
Y = UnitY(Factor=Slider(5, range=0..100))  # -> expr("-x", UnitVector)
Y_2 = UnitY(Factor=Slider(5, range=0..100))
move = Move(Geometry=item_4, Motion=X)  # -> Geometry, Transform
move_2 = Move(Geometry=item, Motion=X_2)  # -> Geometry, Transform
move_3 = Move(Geometry=item_2, Motion=Y_2)  # -> Geometry, Transform
move_4 = Move(Geometry=item_3, Motion=Y)  # -> Geometry, Transform
pdecon = Deconstruct(Point=midpt)  # -> XComponent, YComponent, ZComponent
pdecon_2 = Deconstruct(Point=midpt_2)  # -> XComponent, YComponent, ZComponent
pt = ConstructPoint(XCoordinate=pdecon.XComponent, YCoordinate=pdecon_2.YComponent, ZCoordinate=0)
dist = Distance(PointA=pt, PointB=midpt_2)
subtraction = Subtraction(A=dist, B=Slider(5, range=0..10))
X_3 = UnitX(Factor=subtraction)
item_6 = ListItem(List=flatten(<missing>), Index=Slider(3, range=0..4), Wrap=True)
item_7 = ListItem(List=flatten(<missing>), Index=Slider(0, range=0..4), Wrap=True)
move_5 = Move(Geometry=item_4, Motion=X_3)  # -> Geometry, Transform
end = EndPoints(Curve=move_5.Geometry)  # -> Start, End
pdecon_3 = Deconstruct(Point=end.Start)  # -> XComponent, YComponent, ZComponent
pdecon_4 = Deconstruct(Point=item_7)  # -> XComponent, YComponent, ZComponent
rec_2pt = Rectangle2Pt(Plane=PlaneXY(0, 0, 0), PointA=item_6, PointB=item_7, Radius=0)  # -> Rectangle, Length
pt_2 = ConstructPoint(XCoordinate=pdecon_3.XComponent, YCoordinate=pdecon_4.YComponent, ZCoordinate=0)
rec_2pt_2 = Rectangle2Pt(Plane=PlaneXY(0, 0, 0), PointA=pt_2, PointB=item_6, Radius=0)  # -> Rectangle, Length
R = ClusterOutput(rec_2pt_2.Rectangle)
