# Grasshopper definition ladybug_v1.0.gh (Grasshopper 1.0.7)
# plug-ins: Bifocals

crvdom = CurveDomain()  # -> Curve, Domain
eval = EvaluateCurve()  # -> Point, Tangent, Angle
number_slider = Slider(30.710196, range=30.359396..64.366226)
python = GhPythonScript()  # -> out, a
# ---------- python: Python ----------
__author__ = "preston"

import rhinoscriptsyntax as rs

rs.SurfaceDomain()
# ---------- end python ----------
number_slider_2 = Slider(64, range=30.3..64.3)
number_slider_3 = Slider(-55.71604, range=-58.06431..-28.4163)
number_slider_4 = Slider(-31.2, range=-58..-28.4)

panel = Panel("http://climate.onebuilding.org/WMO_Region_4_North_and_Central_America/USA_United_States_of_America/WA_Washington/USA_WA_Seattle-Tacoma.Intl.AP.727930_TMY3.zip")
number_slider_5 = Slider(2, range=0..20)
downloadepw = LBDownloadWeather(weather_URL=panel)  # -> epw_file, stat_file, ddy_file; plug-in component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
run_sun_hours = BooleanToggle(False)
run_rad_sim = BooleanToggle(True)
context = Brep([<brep referenced from the Rhino model> x34])

crv = Curve(<curve referenced from the Rhino model>)
galapagos = Galapagos(fitness=area_2, gene=[number_slider_4, number_slider_3, number_slider, number_slider_2])
findbuildablearea = FindBuildableArea(C=crv)

explode = Explode(Curve=findbuildablearea, Recursive=True)  # -> Segments, Vertices
item = ListItem(List=explode.Vertices, Index=Slider(0, range=0..3), Wrap=True)
item_2 = ListItem(List=explode.Vertices, Index=Slider(2, range=0..3), Wrap=True)
pdecon = Deconstruct(Point=item_2)  # -> XComponent, YComponent, ZComponent
pdecon_2 = Deconstruct(Point=item)  # -> XComponent, YComponent, ZComponent
dom = ConstructDomain(DomainStart=pdecon_2.YComponent, DomainEnd=pdecon.YComponent)
dom_2 = ConstructDomain(DomainStart=pdecon_2.XComponent, DomainEnd=pdecon.XComponent)
dom² = ConstructDomain²(DomainU=dom, DomainV=dom_2)

panel_2 = Panel(dom²)
pt = ConstructPoint(XCoordinate=number_slider, YCoordinate=number_slider_3, ZCoordinate=0)
pt_2 = ConstructPoint(XCoordinate=number_slider_2, YCoordinate=number_slider_4, ZCoordinate=0)
join = JoinCurves(Curves=explode.Segments, Preserve=False)
rec_2pt = Rectangle2Pt(Plane=PlaneXY(0, 0, 0), PointA=pt_2, PointB=pt, Radius=0)  # -> Rectangle, Length
area = Area(Geometry=join)  # -> Area, Centroid
xy = XYPlane(Origin=Point(0, 0, 0))
area_2 = Area(Geometry=rec_2pt.Rectangle)  # -> Area, Centroid
pl_origin = PlaneOrigin(Base=xy, Origin=area_2.Centroid)
rad = Radians(Degrees=Slider(-6.516, range=-90..90))
panel_3 = Panel(area_2.Area)
rotate = Rotate(Geometry=rec_2pt.Rectangle, Angle=rad, Plane=pl_origin)  # -> Geometry, Transform
explode_2 = Explode(Curve=rec_2pt.Rectangle, Recursive=True)  # -> Segments, Vertices
item_3 = ListItem(List=explode.Vertices, Index=Slider(0, range=0..4), Wrap=True)
item_4 = ListItem(List=explode.Vertices, Index=Slider(1, range=0..4), Wrap=True)
item_5 = ListItem(List=explode.Vertices, Index=Slider(3, range=0..4), Wrap=True)
item_6 = ListItem(List=explode.Vertices, Index=Slider(2, range=0..4), Wrap=True)
srf4pt = _4PointSurface(CornerA=item_3, CornerB=item_4, CornerC=item_6, CornerD=item_5)
join_2 = JoinCurves(Curves=explode.Segments, Preserve=False)
item_7 = ListItem(List=explode_2.Vertices, Index=Slider(0, range=0..4), Wrap=True)
item_8 = ListItem(List=explode_2.Vertices, Index=Slider(1, range=0..4), Wrap=True)
item_9 = ListItem(List=explode_2.Vertices, Index=Slider(3, range=0..4), Wrap=True)
item_10 = ListItem(List=explode_2.Vertices, Index=Slider(2, range=0..4), Wrap=True)
python_2 = GhPythonScript(area=area_2.Area, pt1=item_7, pt2=item_8, pt3=item_10, pt4=item_9, bounds=srf4pt)  # -> out, footprint
# ---------- python_2: Python ----------
__author__ = "preston"

import rhinoscriptsyntax as rs

rec_pts = [pt1, pt2, pt3, pt4]

def checkValidity(rec_pts, bounds, area):
    j = 0
    for i in range(len(rec_pts)):
        if rs.IsPointOnSurface(bounds, rec_pts[i]):
            j+=1
            print('point is on surface')

    if j == 4:
        if area <= 1050 and area >= 800:
            footprint = rs.AddSrfPt(rec_pts)
            return footprint
    else:
        return 0
        
footprint = checkValidity(rec_pts, bounds, area)
print('area = ')    
print(area)
# ---------- end python_2 ----------
edges = BrepEdges(Brep=python_2.footprint)  # -> Naked, Interior, NonManifold
panel_4 = Panel(python_2.out)
join_3 = JoinCurves(Curves=edges.Naked, Preserve=False)
Z = UnitZ(Factor=Slider(16, range=0..100))
extr = Extrude(Base=join_3, Direction=Z)
area_3 = Area(Geometry=join_3)  # -> Area, Centroid
cap = CapHoles(Brep=extr)
num = Number(area_3.Area)
panel_5 = Panel(num)
annualloads = HBAnnualLoads()  # -> out, total_load, cooling, heating, lighting, equip, balance; plug-in component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
model = HBModel()  # -> report, model; plug-in component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
brep = Brep(cap)

importloc = LBImportLocation(epw_file=downloadepw.epw_file)  # -> location; plug-in component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
hoy = LBCalculateHOY(
    month=Slider(1, range=1..12),
    day=Slider(1, range=1..31),
    hour=Slider(15, range=1..23, expression="x-1"),
    minute=Slider(0, range=0..59))  # -> flatten(hoy), flatten(doy), flatten(date); plug-in component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
sunpath = LBSunPath(location=importloc, hoys=hoy.hoy, scale=1)  # -> report, vectors, altitudes, azimuths, hoys, sun_pts, analemma, daily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; plug-in component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
sph = Sphere(Base=sunpath.sun_pts, Radius=Slider(26, range=20..100))
directsunhours = LBDirectSunHours(
    vectors=flatten(sunpath.vectors),
    geometry=flatten(brep),
    context=flatten(context),
    grid_size=number_slider_5,
    run=run_sun_hours)  # -> report, points, results, mesh, legend, title, int_mtx; plug-in component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

importepw = LBImportEPW(epw_file=downloadepw.epw_file)  # -> location, dry_bulb_temperature, dew_point_temperature, relative_humidity, wind_speed, wind_direction, direct_normal_rad, diffuse_horizontal_rad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; plug-in component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
skymatrix = LBCumulativeSkyMatrix(location=importepw.location, direct_rad=importepw.direct_normal_rad, diffuse_rad=importepw.diffuse_horizontal_rad)  # -> out, sky_mtx; plug-in component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
incidentradiation = LBIncidentRadiation(sky_mtx=skymatrix.sky_mtx, geometry=flatten(brep), context=flatten(context), grid_size=number_slider_5, run=run_rad_sim)  # -> out, points, results, total, mesh, legend, title, int_mtx; plug-in component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

panel_6 = Panel(incidentradiation.out)

# ==== cluster FindBuildableArea
C = ClusterInput()
explode = Explode(Curve=C, Recursive=True)  # -> Segments, Vertices
brep = Brep(<brep referenced from the Rhino model>)
item = ListItem(List=explode.Segments, Index=Slider(1, range=0..3), Wrap=True)
edges = BrepEdges(Brep=brep)  # -> Naked, Interior, NonManifold
item_2 = ListItem(List=explode.Segments, Index=Slider(0, range=0..3), Wrap=True)
item_3 = ListItem(List=explode.Segments, Index=Slider(2, range=0..3), Wrap=True)
item_4 = ListItem(List=explode.Segments, Index=Slider(3, range=0..3), Wrap=True)
item_5 = ListItem(List=edges.Interior, Index=0, Wrap=True)
midpt = CurveMiddle(Curve=item_5)
midpt_2 = CurveMiddle(Curve=item_4)
X = UnitX(Factor=Slider(8, range=0..100))
X_2 = UnitX(Factor=Slider(20, range=0..100))  # -> expr("-x", UnitVector)
Y = UnitY(Factor=Slider(5, range=0..100))  # -> expr("-x", UnitVector)
Y_2 = UnitY(Factor=Slider(5, range=0..100))
move = Move(Geometry=item_4, Motion=X)  # -> Geometry, Transform
move_2 = Move(Geometry=item, Motion=X_2)  # -> Geometry, Transform
move_3 = Move(Geometry=item_2, Motion=Y_2)  # -> Geometry, Transform
move_4 = Move(Geometry=item_3, Motion=Y)  # -> Geometry, Transform
pdecon = Deconstruct(Point=midpt)  # -> XComponent, YComponent, ZComponent
pdecon_2 = Deconstruct(Point=midpt_2)  # -> XComponent, YComponent, ZComponent
pt = ConstructPoint(XCoordinate=pdecon.XComponent, YCoordinate=pdecon_2.YComponent, ZCoordinate=0)
ptuvcrvs = IntersectCurves(CU=[move_2.Geometry, move.Geometry], CV=[move_4.Geometry, move_3.Geometry])
dist = Distance(PointA=pt, PointB=midpt_2)
subtraction = Subtraction(A=dist, B=Slider(5, range=0..10))
X_3 = UnitX(Factor=subtraction)
item_6 = ListItem(List=flatten(ptuvcrvs), Index=Slider(3, range=0..4), Wrap=True)
item_7 = ListItem(List=flatten(ptuvcrvs), Index=Slider(0, range=0..4), Wrap=True)
move_5 = Move(Geometry=item_4, Motion=X_3)  # -> Geometry, Transform
end = EndPoints(Curve=move_5.Geometry)  # -> Start, End
pdecon_3 = Deconstruct(Point=end.Start)  # -> XComponent, YComponent, ZComponent
pdecon_4 = Deconstruct(Point=item_7)  # -> XComponent, YComponent, ZComponent
rec_2pt = Rectangle2Pt(Plane=PlaneXY(0, 0, 0), PointA=item_6, PointB=item_7, Radius=0)  # -> Rectangle, Length
pt_2 = ConstructPoint(XCoordinate=pdecon_3.XComponent, YCoordinate=pdecon_4.YComponent, ZCoordinate=0)
rec_2pt_2 = Rectangle2Pt(Plane=PlaneXY(0, 0, 0), PointA=pt_2, PointB=item_6, Radius=0)  # -> Rectangle, Length
R = ClusterOutput(rec_2pt_2.Rectangle)
