# Grasshopper definition GA-analysis.gh (Grasshopper 1.0.7)
# plug-ins: Human

panel = Panel("http://climate.onebuilding.org/WMO_Region_4_North_and_Central_America/USA_United_States_of_America/WA_Washington/USA_WA_Seattle-Tacoma.Intl.AP.727930_TMY3.zip")
number_slider = Slider(2, range=0..20)
downloadepw = LBDownloadWeather(weather_URL=panel)  # -> epw_file, stat_file, ddy_file; plug-in component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
run_sun_hours = BooleanToggle(False)
run_rad_sim = BooleanToggle(True)
context = Brep([<brep referenced from the Rhino model> x34])

crv = Curve(<curve referenced from the Rhino model>)
galapagos = Galapagos()

# ----
# Massing
# Geometry
height_ft = Panel("10")
outsidecrvfromrhino = Curve([<curve referenced from the Rhino model> x3])
outsidecrvfromrhino_2 = Curve([<curve referenced from the Rhino model> x3])
adiabaticcrvfromrhino = Curve(<curve referenced from the Rhino model>)
adiabaticcrvfromrhino_2 = Curve(<curve referenced from the Rhino model>)
adiabaticcrvfromrhino_3 = Curve([<curve referenced from the Rhino model> x3])
adiabaticcrvfromrhino_4 = Curve(<curve referenced from the Rhino model>)
outsidecrvfromrhino_3 = Curve([<curve referenced from the Rhino model> x3])
outsidecrvfromrhino_4 = Curve([<curve referenced from the Rhino model> x3])
adiabaticcrvfromrhino_5 = Curve([<curve referenced from the Rhino model> x4])

findbuildablearea = FindBuildableArea(C=crv)

explode = Explode(Curve=findbuildablearea, Recursive=True)  # -> Segments, Vertices
item = ListItem(List=explode.Vertices, Index=Slider(0, range=0..3), Wrap=True)
item_2 = ListItem(List=explode.Vertices, Index=Slider(2, range=0..3), Wrap=True)
pdecon = Deconstruct(Point=item_2)  # -> XComponent, YComponent, ZComponent
pdecon_2 = Deconstruct(Point=item)  # -> XComponent, YComponent, ZComponent
dom = ConstructDomain(DomainStart=pdecon_2.YComponent, DomainEnd=pdecon.YComponent)
dom_2 = ConstructDomain(DomainStart=pdecon_2.XComponent, DomainEnd=pdecon.XComponent)
dom² = ConstructDomain²(DomainU=dom, DomainV=dom_2)

panel_2 = Panel(dom²)

# ----
# Choose
# Location!
list = ValueList({"Seattle, WA": 0, "Milwaukee, WI": 1, "San Antonio, TX": 2}, selected="San Antonio, TX")

pt = ConstructPoint(
    XCoordinate=Slider(64.366226, range=30.359396..64.366226),
    YCoordinate=Slider(-58.06431, range=-58.06431..-28.4163),
    ZCoordinate=0)
pt_2 = ConstructPoint(
    XCoordinate=Slider(30.359396, range=30.359396..64.366226),
    YCoordinate=Slider(-28.4163, range=-58.06431..-28.4163),
    ZCoordinate=0)
join = JoinCurves(Curves=explode.Segments, Preserve=False)
cities = GhPythonScript(city=list)  # -> out, city, weather_file, kgCo2e_kwh
# ---------- cities: Python ----------
__author__ = "tmendeze"

import rhinoscriptsyntax as rs

from studio2021.functions import city_carbon
reload(city_carbon)
from studio2021.functions.city_carbon import city_EUI
from studio2021.functions.city_carbon import weather

cities = {0: 'Seattle',
          1: 'Milwaukee',
          2: 'San Antonio'}

city = cities[city]
kgCo2e_kwh = city_EUI(city)['kg/kWh']
weather_file = weather(city)
# ---------- end cities ----------
rec_2pt = Rectangle2Pt(Plane=PlaneXY(0, 0, 0), PointA=pt_2, PointB=pt, Radius=0)  # -> Rectangle, Length
area = Area(Geometry=join)  # -> Area, Centroid

# ----
# Ceiling
# Condition
list_2 = ValueList({"Outdoors", "Adiabatic"}, selected="Outdoors")

# ----
# Floor
# Condition
list_3 = ValueList({"Adiabatic", "Ground"}, selected="Ground")

area_2 = Area(Geometry=rec_2pt.Rectangle)  # -> Area, Centroid
xy = XYPlane(Origin=Point(0, 0, 0))
panel_3 = Panel(area_2.Area)
pl_origin = PlaneOrigin(Base=xy, Origin=area_2.Centroid)

# ----
# INPUTS
# Run Energy
# Simulation
run_energy_simulation = BooleanToggle(False)

# ----
# Simulation Inputs
# Simulation Folder Name:
# Simulation Name:
# .sql Filepath:
path = GhPythonScript()  # -> out, path
# ---------- path: Python ----------
__author__ = "tmendeze"


import studio2021

path = studio2021.TEMP
# ---------- end path ----------
panel_4 = Panel("clever_name")
panel_5 = Panel(path.path)
time_stamp = GhPythonScript(name=panel_4, run=run_energy_simulation)  # -> out, name
# ---------- time_stamp: Python ----------
__author__ = "tmendeze"

import rhinoscriptsyntax as rs
if run:
    import datetime
    time = datetime.datetime.now().strftime('%Y%m%d%H%M')
    name_ = '{}_{}'.format(name, time)
    print(name_)
else:
    name_=name
# ---------- end time_stamp ----------
# Scenario:
csv_path = GhPythonScript(path=path.path, sim_name=time_stamp.name)  # -> out, sql_path
# ---------- csv_path: Python ----------
__author__ = "tmendeze"
__version__ = "2021.03.02"

import rhinoscriptsyntax as rs
import os
sql = os.path.join('OpenStudio','run','eplusout.sql')
sql_path = os.path.join(path, sim_name, sql)
# ---------- end csv_path ----------
panel_6 = Panel(csv_path.sql_path)

# ----
# Simulation Outputs
# Output Folder Name:
csv_path_2 = GhPythonScript(path=path.path, sim_name=time_stamp.name)  # -> out, csv_path
# ---------- csv_path_2: Python ----------
__author__ = "tmendeze"
__version__ = "2021.03.02"

import rhinoscriptsyntax as rs
import os
csv_path = os.path.join(path, sim_name+".csv")
# ---------- end csv_path_2 ----------
panel_7 = Panel(csv_path_2.csv_path)

rad = Radians(Degrees=Slider(-6.516, range=-90..90))
ext_insulation_thickness_in = Slider(3, range=0..12)
int_insulation = ValueList({"Fiberglass", "Cellulose", "None"}, selected="None")
rotate = Rotate(Geometry=rec_2pt.Rectangle, Angle=rad, Plane=pl_origin)  # -> Geometry, Transform
explode_2 = Explode(Curve=rec_2pt.Rectangle, Recursive=True)  # -> Segments, Vertices

# ----
# Add Context
pipeline = GeometryPipeline(
    GroupByLayer=False,
    GroupByType=False,
    IncludeHidden=True,
    IncludeLocked=True,
    LayerFilter="context",
    NameFilter="*",
    SublayerFiltering=True,
    TypeFilter=1073741848)
context_geometry = Brep()
data = Data(pipeline)

item_3 = ListItem(List=explode.Vertices, Index=Slider(0, range=0..4), Wrap=True)
item_4 = ListItem(List=explode.Vertices, Index=Slider(1, range=0..4), Wrap=True)
item_5 = ListItem(List=explode.Vertices, Index=Slider(3, range=0..4), Wrap=True)
item_6 = ListItem(List=explode.Vertices, Index=Slider(2, range=0..4), Wrap=True)
srf4pt = _4PointSurface(CornerA=item_3, CornerB=item_4, CornerC=item_6, CornerD=item_5)
join_2 = JoinCurves(Curves=explode.Segments, Preserve=False)
item_7 = ListItem(List=explode_2.Vertices, Index=Slider(0, range=0..4), Wrap=True)
item_8 = ListItem(List=explode_2.Vertices, Index=Slider(1, range=0..4), Wrap=True)
item_9 = ListItem(List=explode_2.Vertices, Index=Slider(3, range=0..4), Wrap=True)
item_10 = ListItem(List=explode_2.Vertices, Index=Slider(2, range=0..4), Wrap=True)
python = GhPythonScript(area=area_2.Area, pt1=item_7, pt2=item_8, pt3=item_10, pt4=item_9, bounds=srf4pt)  # -> out, footprint
# ---------- python: Python ----------
__author__ = "preston"

import rhinoscriptsyntax as rs

rec_pts = [pt1, pt2, pt3, pt4]

def checkValidity(rec_pts, bounds, area):
    j = 0
    for i in range(len(rec_pts)):
        if rs.IsPointOnSurface(bounds, rec_pts[i]):
            j+=1
            print('point is on surface')

    if j == 4:
        if area <= 1000 and area >= 800:
            footprint = rs.AddSrfPt(rec_pts)
            return footprint
    else:
        return 
        
footprint = checkValidity(rec_pts, bounds, area)
print('area = ')    
print(area)
# ---------- end python ----------
edges = BrepEdges(Brep=python.footprint)  # -> Naked, Interior, NonManifold
panel_8 = Panel(python.out)
join_3 = JoinCurves(Curves=edges.Naked, Preserve=False)
Z = UnitZ(Factor=Slider(16, range=0..100))
extr = Extrude(Base=join_3, Direction=Z)
area_3 = Area(Geometry=join_3)  # -> Area, Centroid
num = Number(area_3.Area)
cap = CapHoles(Brep=extr)

# ---- group: generate trees for radiance
# % to keep
number_slider_2 = Slider(50, range=0..100)  # disabled
mesh_sphere = MeshSphere(Base=PlaneXY(0, 0, 0), Radius=10, UCount=number_slider_2, VCount=number_slider_2)  # disabled
triangulate = Triangulate(Mesh=mesh_sphere)  # -> Mesh, Count; disabled
number_slider_3 = Slider(0.27, range=0..1)  # disabled
deconstruct_mesh = DeconstructMesh(Mesh=triangulate.Mesh)  # -> Vertices, Faces, Colours, Normals; disabled
list_length = ListLength(List=deconstruct_mesh.Faces)  # disabled
multiplication = Multiplication(A=list_length, B=number_slider_3)  # disabled
series = Series(Start=0, Step=1, Count=list_length)  # disabled
random_reduce = RandomReduce(List=series, Reduction=multiplication, Seed=1)  # disabled
ghpython_script = PythonScript(x=series, y=random_reduce)  # -> a; inputs x: list, y: list; disabled
# ---------- ghpython_script: Python ----------
a = (i in y for i in x)
# ---------- end ghpython_script ----------
cull_faces = CullFaces(Mesh=triangulate.Mesh, Pattern=ghpython_script)  # disabled
colour_swatch = ColourSwatch(SwatchColor=RGB(51, 149, 66))  # disabled
custom_preview = CustomPreview(Geometry=cull_faces, Shader=colour_swatch)  # disabled

# ----
panel_9 = Panel(num)
brep = Brep(cap)

importloc = LBImportLocation(epw_file=downloadepw.epw_file)  # -> location; plug-in component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
hoy = LBCalculateHOY(
    month=Slider(1, range=1..12),
    day=Slider(1, range=1..31),
    hour=Slider(15, range=1..23, expression="x-1"),
    minute=Slider(0, range=0..59))  # -> flatten(hoy), flatten(doy), flatten(date); plug-in component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
sunpath = LBSunPath(location=importloc, hoys=hoy.hoy, scale=1)  # -> report, vectors, altitudes, azimuths, hoys, sun_pts, analemma, daily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; plug-in component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
sph = Sphere(Base=sunpath.sun_pts, Radius=Slider(26, range=20..100))
directsunhours = LBDirectSunHours(
    vectors=flatten(sunpath.vectors),
    geometry=flatten(brep),
    context=flatten(context),
    grid_size=number_slider,
    run=run_sun_hours)  # -> report, points, results, mesh, legend, title, int_mtx; plug-in component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

importepw = LBImportEPW(epw_file=downloadepw.epw_file)  # -> location, dry_bulb_temperature, dew_point_temperature, relative_humidity, wind_speed, wind_direction, direct_normal_rad, diffuse_horizontal_rad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; plug-in component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
skymatrix = LBCumulativeSkyMatrix(location=importepw.location, direct_rad=importepw.direct_normal_rad, diffuse_rad=importepw.diffuse_horizontal_rad)  # -> out, sky_mtx; plug-in component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
incidentradiation = LBIncidentRadiation(sky_mtx=skymatrix.sky_mtx, geometry=flatten(brep), context=flatten(context), grid_size=number_slider, run=run_rad_sim)  # -> out, points, results, total, mesh, legend, title, int_mtx; plug-in component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

panel_10 = Panel(incidentradiation.out)
number_slider_4 = Slider(1, range=0..10)
r_per_in = Slider(4, range=0..10)
multiplication_2 = Multiplication(A=r_per_in, InsulationThickness=Slider(1, range=0..1))
division = Division(A=multiplication_2, B=5.67826)
opaquematnomass = HBOpaqueMaterialNoMass(name="AirGap", r_value=Slider(1, range=0..1))  # -> flatten(mat); plug-in component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
opaquematnomass_2 = HBOpaqueMaterialNoMass(name="ContExtInsulation", r_value=division)  # -> mat; plug-in component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
opaquemat = HBOpaqueMaterial(
    name="2x6 wall framing",
    thickness=Slider(0.0889, range=0..0.1),
    conductivity=Slider(0.041, range=0..0.1),
    density=Slider(141.25, range=0..1000),
    spec_heat=Slider(2300, range=0..10000))  # -> mat; plug-in component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
opaquemat_2 = HBOpaqueMaterial(
    name="Gypsum Board",
    thickness=Slider(0.5, range=0..1),
    conductivity=Slider(0.16, range=0..1),
    density=Slider(800, range=0..1000),
    spec_heat=Slider(109, range=0..1000))  # -> mat; plug-in component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
opaquemat_3 = HBOpaqueMaterial(
    name="Wood Exterior Cladding",
    thickness=Slider(0.0191, range=0..0.1),
    conductivity=Slider(0.116, range=0..1),
    density=Slider(540, range=0..1000),
    spec_heat=Slider(1210, range=0..10000))  # -> flatten(mat); plug-in component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
constructiontypes = HBConstructionTypes({"SteelFramed", "WoodFramed", "Mass", "Metal Building"}, selected="WoodFramed")
clean = CleanTree(
    RemoveNulls=True,
    RemoveInvalid=True,
    RemoveEmpty=False,
    Tree=flatten([opaquemat_3, opaquematnomass, opaquematnomass_2, opaquemat, opaquemat_2]))
opaqueconstr = HBOpaqueConstruction(name="ExteriorWall", materials=flatten(clean))  # -> constr; plug-in component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
applyconstrset = HBApplyConstructionSet(constr_set=constructiontypes)  # -> rooms; plug-in component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
panel_11 = Panel(clean)
exteriorsubset = HBExteriorConstructionSubset(exterior_wall=opaqueconstr)  # -> exterior_set; plug-in component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
decnstrconstr = HBDeconstructConstruction(constr=opaqueconstr)  # -> materials, layers, r_val_si, r_val_ip, u_fac_si, u_fac_ip, t_sol, t_vis; plug-in component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
one_over_x = OneOverX(Value=decnstrconstr.u_fac_ip)

# ----
# Construction Options
interior_finish = ValueList({"Gyp", "None"}, selected="None")
ext_insulation = ValueList({"EPS", "Polyiso", "Rockwool"}, selected="EPS")
facade_cladding = ValueList({"Brick", "Fiber Cement", "Metal Panel": "Steel Panel"}, selected="Metal Panel")
exterior_wall_framing = ValueList({"CLT", "Concrete", "2x4 Wood Studs", "2x6 Wood Studs", "2x8 Wood Studs", "2x10 Wood Studs", "2x12 Wood Studs"}, selected="Concrete")
wall_r_value = Panel(one_over_x)

constructionset = HBConstructionSet(name="CustomConstructionSet", exterior_subset=exteriorsubset)  # -> constr_set; plug-in component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

# ----
# Sun Path & Shading Mask
number_slider_5 = Slider(3, range=1..12)  # disabled
number_slider_6 = Slider(12, range=1..24)  # disabled
number_slider_7 = Slider(21, range=1..31)  # disabled
join_4 = JoinCurves(Curves=[outsidecrvfromrhino_2, outsidecrvfromrhino_4, outsidecrvfromrhino_3, outsidecrvfromrhino], Preserve=False)  # disabled
importloc_2 = LBImportLocation(epw_file=cities.weather_file)  # -> location; disabled; plug-in component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
hoy_2 = LBCalculateHOY(month=number_slider_5, day=number_slider_7, hour=number_slider_6)  # -> flatten(hoy), flatten(doy), flatten(date); disabled; plug-in component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
area_4 = Area(Geometry=join_4)  # -> Area, Centroid; disabled
sunpath_2 = LBSunPath(location=importloc_2, hoys=hoy_2.hoy, center_pt=area_4.Centroid, scale=1)  # -> report, vectors, altitudes, azimuths, hoys, sun_pts, analemma, daily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; disabled; plug-in component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
symask = LBSkyMask(context=data, center=area_4.Centroid)  # -> report, context_mask, orient_mask, strategy_mask, sky_mask, context_view, orient_view, strategy_view, sky_view; disabled; plug-in component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

# ----
# Chart Results
panel_12 = Panel("""Cooling
Heating
Lighting
Equipment
Hot Water
People Gain
Solar Gain
Total Energy""")
data_2 = Data(panel_12)
pick_sql_file = GhPythonScript(i=Slider(0, range=0..10))  # -> out, filepath; inputs i: Int32
# ---------- pick_sql_file: Python ----------
__author__ = "tmendeze"


import studio2021
import os


files = []
for f in os.listdir(os.path.join(studio2021.TEMP)):
    if f.endswith('.csv'):
        files.append(f)
        
file = files[i]

folder = os.path.splitext(file)[0]
filepath =os.path.join(studio2021.TEMP, folder)
filepath = os.path.join(filepath, 'OpenStudio')
filepath = os.path.join(filepath, 'run')
filepath = os.path.join(filepath, 'eplusout.sql')
print(file)
# ---------- end pick_sql_file ----------
list_4 = ItemSelector(
    data_2,
    {"Cooling", "Heating", "Lighting", "Equipment", "Hot Water", "People Gain", "Solar Gain", "Total Energy"}, selected="Heating")
cluster = Cluster(sql=pick_sql_file.filepath)  # -> data_11, data_9, data_12, data_13, data_16, data_14, data_15, data_10
cluster_2 = Cluster_2(
    D=list_4,
    S=panel_12,
    _0=cluster.data_11,
    _1=cluster.data_9,
    _2=cluster.data_12,
    _3=cluster.data_13,
    _4=cluster.data_16,
    _5=cluster.data_14,
    _6=cluster.data_15,
    _7=cluster.data_10)  # -> E, s_1
vec = VectorXYZ(XComponent=Slider(472, range=0..1000), YComponent=0, ZComponent=0)  # -> Vector, Length
legendpar = LBLegendParameters(min=0, max=cluster_2.E)  # -> leg_par; plug-in component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
move = Move(Geometry=area_4.Centroid, Motion=vec.Vector)  # -> Geometry, Transform
# CHECK FILE!
hourlyplot = LBHourlyPlot(data=flatten(cluster_2.s_1), base_pt=move.Geometry, legend_par=legendpar)  # -> report, mesh, legend, borders, labels, title; plug-in component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

make_sure_this_is_the_right_file = Panel(pick_sql_file.out)

# ----
# Glazing
north_wwr = Slider(0.5, range=0..0.95)
north_horizontal_shade_depth_in = Slider(0, range=0..100)
north_e_vertical_shade_depth_in = Slider(0, range=0..100)
south_w_vertical_shade_depth_in = Slider(0, range=0..100)
east_wwr = Slider(0.5, range=0..0.95)
east_n_vertical_shade_depth_in = Slider(0, range=0..100)
east_s_vertical_shade_depth_in = Slider(0, range=0..100)
west_wwr = Slider(0.5, range=0..0.95)
west_shade_horizontal_depth_in = Slider(0, range=0..100)
west_s_vertical_shade_depth_in = Slider(0, range=0..100)
north_w_vertical_shade_depth_in = Slider(0, range=0..100)
south_wwr = Slider(0.5, range=0..0.95)
south_horizontal_shade_depth_in = Slider(0, range=0..100)
south_e_vertical_shade_depth_in = Slider(0, range=0..100)
east_shade_horizontal_depth_in = Slider(0, range=0..100)
west_n_vertical_shade_depth_in = Slider(0, range=0..100)
glazing = ValueList({"Aluminum Double", "Aluminum Triple", "Wood Double", "Wood Triple"}, selected="Wood Double")
north_shgc = ValueList({"Low SHGC": 0.25, "High SHGC": 0.60}, selected="Low SHGC")
south_shgc = ValueList({"Low SHGC": 0.25, "High SHGC": 0.60}, selected="Low SHGC")
east_shgc = ValueList({"Low SHGC": 0.25, "High SHGC": 0.60}, selected="Low SHGC")
west_shgc = ValueList({"Low SHGC": 0.25, "High SHGC": 0.60}, selected="Low SHGC")

# ----
# Set Zone Program
bldgprograms = HBBuildingPrograms({"LargeOffice", "MediumOffice", "SmallOffice", "MidriseApartment", "HighriseApartment", "Retail", "StripMall", "PrimarySchool", "SecondarySchool", "SmallHotel", "LargeHotel", "Hospital", "Outpatient", "Laboratory", "Warehouse", "SuperMarket", "FullServiceRestaurant", "QuickServiceRestaurant", "Courthouse", "LargeDataCenterHighITE", "LargeDataCenterLowITE", "SmallDataCenterHighITE", "SmallDataCenterLowITE"}, selected="Retail")

searchprog = HBSearchPrograms(bldg_prog=bldgprograms)  # -> room_prog; plug-in component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

list_5 = ItemSelector(
    searchprog,
    {"2013::Retail::Back_Space", "2013::Retail::Core_Retail", "2013::Retail::Entry", "2013::Retail::Front_Retail", "2013::Retail::Point_of_Sale", "2013::Retail::Retail"}, selected="2013::Retail::Back_Space")

black_box = BlackBox(
    city=cities.city,
    _0_0_2="1_zonename",
    _0_1_2="2_zonename",
    _0_2_2="3_zonename",
    _0_3_2="4_zonename",
    _0_0="clever_name",
    _0_1=height_ft,
    _0_4_2="5_zonename",
    _0_2=outsidecrvfromrhino_2,
    _0_3=adiabaticcrvfromrhino_4,
    _0_4=outsidecrvfromrhino_4,
    _0_5=adiabaticcrvfromrhino,
    _0_6=outsidecrvfromrhino_3,
    _0_7=adiabaticcrvfromrhino_2,
    _0_8=outsidecrvfromrhino,
    interior_insul_mat=int_insulation,
    _0_9=adiabaticcrvfromrhino_3,
    _0_10=adiabaticcrvfromrhino_5,
    _0_11=list_2,
    glazing_system=glazing,
    _0_12=list_3,
    simulation_name=time_stamp.name,
    _0_13=north_wwr,
    weather_file=cities.weather_file,
    _0_14=south_wwr,
    csv=panel_7,
    _0_15=east_wwr,
    sql_path=panel_6,
    _0_16=west_wwr,
    simulation_folder=path.path,
    _0_17=north_horizontal_shade_depth_in,
    run_simulation=run_energy_simulation,
    _0_18=south_horizontal_shade_depth_in,
    _0_19=east_shade_horizontal_depth_in,
    _0_20=west_shade_horizontal_depth_in,
    _0_21=north_w_vertical_shade_depth_in,
    _0_22=south_e_vertical_shade_depth_in,
    _0_23=east_n_vertical_shade_depth_in,
    _0_24=west_n_vertical_shade_depth_in,
    _0_25=north_e_vertical_shade_depth_in,
    _0_26=south_w_vertical_shade_depth_in,
    _0_27=east_s_vertical_shade_depth_in,
    kgco2e_kwh=cities.kgCo2e_kwh,
    _0_28=west_s_vertical_shade_depth_in,
    _0_29=north_shgc,
    _0_30=south_shgc,
    context=data,
    _0_31=east_shgc,
    _0_32=west_shgc,
    _0_33=list_5,
    _0_34=facade_cladding,
    _0_35=ext_insulation,
    _0_36=ext_insulation_thickness_in,
    _0_37=exterior_wall_framing,
    _0_38=interior_finish)  # -> out, building_2

trees_from_building = GhPythonScript(building=black_box.building_2)  # -> out, zones, facade_area_n, facade_area_s, facade_area_e, facade_area_w, window_areas_n, window_areas_s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
# ---------- trees_from_building: Python ----------
import rhinoscriptsyntax as rs
import ghpythonlib.treehelpers as th

data = building.to_gh_data()

zones                   = data['zones']
facade_area_n           = data['facade_areas']['n']
facade_area_s           = data['facade_areas']['s']
facade_area_e           = data['facade_areas']['e']
facade_area_w           = data['facade_areas']['w']
exterior_walls_n        = data['exterior_walls']['n']
exterior_walls_s        = data['exterior_walls']['s']
exterior_walls_e        = data['exterior_walls']['e']
exterior_walls_w        = data['exterior_walls']['w']
adiabatic_walls         = data['adiabatic_walls']
floor_surfaces          = data['floor_surfaces']
ceiling_surfaces        = data['ceiling_surfaces']
window_areas_n          = data['window_areas']['n']
window_areas_s          = data['window_areas']['s']
window_areas_e          = data['window_areas']['e']
window_areas_w          = data['window_areas']['w']
opaque_areas_n          = data['opaque_areas']['n']
opaque_areas_s          = data['opaque_areas']['s']
opaque_areas_e          = data['opaque_areas']['e']
opaque_areas_w          = data['opaque_areas']['w']
shade_gc                = data['shade_gc']
shade_depth_h           = data['shade_depth_h']
shade_depth_v1          = data['shade_depth_v1']
shade_depth_v2          = data['shade_depth_v2']
facade_cladding         = data['facade_cladding']
facade_cladding         = data['facade_cladding']
external_insulation     = data['external_insulation'] 
insulation_thickness    = data['insulation_thickness']
ewall_framing           = data['ewall_framing']
int_finish              = data['int_finish']
glazing_system          = data['glazing_system']
simulation_name         = data['simulation_name']
zone_program            = data['zone_program']
weather_file            = data['weather_file']
sql_path                = data['sql_path']
simulation_folder       = data['simulation_folder']
run_simulation          = data['run_simulation']
wwr                     = data['wwr'] 
ceiling_condition       = data['ceiling_condition']
floor_condition         = data['floor_condition']
height                  = data['height']
interior_insul_mat      = data['interior_insul_mat']
int_ins_thick           = data['int_ins_thick']
context                 = data['context']
# ---------- end trees_from_building ----------
clean_2 = CleanTree(RemoveNulls=True, RemoveInvalid=True, RemoveEmpty=True, Tree=trees_from_building.exterior_walls_n)
clean_3 = CleanTree(RemoveNulls=True, RemoveInvalid=True, RemoveEmpty=True, Tree=trees_from_building.exterior_walls_s)
clean_4 = CleanTree(RemoveNulls=True, RemoveInvalid=True, RemoveEmpty=True, Tree=trees_from_building.exterior_walls_e)
clean_5 = CleanTree(RemoveNulls=True, RemoveInvalid=True, RemoveEmpty=True, Tree=trees_from_building.exterior_walls_w)
subtraction = Subtraction(A=trees_from_building.height, B=Slider(2, range=0..10))  # -> flatten(Result)

# ---- group: Create Faces
face = HBFace(geo=trees_from_building.ceiling_surfaces, name="RoofCeiling", type="RoofCeiling", bc="Outdoors")  # -> report, faces; plug-in component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
face_2 = HBFace(geo=trees_from_building.floor_surfaces, name="Floor", type="Floor", bc="Ground")  # -> report, faces; plug-in component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
face_3 = HBFace(geo=trees_from_building.adiabatic_walls, name="Adiabatic Wall", type="AirBoundary", bc="Adiabatic")  # -> report, faces; plug-in component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
match = MatchTree(Tree=face_2.faces, Guide=trees_from_building.floor_surfaces)
match_2 = MatchTree(Tree=face_3.faces, Guide=trees_from_building.adiabatic_walls)
match_3 = MatchTree(Tree=face.faces, Guide=match)

# ---- group: Create Room
clean_6 = CleanTree(RemoveNulls=True, RemoveInvalid=True, RemoveEmpty=True, Tree=[match_2, match, match_3])
tstat = TreeStatistics(Tree=clean_6)  # -> Paths, Length, Count
zone_names = TreeBranch(Tree=simplify(trees_from_building.zones), Path=tstat.Paths, MaintainPaths=True)
room = HBRoom(faces=clean_6, name=zone_names, program=trees_from_building.zone_program, conditioned=True)  # -> report, room; plug-in component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

# ----
item_11 = ListItem(List=trees_from_building.shade_gc, Index=0, Wrap=True)
item_12 = ListItem(List=trees_from_building.shade_depth_h, Index=0, Wrap=True)
item_13 = ListItem(List=trees_from_building.wwr, Index=0, Wrap=True)
item_14 = ListItem(List=trees_from_building.shade_depth_v1, Index=0, Wrap=True)
item_15 = ListItem(List=trees_from_building.shade_depth_v2, Index=0, Wrap=True)
vertical_depth_n_s_e_w = ExplodeTree(Data=item_14)  # -> Branch0, Branch1, Branch2, Branch3
flip_vertical_n_s_e_w = ExplodeTree(Data=item_15)  # -> Branch0, Branch1, Branch2, Branch3
larger = LargerThan(FirstNumber=vertical_depth_n_s_e_w.Branch1, SecondNumber=0)  # -> LargerThan, OrEqualTo
larger_2 = LargerThan(FirstNumber=vertical_depth_n_s_e_w.Branch2, SecondNumber=0)  # -> LargerThan, OrEqualTo
larger_3 = LargerThan(FirstNumber=vertical_depth_n_s_e_w.Branch0, SecondNumber=0)  # -> LargerThan, OrEqualTo
larger_4 = LargerThan(FirstNumber=vertical_depth_n_s_e_w.Branch3, SecondNumber=0)  # -> LargerThan, OrEqualTo
larger_5 = LargerThan(FirstNumber=flip_vertical_n_s_e_w.Branch0, SecondNumber=0)  # -> LargerThan, OrEqualTo
larger_6 = LargerThan(FirstNumber=flip_vertical_n_s_e_w.Branch1, SecondNumber=0)  # -> LargerThan, OrEqualTo
larger_7 = LargerThan(FirstNumber=flip_vertical_n_s_e_w.Branch2, SecondNumber=0)  # -> LargerThan, OrEqualTo
larger_8 = LargerThan(FirstNumber=flip_vertical_n_s_e_w.Branch3, SecondNumber=0)  # -> LargerThan, OrEqualTo

# ---- group: Apply Con Set
clean_7 = CleanTree(RemoveNulls=True, RemoveInvalid=True, RemoveEmpty=False, Tree=room.room)  # -> flatten(Tree)
applyconstrset_2 = HBApplyConstructionSet(rooms=clean_7, constr_set=constructionset)  # -> rooms; plug-in component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

# ----
roomattr = HBRoomAttributes({"Display Name": "display_name", "Simulation Name (Identifier)": "identifier", "Multiplier": "multiplier", "Story": "story", "Volume": "volume", "Gross Floor Area": "floor_area", "Exposed Area": "exposed_area", "Exterior Wall Area": "exterior_wall_area", "Exterior Aperture Area": "exterior_aperture_area", "Average Floor Elevation": "average_floor_height"}, selected="Simulation Name (Identifier)")
panel_13 = Panel("""  Daylighting:Controls,
  Test,     		   !- Name
  Zone_Name,               !- Zone Name
  SplitFlux,               !- Daylighting Method
  ,                        !- Availability Schedule Name
  Continuous,              !- Lighting Control Type
  0.3,                     !- Minimum Input Power Fraction for Continuous or ContinuousOff Dimming Control
  0.2,                     !- Minimum Light Output Fraction for Continuous or ContinuousOff Dimming Control
  ,                        !- Number of Stepped Control Steps
  1.0,                     !- Probability Lighting will be Reset When Needed in Manual Stepped Control
  DaylRefPt1,              !- Glare Calculation Daylighting Reference Point Name
  180.0,                   !- Glare Calculation Azimuth Angle of View Direction Clockwise from Zone y-Axis {deg}
  20.0,                    !- Maximum Allowable Discomfort Glare Index
  ,                        !- DElight Gridding Resolution {m2}
  DaylRefPt1,              !- Daylighting Reference Point 1 Name
  1.0,                     !- Fraction of Zone Controlled by Reference Point 1
  500.;                    !- Illuminance Setpoint at Reference Point 1 {lux}""")
area_5 = Area(Geometry=trees_from_building.floor_surfaces)  # -> Area, Centroid
labelrooms = HBLabelRooms(rooms_model=flatten(applyconstrset_2), attribute=roomattr)  # -> graft(label_text), base_pts, labels, wire_frame; plug-in component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
move_2 = Move(Geometry=area_5.Centroid, Motion="{0,0,3}")  # -> Geometry, Transform
pdecon_3 = Deconstruct(Point=move_2.Geometry)  # -> XComponent, YComponent, ZComponent
lng = ListLength(List=flatten(labelrooms.label_text))
clean_8 = CleanTree(RemoveNulls=True, RemoveInvalid=True, RemoveEmpty=True, Tree=pdecon_3.XComponent)
clean_9 = CleanTree(RemoveNulls=True, RemoveInvalid=True, RemoveEmpty=True, Tree=pdecon_3.ZComponent)
panel_14 = Panel("""  Daylighting:ReferencePoint,
  DaylRefPt1,              !- Name
  Zone_Name,               !- Zone Name
  point1_x,                !- X-Coordinate of Reference Point {m}
  point1_y,                !- Y-Coordinate of Reference Point {m}
  point1_z;                !- Z-Coordinate of Reference Point {m}""")
panel_15 = Panel(lng)
clean_10 = CleanTree(RemoveNulls=True, RemoveInvalid=True, RemoveEmpty=True, Tree=pdecon_3.YComponent)
panel_16 = Panel("""Run1
Run2
Run3
Run4
Run5""")
split = SplitList(List=panel_16, Index=panel_15)  # -> ListA, ListB
panel_17 = Panel("""Point1
Point2
Point3
Point4
Point5""")
rep = ReplaceText(Text=panel_13, Find="Zone_Name", Replace=simplify(labelrooms.label_text), RecursiveReplace=False)
rep_2 = ReplaceText(Text=rep, Find="Test", Replace=graft(split.ListA), RecursiveReplace=False)
split_2 = SplitList(List=panel_17, Index=panel_15)  # -> ListA, ListB
rep_3 = ReplaceText(Text=panel_14, Find="Zone_Name", Replace=simplify(labelrooms.label_text), RecursiveReplace=False)
rep_4 = ReplaceText(Text=rep_2, Find="DaylRefPt1", Replace=graft(split_2.ListA), RecursiveReplace=False)  # -> flatten(Result)
rep_5 = ReplaceText(Text=rep_3, Find="DaylRefPt1", Replace=graft(split_2.ListA), RecursiveReplace=False)
rep_6 = ReplaceText(Text=rep_5, Find="point1_x", Replace=clean_8, RecursiveReplace=False)
rep_7 = ReplaceText(Text=rep_6, Find="point1_y", Replace=clean_10, RecursiveReplace=False)
rep_8 = ReplaceText(Text=rep_7, Find="point1_z", Replace=clean_9, RecursiveReplace=False)  # -> flatten(Result)
join_5 = TextJoin(Text=rep_4)
join_6 = TextJoin(Text=rep_8)
join_7 = TextJoin(Text=[join_5, join_6])

shade = HBShade(geo=trees_from_building.context)  # -> report, shades; plug-in component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
model = HBModel(rooms=flatten(applyconstrset_2), name=trees_from_building.simulation_name)  # -> report, model; plug-in component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
panel_18 = Panel(trees_from_building.out)

importglazing = GhPythonScript(glazing_name=trees_from_building.glazing_system)  # -> flatten(frame_type), glass_type, flatten(u_value), flatten(t_vis), embodied_carbon_metric, embodied_carbon_imperial
# ---------- importglazing: Python ----------
__author__ = "preston"

import rhinoscriptsyntax as rs
import sys

studiopath = "/Users/preston/Documents/GitHub/studio2021/src"
sys.path.append(studiopath)
import studio2021

from studio2021.functions import read_glazing

glazing = read_glazing(glazing_name)

print(glazing.keys())

frame_type = glazing['frame_type']
glass_type = glazing['glass_type']
u_value = glazing['u_value']
t_vis = glazing['t_vis']
embodied_carbon_metric = glazing['embodied_carbon_metric']
embodied_carbon_imperial = glazing['embodied_carbon_imperial']
# ---------- end importglazing ----------
shgc_n_s_e_w = ExplodeTree(Data=item_11)  # -> Branch0, Branch1, Branch2, Branch3
wwr_n_s_e_w = ExplodeTree(Data=item_13)  # -> Branch0, Branch1, Branch2, Branch3
shade_depth_n_s_e_w = ExplodeTree(Data=item_12)  # -> Branch0, Branch1, Branch2, Branch3

item_16 = ListItem(List=importglazing.u_value, Index=0, Wrap=True)

window_uvalue = Panel(item_16)

item_17 = ListItem(List=importglazing.t_vis, Index=0, Wrap=True)
item_18 = ListItem(List=importglazing.frame_type, Index=0, Wrap=True)
multiplication_3 = Multiplication(A=item_16, B=Slider(5.678, range=0..10))
r_value_of_wall_construction_2 = Panel(multiplication_3)
larger_9 = LargerThan(FirstNumber=shade_depth_n_s_e_w.Branch1, SecondNumber=0)  # -> LargerThan, OrEqualTo
larger_10 = LargerThan(FirstNumber=shade_depth_n_s_e_w.Branch3, SecondNumber=0)  # -> LargerThan, OrEqualTo
larger_11 = LargerThan(FirstNumber=shade_depth_n_s_e_w.Branch2, SecondNumber=0)  # -> LargerThan, OrEqualTo
larger_12 = LargerThan(FirstNumber=shade_depth_n_s_e_w.Branch0, SecondNumber=0)  # -> LargerThan, OrEqualTo

face_4 = HBFace(geo=clean_5, name="Exposed Wall", type="Wall", bc="Outdoors")  # -> report, simplify(faces); plug-in component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
windowmat = HBWindowMaterial(name=item_18, u_factor=flatten(multiplication_3), shgc=flatten(shgc_n_s_e_w.Branch3), t_vis=flatten(item_17))  # -> mat; plug-in component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
windowconstr = HBWindowConstruction(name="WGlass", materials=flatten(windowmat))  # -> constr; plug-in component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

match_4 = MatchTree(Tree=face_4.faces, Guide=clean_5)

aperturesbyratio = HBAperturesByRatio(hb_objs=match_4, ratio=flatten(wwr_n_s_e_w.Branch3), win_height=subtraction, sill_height=number_slider_4)  # -> report, hb_objs; plug-in component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
applywindowconstr = HBApplyWindowConstruction(hb_objs=aperturesbyratio.hb_objs, constr=windowconstr)  # -> hb_objs; plug-in component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
louvershades = HBLouverShades(hb_objs=applywindowconstr, depth=flatten(shade_depth_n_s_e_w.Branch3), vertical=False)  # -> report, hb_objs; plug-in component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

filter = StreamFilter(Gate=larger_10.LargerThan, Stream0=applywindowconstr, Stream1=louvershades.hb_objs)
louvershades_2 = HBLouverShades(hb_objs=filter, depth=flatten(vertical_depth_n_s_e_w.Branch3), vertical=True)  # -> report, hb_objs; plug-in component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
filter_2 = StreamFilter(Gate=larger_4.LargerThan, Stream0=filter, Stream1=louvershades_2.hb_objs)
louvershades_3 = HBLouverShades(hb_objs=filter_2, depth=flatten(flip_vertical_n_s_e_w.Branch3), vertical=True, flip_start=True)  # -> report, hb_objs; plug-in component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
filter_3 = StreamFilter(Gate=larger_8.LargerThan, Stream0=filter_2, Stream1=louvershades_3.hb_objs)

face_5 = HBFace(geo=clean_4, name="Exposed Wall", type="Wall", bc="Outdoors")  # -> report, simplify(faces); plug-in component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
windowmat_2 = HBWindowMaterial(name=item_18, u_factor=flatten(multiplication_3), shgc=flatten(shgc_n_s_e_w.Branch2), t_vis=flatten(item_17))  # -> mat; plug-in component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
windowconstr_2 = HBWindowConstruction(name="EGlass", materials=flatten(windowmat_2))  # -> constr; plug-in component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

match_5 = MatchTree(Tree=face_5.faces, Guide=clean_4)

aperturesbyratio_2 = HBAperturesByRatio(hb_objs=match_5, ratio=flatten(wwr_n_s_e_w.Branch2), win_height=subtraction, sill_height=number_slider_4)  # -> report, hb_objs; plug-in component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
applywindowconstr_2 = HBApplyWindowConstruction(hb_objs=aperturesbyratio_2.hb_objs, constr=windowconstr_2)  # -> hb_objs; plug-in component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
louvershades_4 = HBLouverShades(hb_objs=applywindowconstr_2, depth=flatten(shade_depth_n_s_e_w.Branch2), vertical=False)  # -> report, hb_objs; plug-in component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

filter_4 = StreamFilter(Gate=larger_11.LargerThan, Stream0=applywindowconstr_2, Stream1=louvershades_4.hb_objs)
louvershades_5 = HBLouverShades(hb_objs=filter_4, depth=flatten(vertical_depth_n_s_e_w.Branch2), vertical=True)  # -> report, hb_objs; plug-in component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
filter_5 = StreamFilter(Gate=larger_2.LargerThan, Stream0=filter_4, Stream1=louvershades_5.hb_objs)
louvershades_6 = HBLouverShades(hb_objs=filter_5, depth=flatten(flip_vertical_n_s_e_w.Branch2), vertical=True, flip_start=True)  # -> report, hb_objs; plug-in component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
filter_6 = StreamFilter(Gate=larger_7.LargerThan, Stream0=filter_5, Stream1=louvershades_6.hb_objs)

face_6 = HBFace(geo=clean_2, name="Exposed Wall", type="Wall", bc="Outdoors")  # -> report, simplify(faces); plug-in component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
windowmat_3 = HBWindowMaterial(name=item_18, u_factor=flatten(multiplication_3), shgc=flatten(shgc_n_s_e_w.Branch0), t_vis=flatten(item_17))  # -> mat; plug-in component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
windowconstr_3 = HBWindowConstruction(name="NGlass", materials=flatten(windowmat_3))  # -> constr; plug-in component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

match_6 = MatchTree(Tree=face_6.faces, Guide=clean_2)

aperturesbyratio_3 = HBAperturesByRatio(hb_objs=match_6, ratio=flatten(wwr_n_s_e_w.Branch0), win_height=subtraction, sill_height=number_slider_4)  # -> report, hb_objs; plug-in component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
applywindowconstr_3 = HBApplyWindowConstruction(hb_objs=aperturesbyratio_3.hb_objs, constr=windowconstr_3)  # -> hb_objs; plug-in component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
louvershades_7 = HBLouverShades(hb_objs=applywindowconstr_3, depth=flatten(shade_depth_n_s_e_w.Branch0))  # -> report, hb_objs; plug-in component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

filter_7 = StreamFilter(Gate=larger_12.LargerThan, Stream0=applywindowconstr_3, Stream1=louvershades_7.hb_objs)
louvershades_8 = HBLouverShades(hb_objs=filter_7, depth=flatten(vertical_depth_n_s_e_w.Branch0), vertical=True)  # -> report, hb_objs; plug-in component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
filter_8 = StreamFilter(Gate=larger_3.LargerThan, Stream0=filter_7, Stream1=louvershades_8.hb_objs)
decnstrconstr_2 = HBDeconstructConstruction(constr=windowconstr_3)  # -> materials, layers, r_val_si, r_val_ip, u_fac_si, u_fac_ip, t_sol, t_vis; plug-in component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
louvershades_9 = HBLouverShades(hb_objs=filter_8, depth=flatten(flip_vertical_n_s_e_w.Branch0), vertical=True, flip_start=True)  # -> report, hb_objs; plug-in component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
filter_9 = StreamFilter(Gate=larger_5.LargerThan, Stream0=filter_8, Stream1=louvershades_9.hb_objs)

face_7 = HBFace(geo=clean_3, name="Exposed Wall", type="Wall", bc="Outdoors")  # -> report, simplify(faces); plug-in component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
windowmat_4 = HBWindowMaterial(name=item_18, u_factor=flatten(multiplication_3), shgc=flatten(shgc_n_s_e_w.Branch1), t_vis=flatten(item_17))  # -> mat; plug-in component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
windowconstr_4 = HBWindowConstruction(name="SGlass", materials=flatten(windowmat_4))  # -> constr; plug-in component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

match_7 = MatchTree(Tree=face_7.faces, Guide=clean_3)

aperturesbyratio_4 = HBAperturesByRatio(hb_objs=match_7, ratio=flatten(wwr_n_s_e_w.Branch1), win_height=subtraction, sill_height=number_slider_4)  # -> report, hb_objs; plug-in component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
applywindowconstr_4 = HBApplyWindowConstruction(hb_objs=aperturesbyratio_4.hb_objs, constr=windowconstr_4)  # -> hb_objs; plug-in component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
louvershades_10 = HBLouverShades(hb_objs=applywindowconstr_4, depth=flatten(shade_depth_n_s_e_w.Branch1))  # -> report, hb_objs; plug-in component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

filter_10 = StreamFilter(Gate=larger_9.LargerThan, Stream0=applywindowconstr_4, Stream1=louvershades_10.hb_objs)
louvershades_11 = HBLouverShades(hb_objs=filter_10, depth=flatten(vertical_depth_n_s_e_w.Branch1), vertical=True)  # -> report, hb_objs; plug-in component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
filter_11 = StreamFilter(Gate=larger.LargerThan, Stream0=filter_10, Stream1=louvershades_11.hb_objs)
louvershades_12 = HBLouverShades(hb_objs=filter_11, depth=flatten(flip_vertical_n_s_e_w.Branch1), vertical=True, flip_start=True)  # -> report, hb_objs; plug-in component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
filter_12 = StreamFilter(Gate=larger_6.LargerThan, Stream0=filter_11, Stream1=louvershades_12.hb_objs)

n_s_e_w_exterior_walls = Merge(Data1=filter_9, Data2=filter_12, Data3=filter_6, Data4=filter_3)
remove_empy_zones = CleanTree(RemoveNulls=True, RemoveInvalid=True, RemoveEmpty=True, Tree=n_s_e_w_exterior_walls)

# ----
# Energy Simulation
toggle = BooleanToggle(True)
simoutput = HBSimulationOutput(zone_energy_use=toggle, gains_and_losses=toggle)  # -> report, sim_output; plug-in component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
simpar = HBSimulationParameter(output=simoutput.sim_output, timestep=6)  # -> sim_par; plug-in component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
model_2 = HBModel(rooms=flatten(applyconstrset_2), shades=flatten(shade.shades), name=trees_from_building.simulation_name)  # -> report, model; plug-in component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

null = NullItem(Item=model_2.model)  # -> NullFlags, InvalidFlags, Description
filter_13 = StreamFilter(Gate=null.InvalidFlags, Stream0=model_2.model, Stream1=model.model)

modeltoosm = HBModelToOSM(
    model=filter_13,
    epw_file=trees_from_building.weather_file,
    sim_par=simpar,
    folder=trees_from_building.simulation_folder,
    write=trees_from_building.run_simulation,
    run=trees_from_building.run_simulation)  # -> report, jsons, osw, osm, idf, sql, zsz, rdd, html; plug-in component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
roomenergyresult = HBReadRoomEnergyResult(sql=modeltoosm.sql)  # -> cooling, heating, lighting, electric_equip, gas_equip, hot_water, fan_electric, pump_electric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; plug-in component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

add_euis = GhPythonScript(
    building=trees_from_building.building,
    cooling=roomenergyresult.cooling,
    heating=roomenergyresult.heating,
    lighting=roomenergyresult.lighting,
    equipment=roomenergyresult.electric_equip,
    hot_water=roomenergyresult.hot_water,
    wall_r=one_over_x,
    window_u=decnstrconstr_2.u_fac_ip)  # -> out, building; inputs cooling: list, heating: list, lighting: list, equipment: list, hot_water: list
# ---------- add_euis: Python ----------
__author__ = "tmendeze"

building.add_eui_results(cooling,
                         heating,
                         lighting,
                         equipment,
                         hot_water,
                         wall_r,
                         window_u)
# ---------- end add_euis ----------
panel_19 = Panel(roomenergyresult.hot_water)
panel_20 = Panel(add_euis.out)

# ----
# Label Rooms
faceenergyattr = HBFaceEnergyAttributes({"Construction": "properties.energy.construction.display_name", "Materials": "properties.energy.construction.layers", "R-Value": "properties.energy.construction.r_value", "U-Value": "properties.energy.construction.u_value", "U-Factor": "properties.energy.construction.u_factor", "Solar Transmitance [Unshaded]": "properties.energy.construction.solar_transmittance", "Solar Reflectance [Outside]": "properties.energy.construction.outside_solar_reflectance", "Solar Reflectance [Inside]": "properties.energy.construction.inside_solar_reflectance", "Fraction Area Operable": "properties.energy.vent_opening.fraction_area_operable", "Fraction Height Operable": "properties.energy.vent_opening.fraction_height_operable", "Discharge Coefficient": "properties.energy.vent_opening.discharge_coefficient", "Cross Ventilation": "properties.energy.vent_opening.wind_cross_vent"}, selected="Construction")  # disabled
roomenergyattr = HBRoomEnergyAttributes({"Program": "properties.energy.program_type.display_name", "Construction Set": "properties.energy.construction_set.display_name", "Is Conditioned": "properties.energy.is_conditioned", "People per Area [ppl/m2]": "properties.energy.people.people_per_area", "Area per Person [m2/ppl]": "properties.energy.people.area_per_person", "Lighting per Area [W/m2]": "properties.energy.lighting.watts_per_area", "Electric Equipment per Area [W/m2]": "properties.energy.electric_equipment.watts_per_area", "Gas Equipment per Area [W/m2]": "properties.energy.gas_equipment.watts_per_area", "Infiltration per Exterior Area [m3/s-m2]": "properties.energy.infiltration.flow_per_exterior_area", "Ventilation per Person [m3/s-ppl]": "properties.energy.ventilation.flow_per_person"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}, selected="Ventilation per Person [m3/s-ppl]")  # disabled
allzones = Data(filter_13)  # disabled
labelrooms_2 = HBLabelRooms(rooms_model=flatten(allzones), attribute=roomenergyattr)  # -> label_text, base_pts, labels, wire_frame; disabled; plug-in component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
lablefaces = HBLabelFaces(hb_objs=flatten(allzones), attribute=faceenergyattr)  # -> label_text, base_pts, labels, wire_frame; disabled; plug-in component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

# ----
# View Zones
allzones_2 = Data(filter_13)
vizbytype = HBVisualizeByType(hb_objs=allzones_2)  # -> walls, interior_walls, roofs, ceilings, exterior_floors, interior_floors, air_walls, apertures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; plug-in component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

# ----
# Write To Excel
write_results = GhPythonScript(building=add_euis.building)  # -> out
# ---------- write_results: Python ----------
__author__ = "tmendeze"

building.write_results()
# ---------- end write_results ----------
panel_21 = Panel(write_results)

# ==== cluster BlackBox
_0_0 = ClusterInput()
_0_1 = ClusterInput()
_0_2 = ClusterInput()
_0_3 = ClusterInput()
_0_4 = ClusterInput()
_0_5 = ClusterInput()
_0_6 = ClusterInput()
_0_7 = ClusterInput()
_0_8 = ClusterInput()
_0_9 = ClusterInput()
_0_10 = ClusterInput()
_0_11 = ClusterInput()
_0_12 = ClusterInput()
_0_13 = ClusterInput()
_0_14 = ClusterInput()
_0_15 = ClusterInput()
_0_16 = ClusterInput()
_0_17 = ClusterInput()
_0_18 = ClusterInput()
_0_19 = ClusterInput()
_0_20 = ClusterInput()
_0_21 = ClusterInput()
_0_22 = ClusterInput()
_0_23 = ClusterInput()
_0_24 = ClusterInput()
_0_25 = ClusterInput()
_0_26 = ClusterInput()
_0_27 = ClusterInput()
_0_28 = ClusterInput()
_0_29 = ClusterInput()
_0_30 = ClusterInput()
_0_31 = ClusterInput()
_0_32 = ClusterInput()
_0_33 = ClusterInput()
_0_34 = ClusterInput()
_0_35 = ClusterInput()
_0_36 = ClusterInput()
_0_37 = ClusterInput()
_0_38 = ClusterInput()
gather_all_info_from_scenario = Entwine(
    Branch00=_0_0,
    Branch01=_0_1,
    Branch02=_0_2,
    Branch03=_0_3,
    Branch04=_0_4,
    Branch05=_0_5,
    Branch06=_0_6,
    Branch07=_0_7,
    Branch08=_0_8,
    Branch09=_0_9,
    Branch010=_0_10,
    Branch011=_0_11,
    Branch012=_0_12,
    Branch013=_0_13,
    Branch014=_0_14,
    Branch015=_0_15,
    Branch016=_0_16,
    Branch017=_0_17,
    Branch018=_0_18,
    Branch019=_0_19,
    Branch020=_0_20,
    Branch021=_0_21,
    Branch022=_0_22,
    Branch023=_0_23,
    Branch024=_0_24,
    Branch025=_0_25,
    Branch026=_0_26,
    Branch027=_0_27,
    Branch028=_0_28,
    Branch029=_0_29,
    Branch030=_0_30,
    Branch031=_0_31,
    Branch032=_0_32,
    Branch033=_0_33,
    Branch034=_0_34,
    Branch035=_0_35,
    Branch036=_0_36,
    Branch037=_0_37,
    Branch038=_0_38,
    FlattenInputs=True)  # -> simplify(Result)
filter = StreamFilter(Gate=Toggle(True), Stream1=gather_all_info_from_scenario)
_0_0_2 = ClusterInput()
_0_1_2 = ClusterInput()
_0_2_2 = ClusterInput()
_0_3_2 = ClusterInput()
_0_4_2 = ClusterInput()

merge = Merge(Data2=filter)
bang = ExplodeTree(Data=merge)  # -> Branch0, Branch1, Branch2, Branch3, Branch4, Branch5, Branch6, Branch7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
adiabaticcrv = Entwine(
    Branch00=bang.Branch3,
    Branch01=bang.Branch5,
    Branch02=bang.Branch7,
    Branch03=bang.Branch9,
    Branch04=bang.Branch10,
    FlattenInputs=True)  # -> simplify(Result)
outsidecrv = Entwine(Branch00=bang.Branch2, Branch01=bang.Branch4, Branch02=bang.Branch6, Branch03=bang.Branch8, FlattenInputs=True)  # -> simplify(Result)
zone = Entwine(Branch00=_0_0_2, Branch01=_0_1_2, Branch02=_0_2_2, Branch03=_0_3_2, Branch04=_0_4_2, FlattenInputs=True)  # -> simplify(Result)
vertical_shade_depth_direction_1 = Entwine(Branch00=bang.Branch21, Branch01=bang.Branch22, Branch02=bang.Branch23, Branch03=bang.Branch24, FlattenInputs=True)  # -> simplify(Result)
wwr = Entwine(Branch00=bang.Branch13, Branch01=bang.Branch14, Branch02=bang.Branch15, Branch03=bang.Branch16, FlattenInputs=True)  # -> simplify(Result)
horizontal_shade_depth = Entwine(Branch00=bang.Branch17, Branch01=bang.Branch18, Branch02=bang.Branch19, Branch03=bang.Branch20, FlattenInputs=True)  # -> simplify(Result)
shgc = Entwine(Branch00=bang.Branch29, Branch01=bang.Branch30, Branch02=bang.Branch31, Branch03=bang.Branch32, FlattenInputs=True)  # -> simplify(Result)
vertical_shade_depth_direction_2 = Entwine(Branch00=bang.Branch25, Branch01=bang.Branch26, Branch02=bang.Branch27, Branch03=bang.Branch28, FlattenInputs=True)  # -> simplify(Result)
division = Division(A=horizontal_shade_depth, B=12)
division_2 = Division(A=vertical_shade_depth_direction_1, B=12)
division_3 = Division(A=vertical_shade_depth_direction_2, B=12)

boundary = BoundarySurfaces(FloorCrvs=flatten([outsidecrv, adiabaticcrv]))  # -> simplify(Surfaces)
Z = UnitZ(Factor=bang.Branch1)
extr = Extrude(Base=boundary, Direction=Z)
extr_2 = Extrude(OutsideCrv=outsidecrv, Direction=Z)  # -> simplify(OutsideSrf)
debrep = DeconstructBrep(Brep=extr)  # -> simplify(Faces), Edges, Vertices
area = Area(Geometry=debrep.Faces)  # -> Area, Centroid
brep = Brep(debrep.Faces)
area_2 = Area(Geometry=extr_2)  # -> Area, Centroid
mindex = MemberIndex(Set=area.Centroid, Member=area_2.Centroid)  # -> Index, Count
srf = Surface([brep, extr_2])
join = JoinCurves(Curves=[outsidecrv, adiabaticcrv], Preserve=False)  # -> simplify(Curves)
trim = TrimTree(Tree=mindex.Index, Depth=1)
item = ListItem(List=srf, Index=trim, Wrap=True)
extr_3 = Extrude(AdiabaticCrv=adiabaticcrv, Direction=Z)  # -> simplify(AdiabaticSrf)
move = Move(Geometry=join, Motion=Z)  # -> Geometry, Transform
clean = CleanTree(RemoveNulls=True, RemoveInvalid=True, RemoveEmpty=True, Tree=item)  # -> simplify(Tree)
facen = FaceNormals(Mesh=clean)  # -> Centers, Normals
debrep_2 = DeconstructBrep(Brep=extr_3)  # -> Faces, Edges, Vertices
cullpt = CullDuplicates(Points=facen.Normals, Tolerance=0.1, CullMode=3)  # -> Points, Indices, Valence
join_2 = JoinCurves(Curves=debrep_2.Edges, Preserve=False)
devec = DeconstructVector(Vector=cullpt.Points)  # -> XComponent, YComponent, ZComponent
trim_2 = TrimTree(Tree=join_2, Depth=Slider(2, range=0..10))
larger = LargerThan(FirstNumber=devec.XComponent, SecondNumber="-0.707")  # -> LargerThan, OrEqualTo
smaller = SmallerThan(FirstNumber=devec.YComponent, SecondNumber="-0.707")  # -> SmallerThan, OrEqualTo
larger_2 = LargerThan(FirstNumber=devec.YComponent, SecondNumber="-1")  # -> LargerThan, OrEqualTo
smaller_2 = SmallerThan(FirstNumber=devec.YComponent, SecondNumber="1")  # -> SmallerThan, OrEqualTo
larger_3 = LargerThan(FirstNumber=devec.YComponent, SecondNumber="0.707")  # -> LargerThan, OrEqualTo
smaller_3 = SmallerThan(FirstNumber=devec.XComponent, SecondNumber="1")  # -> SmallerThan, OrEqualTo
smaller_4 = SmallerThan(FirstNumber=devec.XComponent, SecondNumber="0.707")  # -> SmallerThan, OrEqualTo
smaller_5 = SmallerThan(FirstNumber=devec.YComponent, SecondNumber="0.707")  # -> SmallerThan, OrEqualTo
larger_4 = LargerThan(FirstNumber=devec.YComponent, SecondNumber="-0.707")  # -> LargerThan, OrEqualTo
larger_5 = LargerThan(FirstNumber=devec.XComponent, SecondNumber="0.707")  # -> LargerThan, OrEqualTo
larger_6 = LargerThan(FirstNumber=devec.XComponent, SecondNumber="-1")  # -> LargerThan, OrEqualTo
smaller_6 = SmallerThan(FirstNumber=devec.XComponent, SecondNumber="-0.707")  # -> SmallerThan, OrEqualTo
and = GateAnd(A=larger.LargerThan, B=smaller_4.SmallerThan)
and_2 = GateAnd(A=larger_2.OrEqualTo, B=smaller.SmallerThan)
and_3 = GateAnd(A=larger_3.LargerThan, B=smaller_2.OrEqualTo)
and_4 = GateAnd(A=larger_5.LargerThan, B=smaller_3.OrEqualTo)
and_5 = GateAnd(A=larger_4.OrEqualTo, B=smaller_5.SmallerThan)
and_6 = GateAnd(A=larger_6.OrEqualTo, B=smaller_6.SmallerThan)
and_7 = GateAnd(A=and, B=and_3)
and_8 = GateAnd(A=and, B=and_2)
and_9 = GateAnd(A=and_5, B=and_6)
and_10 = GateAnd(A=and_4, B=and_5)
cull = CullPattern(List=graft(clean), CullPattern=and_8)
cull_2 = CullPattern(List=graft(clean), CullPattern=and_9)
cull_3 = CullPattern(List=graft(clean), CullPattern=and_10)
cull_4 = CullPattern(List=graft(clean), CullPattern=and_7)
pshift = ShiftPaths(Data=cull, Offset=-2)
pshift_2 = ShiftPaths(Data=cull_4, Offset=-2)
pshift_3 = ShiftPaths(Data=cull_2, Offset=-2)
pshift_4 = ShiftPaths(Data=cull_3, Offset=-2)
debrep_3 = DeconstructBrep(Brep=pshift_2)  # -> Faces, Edges, Vertices
debrep_4 = DeconstructBrep(Brep=pshift)  # -> Faces, Edges, Vertices
debrep_5 = DeconstructBrep(Brep=pshift_4)  # -> Faces, Edges, Vertices
debrep_6 = DeconstructBrep(Brep=pshift_3)  # -> Faces, Edges, Vertices
join_3 = JoinCurves(Curves=debrep_3.Edges, Preserve=False)
join_4 = JoinCurves(Curves=debrep_4.Edges, Preserve=False)
join_5 = JoinCurves(Curves=debrep_5.Edges, Preserve=False)
join_6 = JoinCurves(Curves=debrep_6.Edges, Preserve=False)
trim_3 = TrimTree(Tree=join_3, Depth=Slider(2, range=0..10))
trim_4 = TrimTree(Tree=join_4, Depth=Slider(2, range=0..10))
trim_5 = TrimTree(Tree=join_5, Depth=Slider(2, range=0..10))
trim_6 = TrimTree(Tree=join_6, Depth=Slider(2, range=0..10))
clean_2 = CleanTree(RemoveNulls=True, RemoveInvalid=True, RemoveEmpty=False, Tree=move.Geometry)
interior_insul_mat = ClusterInput()
building_type = ClusterInput()
num_floors_above = ClusterInput()
composite_slab = ClusterInput()
cores = ClusterInput()
glazing_system = ClusterInput()
city = ClusterInput()
simulation_name = ClusterInput()
weather_file = ClusterInput()
csv = ClusterInput()
sql_path = ClusterInput()
simulation_folder = ClusterInput()
run_simulation = ClusterInput()
columns = ClusterInput()
beams_x = ClusterInput()
beams_y = ClusterInput()
kgco2e_kwh = ClusterInput()
context = ClusterInput()
building = GhPythonScript(
    city=city,
    znames=zone,
    wwr=wwr,
    height=bang.Branch1,
    shade_gc=shgc,
    shade_depth_h=division,
    shade_depth_v1=division_2,
    shade_depth_v2=division_3,
    exterior_walls_n=trim_3,
    exterior_walls_s=trim_4,
    exterior_walls_e=trim_5,
    exterior_walls_w=trim_6,
    adiabatic_walls=trim_2,
    floor_surfaces=join,
    ceiling_surfaces=clean_2,
    facade_cladding=bang.Branch34,
    external_insulation=bang.Branch35,
    insulation_thickness=bang.Branch36,
    interior_insul_mat=interior_insul_mat,
    ewall_framing=bang.Branch37,
    int_finish=bang.Branch38,
    glazing_system=glazing_system,
    simulation_name=simulation_name,
    zone_program=bang.Branch33,
    weather_file=weather_file,
    csv=csv,
    sql_path=sql_path,
    simulation_folder=simulation_folder,
    run_simulation=run_simulation,
    columns=columns,
    beams_x=beams_x,
    beams_y=beams_y,
    cores=cores,
    building_type=building_type,
    num_floors_above=num_floors_above,
    composite_slab=composite_slab,
    ceiling_condition=bang.Branch11,
    floor_condition=bang.Branch12,
    kgco2e_kwh=kgco2e_kwh,
    context=context)  # -> out, building; inputs znames: tree, wwr: tree, shade_gc: tree, shade_depth_h: tree, shade_depth_v1: tree, shade_depth_v2: tree, exterior_walls_n: tree, exterior_walls_s: tree, exterior_walls_e: tree, exterior_walls_w: tree, adiabatic_walls: tree, floor_surfaces: tree, ceiling_surfaces: tree, columns: list, beams_x: list, beams_y: list, cores: list, context: list
# ---------- building: Python ----------
from studio2021.datastructures import building
reload(building)
from studio2021.datastructures.building import Building
import rhinoscriptsyntax as rs


columns = [[rs.CurveStartPoint(c), rs.CurveEndPoint(c)] for c in columns]
beams_x = [[rs.CurveStartPoint(b), rs.CurveEndPoint(b)] for b in beams_x]
beams_y = [[rs.CurveStartPoint(b), rs.CurveEndPoint(b)] for b in beams_y]
cores   = [rs.PolylineVertices(core) for core in cores]

context_ = []
for guid in context:
    if rs.IsSurface(guid):
        pt = [list(p) for p in rs.SurfacePoints(guid)]
        context_.append((pt[0], pt[1], pt[3], pt[2]))
    elif rs.IsBrep(guid):
        srfs = rs.ExplodePolysurfaces(guid)
        for srf in srfs:
            pt = [list(p) for p in rs.SurfacePoints(srf)]
            context_.append((pt[0], pt[1], pt[3], pt[2]))

data = {'city': city,
        'znames': znames,
        'exterior_walls_n': exterior_walls_n,
        'exterior_walls_s': exterior_walls_s,
        'exterior_walls_e': exterior_walls_e,
        'exterior_walls_w': exterior_walls_w,
        'adiabatic_walls': adiabatic_walls,
        'floor_surfaces': floor_surfaces,
        'ceiling_surfaces': ceiling_surfaces,
        'wwr':wwr,
        'height': height,
        'shade_gc':shade_gc,
        'shade_depth_h':shade_depth_h,
        'shade_depth_v1':shade_depth_v1,
        'shade_depth_v2':shade_depth_v2,
        'facade_cladding':facade_cladding,
        'external_insulation':external_insulation,
        'insulation_thickness':insulation_thickness,
        'interior_insul_mat':interior_insul_mat,
        'ewall_framing':ewall_framing,
        'int_finish':int_finish,
        'glazing_system':glazing_system,
        'simulation_name': simulation_name,
        'zone_program': zone_program,
        'weather_file': weather_file,
        'csv':csv,
        'sql_path': sql_path,
        'simulation_folder': simulation_folder,
        'run_simulation': run_simulation,
        'columns': columns,
        'beams_x': beams_x,
        'beams_y': beams_y,
        'cores':cores,
        'building_type':building_type,
        'num_floors_above':num_floors_above,
        'composite_slab':composite_slab,
        'ceiling_condition': ceiling_condition,
        'floor_condition': floor_condition,
        'kgco2e_kwh': kgco2e_kwh,
        'context':context_,
        }

building = Building.from_gh_data(data)
# ---------- end building ----------
panel = Panel(building.out)
building_2 = ClusterOutput(building.building)
out = ClusterOutput(building.out)

# ==== cluster Cluster
sql = ClusterInput()
roomenergyresult = HBReadRoomEnergyResult(sql=sql)  # -> cooling, heating, lighting, electric_equip, gas_equip, hot_water, fan_electric, pump_electric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; plug-in component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
toip = LBToIP(data_si=roomenergyresult.hot_water)  # -> data_ip; plug-in component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
toip_2 = LBToIP(data_si=roomenergyresult.electric_equip)  # -> data_ip; plug-in component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
toip_3 = LBToIP(data_si=roomenergyresult.people_gain)  # -> data_ip; plug-in component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
toip_4 = LBToIP(data_si=roomenergyresult.solar_gain)  # -> data_ip; plug-in component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
toip_5 = LBToIP(data_si=roomenergyresult.heating)  # -> data_ip; plug-in component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
toip_6 = LBToIP(data_si=roomenergyresult.lighting)  # -> data_ip; plug-in component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
toip_7 = LBToIP(data_si=roomenergyresult.cooling)  # -> data_ip; plug-in component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
xdata = LBDeconstructData(data=toip)  # -> header, values; plug-in component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
xdata_2 = LBDeconstructData(data=toip_2)  # -> header, values; plug-in component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
xdata_3 = LBDeconstructData(data=toip_4)  # -> header, values; plug-in component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
xdata_4 = LBDeconstructData(data=toip_3)  # -> header, values; plug-in component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
xdata_5 = LBDeconstructData(data=toip_5)  # -> header, values; plug-in component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
xdata_6 = LBDeconstructData(data=toip_6)  # -> header, values; plug-in component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
xdata_7 = LBDeconstructData(data=toip_7)  # -> header, values; plug-in component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
addition = Addition(A=xdata_7.values, B=xdata_5.values, C=xdata_6.values, D=xdata_2.values, E=xdata.values)
constrtype = LBConstructDataType(name="Heating", unit="kBtu")  # -> type; plug-in component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
constrtype_2 = LBConstructDataType(name="Cooling", unit="kBtu")  # -> type; plug-in component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
constrtype_3 = LBConstructDataType(name="Lighting", unit="kBtu")  # -> type; plug-in component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
constrtype_4 = LBConstructDataType(name="Equipment", unit="kBtu")  # -> type; plug-in component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
constrtype_5 = LBConstructDataType(name="Total Energy", unit="kBtu")  # -> type; plug-in component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
constrtype_6 = LBConstructDataType(name="People Gain", unit="kBtu")  # -> type; plug-in component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
constrtype_7 = LBConstructDataType(name="Solar Gain", unit="kBtu")  # -> type; plug-in component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
constrtype_8 = LBConstructDataType(name="Hot Water", unit="kBtu")  # -> type; plug-in component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
constrheader = LBConstructHeader(data_type=constrtype)  # -> header; plug-in component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
constrheader_2 = LBConstructHeader(data_type=constrtype_2)  # -> header; plug-in component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
constrheader_3 = LBConstructHeader(data_type=constrtype_4)  # -> header; plug-in component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
constrheader_4 = LBConstructHeader(data_type=constrtype_5)  # -> header; plug-in component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
constrheader_5 = LBConstructHeader(data_type=constrtype_3)  # -> header; plug-in component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
constrheader_6 = LBConstructHeader(data_type=constrtype_6)  # -> header; plug-in component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
constrheader_7 = LBConstructHeader(data_type=constrtype_7)  # -> header; plug-in component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
constrheader_8 = LBConstructHeader(data_type=constrtype_8)  # -> header; plug-in component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
data = LBConstructData(header=constrheader, values=xdata_5.values)  # -> data; plug-in component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
data_2 = LBConstructData(header=constrheader_2, values=xdata_7.values)  # -> data; plug-in component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
data_3 = LBConstructData(header=constrheader_4, values=addition)  # -> data; plug-in component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
data_4 = LBConstructData(header=constrheader_5, values=xdata_6.values)  # -> data; plug-in component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
data_5 = LBConstructData(header=constrheader_3, values=xdata_2.values)  # -> data; plug-in component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
data_6 = LBConstructData(header=constrheader_6, values=xdata_4.values)  # -> data; plug-in component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
data_7 = LBConstructData(header=constrheader_7, values=xdata_3.values)  # -> data; plug-in component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
data_8 = LBConstructData(header=constrheader_8, values=xdata.values)  # -> data; plug-in component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
data_9 = ClusterOutput(data)
data_10 = ClusterOutput(data_3)
data_11 = ClusterOutput(data_2)
data_12 = ClusterOutput(data_4)
data_13 = ClusterOutput(data_5)
data_14 = ClusterOutput(data_6)
data_15 = ClusterOutput(data_7)
data_16 = ClusterOutput(data_8)

# ==== cluster Cluster_2
D = ClusterInput()
S = ClusterInput()
fsim = FindSimilarMember(Data=D, Set=S)  # -> Hit, Index
_0 = ClusterInput()
_1 = ClusterInput()
_2 = ClusterInput()
_3 = ClusterInput()
_4 = ClusterInput()
_5 = ClusterInput()
_6 = ClusterInput()
_7 = ClusterInput()
filter = StreamFilter(Gate=fsim.Index, Stream0=_0, Stream1=_1, Stream2=_2, Stream3=_3, Stream4=_4, Stream5=_5, Stream6=_6, Stream7=_7)
s_1 = ClusterOutput(filter)
xdata = LBDeconstructData(data=filter)  # -> header, values; plug-in component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
bnd = Bounds(Numbers=flatten(xdata.values))
dedomain = DeconstructDomain(Domain=bnd)  # -> Start, End
E = ClusterOutput(dedomain.End)

# ==== cluster FindBuildableArea
C = ClusterInput()
explode = Explode(Curve=C, Recursive=True)  # -> Segments, Vertices
brep = Brep(<brep referenced from the Rhino model>)
item = ListItem(List=explode.Segments, Index=Slider(1, range=0..3), Wrap=True)
edges = BrepEdges(Brep=brep)  # -> Naked, Interior, NonManifold
item_2 = ListItem(List=explode.Segments, Index=Slider(0, range=0..3), Wrap=True)
item_3 = ListItem(List=explode.Segments, Index=Slider(2, range=0..3), Wrap=True)
item_4 = ListItem(List=explode.Segments, Index=Slider(3, range=0..3), Wrap=True)
item_5 = ListItem(List=edges.Interior, Index=0, Wrap=True)
midpt = CurveMiddle(Curve=item_5)
midpt_2 = CurveMiddle(Curve=item_4)
X = UnitX(Factor=Slider(8, range=0..100))
X_2 = UnitX(Factor=Slider(20, range=0..100))  # -> expr("-x", UnitVector)
Y = UnitY(Factor=Slider(5, range=0..100))  # -> expr("-x", UnitVector)
Y_2 = UnitY(Factor=Slider(5, range=0..100))
move = Move(Geometry=item_4, Motion=X)  # -> Geometry, Transform
move_2 = Move(Geometry=item, Motion=X_2)  # -> Geometry, Transform
move_3 = Move(Geometry=item_2, Motion=Y_2)  # -> Geometry, Transform
move_4 = Move(Geometry=item_3, Motion=Y)  # -> Geometry, Transform
pdecon = Deconstruct(Point=midpt)  # -> XComponent, YComponent, ZComponent
pdecon_2 = Deconstruct(Point=midpt_2)  # -> XComponent, YComponent, ZComponent
pt = ConstructPoint(XCoordinate=pdecon.XComponent, YCoordinate=pdecon_2.YComponent, ZCoordinate=0)
ptuvcrvs = IntersectCurves(CU=[move_2.Geometry, move.Geometry], CV=[move_4.Geometry, move_3.Geometry])
dist = Distance(PointA=pt, PointB=midpt_2)
subtraction = Subtraction(A=dist, B=Slider(5, range=0..10))
X_3 = UnitX(Factor=subtraction)
item_6 = ListItem(List=flatten(ptuvcrvs), Index=Slider(3, range=0..4), Wrap=True)
item_7 = ListItem(List=flatten(ptuvcrvs), Index=Slider(0, range=0..4), Wrap=True)
move_5 = Move(Geometry=item_4, Motion=X_3)  # -> Geometry, Transform
end = EndPoints(Curve=move_5.Geometry)  # -> Start, End
pdecon_3 = Deconstruct(Point=end.Start)  # -> XComponent, YComponent, ZComponent
pdecon_4 = Deconstruct(Point=item_7)  # -> XComponent, YComponent, ZComponent
rec_2pt = Rectangle2Pt(Plane=PlaneXY(0, 0, 0), PointA=item_6, PointB=item_7, Radius=0)  # -> Rectangle, Length
pt_2 = ConstructPoint(XCoordinate=pdecon_3.XComponent, YCoordinate=pdecon_4.YComponent, ZCoordinate=0)
rec_2pt_2 = Rectangle2Pt(Plane=PlaneXY(0, 0, 0), PointA=pt_2, PointB=item_6, Radius=0)  # -> Rectangle, Length
R = ClusterOutput(rec_2pt_2.Rectangle)
