# Grasshopper definition GA-analysistesting.gh (Grasshopper 1.0.7)
# plug-ins: Human

crv = Curve(<curve referenced from the Rhino model>)
findbuildablearea = FindBuildableArea(C=crv)
crv_2 = Curve(findbuildablearea)
explode = Explode(Curve=crv_2, Recursive=True)  # -> Segments, Vertices
item = ListItem(List=explode.Segments, Index=Slider(1, range=0..1), Wrap=True)
len = Length(Curve=item)
division = Division(A=len, B=Slider(-3.333, range=-10..10))
offset = OffsetCurve(Curve=crv_2, Distance=division, Plane=PlaneXY(0, 0, 0), Corners=1)
explode_2 = Explode(Curve=offset, Recursive=True)  # -> Segments, Vertices
item_2 = ListItem(List=explode.Vertices, Index=Slider(0, range=0..100), Wrap=True)
item_3 = ListItem(List=explode.Vertices, Index=Slider(1, range=0..100), Wrap=True)
item_4 = ListItem(List=explode.Vertices, Index=Slider(2, range=0..100), Wrap=True)
item_5 = ListItem(List=explode.Vertices, Index=Slider(3, range=0..100), Wrap=True)
item_6 = ListItem(List=explode_2.Vertices, Index=Slider(0, range=0..100), Wrap=True)
item_7 = ListItem(List=explode_2.Vertices, Index=Slider(1, range=0..100), Wrap=True)
item_8 = ListItem(List=explode_2.Vertices, Index=Slider(2, range=0..100), Wrap=True)
item_9 = ListItem(List=explode_2.Vertices, Index=Slider(3, range=0..100), Wrap=True)
item_10 = ListItem(List=explode.Segments, Index=Slider(0, range=0..100), Wrap=True)
item_11 = ListItem(List=explode.Segments, Index=Slider(1, range=0..100), Wrap=True)
item_12 = ListItem(List=explode.Segments, Index=Slider(2, range=0..100), Wrap=True)
item_13 = ListItem(List=explode.Segments, Index=Slider(3, range=0..100), Wrap=True)
ln = Line(StartPoint=item_4, EndPoint=item_8)
ln_2 = Line(StartPoint=item_5, EndPoint=item_9)
item_14 = ListItem(List=explode_2.Segments, Index=Slider(0, range=0..100), Wrap=True)
item_15 = ListItem(List=explode_2.Segments, Index=Slider(1, range=0..100), Wrap=True)
ln_3 = Line(StartPoint=item_2, EndPoint=item_6)
ln_4 = Line(StartPoint=item_3, EndPoint=item_7)
item_16 = ListItem(List=explode_2.Segments, Index=Slider(2, range=0..100), Wrap=True)
item_17 = ListItem(List=explode_2.Segments, Index=Slider(3, range=0..100), Wrap=True)
panel = Panel("http://climate.onebuilding.org/WMO_Region_4_North_and_Central_America/USA_United_States_of_America/WA_Washington/USA_WA_Seattle-Tacoma.Intl.AP.727930_TMY3.zip")
galapagos = Galapagos()

# ----
# Massing
# Geometry
height_ft = Panel("10")
outsidecrvfromrhino = Curve([item_13, ln_2, ln_3])
outsidecrvfromrhino_2 = Curve([ln_4, item_10, ln_3])
adiabaticcrvfromrhino = Curve(item_15)
adiabaticcrvfromrhino_2 = Curve(item_16)
adiabaticcrvfromrhino_3 = Curve(item_17)
adiabaticcrvfromrhino_4 = Curve(item_14)
outsidecrvfromrhino_3 = Curve([item_12, ln, ln_2])
outsidecrvfromrhino_4 = Curve([item_11, ln_4, ln])
adiabaticcrvfromrhino_5 = Curve([item_14, item_15, item_16, item_17])

downloadepw = LBDownloadWeather(weather_URL=panel)  # -> epw_file, stat_file, ddy_file; plug-in component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
number_slider = Slider(0.4, range=0..1)

# ----
# INPUTS
# Run Energy
# Simulation
run_energy_simulation = BooleanToggle(False)

# ----
# Simulation Inputs
# Simulation Folder Name:
# Simulation Name:
# .sql Filepath:
path = GhPythonScript()  # -> out, path
# ---------- path: Python ----------
__author__ = "tmendeze"


import studio2021

path = studio2021.TEMP
# ---------- end path ----------
panel_2 = Panel("clever_name")
panel_3 = Panel(path.path)
time_stamp = GhPythonScript(name=panel_2, run=run_energy_simulation)  # -> out, name
# ---------- time_stamp: Python ----------
__author__ = "tmendeze"

import rhinoscriptsyntax as rs
if run:
    import datetime
    time = datetime.datetime.now().strftime('%Y%m%d%H%M')
    name_ = '{}_{}'.format(name, time)
    print(name_)
else:
    name_=name
# ---------- end time_stamp ----------
# Scenario:
csv_path = GhPythonScript(path=path.path, sim_name=time_stamp.name)  # -> out, sql_path
# ---------- csv_path: Python ----------
__author__ = "tmendeze"
__version__ = "2021.03.02"

import rhinoscriptsyntax as rs
import os
sql = os.path.join('OpenStudio','run','eplusout.sql')
sql_path = os.path.join(path, sim_name, sql)
# ---------- end csv_path ----------
panel_4 = Panel(csv_path.sql_path)

# ----
# Simulation Outputs
# Output Folder Name:
csv_path_2 = GhPythonScript(path=path.path, sim_name=time_stamp.name)  # -> out, csv_path
# ---------- csv_path_2: Python ----------
__author__ = "tmendeze"
__version__ = "2021.03.02"

import rhinoscriptsyntax as rs
import os
csv_path = os.path.join(path, sim_name+".csv")
# ---------- end csv_path_2 ----------
panel_5 = Panel(csv_path_2.csv_path)

# ----
# Add Context
pipeline = GeometryPipeline(
    GroupByLayer=False,
    GroupByType=False,
    IncludeHidden=True,
    IncludeLocked=True,
    LayerFilter="context",
    NameFilter="*",
    SublayerFiltering=True,
    TypeFilter=1073741848)
data = Data(pipeline)

item_18 = ListItem(Index=0, Wrap=True)

# ---- group: generate trees for radiance
# % to keep
number_slider_2 = Slider(50, range=0..100)  # disabled
mesh_sphere = MeshSphere(Base=PlaneXY(0, 0, 0), Radius=10, UCount=number_slider_2, VCount=number_slider_2)  # disabled
triangulate = Triangulate(Mesh=mesh_sphere)  # -> Mesh, Count; disabled
number_slider_3 = Slider(0.27, range=0..1)  # disabled
deconstruct_mesh = DeconstructMesh(Mesh=triangulate.Mesh)  # -> Vertices, Faces, Colours, Normals; disabled
list_length = ListLength(List=deconstruct_mesh.Faces)  # disabled
multiplication = Multiplication(A=list_length, B=number_slider_3)  # disabled
series = Series(Start=0, Step=1, Count=list_length)  # disabled
random_reduce = RandomReduce(List=series, Reduction=multiplication, Seed=1)  # disabled
ghpython_script = PythonScript(x=series, y=random_reduce)  # -> a; inputs x: list, y: list; disabled
# ---------- ghpython_script: Python ----------
a = (i in y for i in x)
# ---------- end ghpython_script ----------
cull_faces = CullFaces(Mesh=triangulate.Mesh, Pattern=ghpython_script)  # disabled
colour_swatch = ColourSwatch(SwatchColor=RGB(51, 149, 66))  # disabled
custom_preview = CustomPreview(Geometry=cull_faces, Shader=colour_swatch)  # disabled

# ----
item_19 = ListItem(List=".63", Index=0, Wrap=True)
item_20 = ListItem(List=".4", Index=0, Wrap=True)

# ----
# Glazing
north_wwr = Slider(0.5, range=0..0.95)
south_wwr = Slider(0.5, range=0..0.95)
west_wwr = Slider(0.5, range=0..0.95)
east_wwr = Slider(0.5, range=0..0.95)
north_shgc = ValueList({"Low SHGC": 0.25, "High SHGC": 0.60}, selected="Low SHGC")
south_shgc = ValueList({"Low SHGC": 0.25, "High SHGC": 0.60}, selected="Low SHGC")
west_shgc = ValueList({"Low SHGC": 0.25, "High SHGC": 0.60}, selected="Low SHGC")
east_shgc = ValueList({"Low SHGC": 0.25, "High SHGC": 0.60}, selected="Low SHGC")
window_uvalue = Panel(item_20)

item_21 = ListItem(List="aluminum", Index=0, Wrap=True)
multiplication_2 = Multiplication(A=item_20, B=Slider(5.678, range=0..10))
r_value_of_wall_construction = Panel(multiplication_2)
wwr_n_s_e_w = ExplodeTree(Data=item_18)  # -> Branch0, Branch1, Branch2, Branch3
subtraction = Subtraction(A=height_ft, B=Slider(2, range=0..10))  # -> flatten(Result)
number_slider_4 = Slider(1, range=0..10)

r_per_in = Slider(4, range=0..10)
multiplication_3 = Multiplication(A=r_per_in, InsulationThickness=Slider(1, range=0..1))
division_2 = Division(A=multiplication_3, B=5.67826)
opaquematnomass = HBOpaqueMaterialNoMass(name="AirGap", r_value=Slider(1, range=0..1))  # -> flatten(mat); plug-in component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
opaquematnomass_2 = HBOpaqueMaterialNoMass(name="ContExtInsulation", r_value=division_2)  # -> mat; plug-in component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
opaquemat = HBOpaqueMaterial(
    name="2x6 wall framing",
    thickness=Slider(0.0889, range=0..0.1),
    conductivity=Slider(0.041, range=0..0.1),
    density=Slider(141.25, range=0..1000),
    spec_heat=Slider(2300, range=0..10000))  # -> mat; plug-in component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
opaquemat_2 = HBOpaqueMaterial(
    name="Gypsum Board",
    thickness=Slider(0.5, range=0..1),
    conductivity=Slider(0.16, range=0..1),
    density=Slider(800, range=0..1000),
    spec_heat=Slider(109, range=0..1000))  # -> mat; plug-in component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
opaquemat_3 = HBOpaqueMaterial(
    name="Wood Exterior Cladding",
    thickness=Slider(0.0191, range=0..0.1),
    conductivity=Slider(0.116, range=0..1),
    density=Slider(540, range=0..1000),
    spec_heat=Slider(1210, range=0..10000))  # -> flatten(mat); plug-in component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
clean = CleanTree(
    RemoveNulls=True,
    RemoveInvalid=True,
    RemoveEmpty=False,
    Tree=flatten([opaquemat_3, opaquematnomass, opaquematnomass_2, opaquemat, opaquemat_2]))
opaqueconstr = HBOpaqueConstruction(name="ExteriorWall", materials=flatten(clean))  # -> constr; plug-in component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
panel_6 = Panel(clean)
exteriorsubset = HBExteriorConstructionSubset(exterior_wall=opaqueconstr)  # -> exterior_set; plug-in component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
decnstrconstr = HBDeconstructConstruction(constr=opaqueconstr)  # -> materials, layers, r_val_si, r_val_ip, u_fac_si, u_fac_ip, t_sol, t_vis; plug-in component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
one_over_x = OneOverX(Value=decnstrconstr.u_fac_ip)
constructionset = HBConstructionSet(name="CustomConstructionSet", exterior_subset=exteriorsubset)  # -> constr_set; plug-in component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
r_value_of_wall_construction_2 = Panel(one_over_x)

shade = HBShade()  # -> report, shades; plug-in component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
run_write = BooleanToggle(False)

# ----
# Sun Path & Shading Mask
number_slider_5 = Slider(3, range=1..12)  # disabled
number_slider_6 = Slider(12, range=1..24)  # disabled
number_slider_7 = Slider(21, range=1..31)  # disabled
join = JoinCurves(Curves=[outsidecrvfromrhino_2, outsidecrvfromrhino_4, outsidecrvfromrhino_3, outsidecrvfromrhino], Preserve=False)  # disabled
importloc = LBImportLocation(epw_file=downloadepw.epw_file)  # -> location; disabled; plug-in component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
hoy = LBCalculateHOY(month=number_slider_5, day=number_slider_7, hour=number_slider_6)  # -> flatten(hoy), flatten(doy), flatten(date); disabled; plug-in component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
area = Area(Geometry=join)  # -> Area, Centroid; disabled
sunpath = LBSunPath(location=importloc, hoys=hoy.hoy, center_pt=area.Centroid, scale=1)  # -> report, vectors, altitudes, azimuths, hoys, sun_pts, analemma, daily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; disabled; plug-in component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
symask = LBSkyMask(context=data, center=area.Centroid)  # -> report, context_mask, orient_mask, strategy_mask, sky_mask, context_view, orient_view, strategy_view, sky_view; disabled; plug-in component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

# ----
# Chart Results
panel_7 = Panel("""Cooling
Heating
Lighting
Equipment
Hot Water
People Gain
Solar Gain
Total Energy""")
data_2 = Data(panel_7)
pick_sql_file = GhPythonScript(i=Slider(0, range=0..10))  # -> out, filepath; inputs i: Int32
# ---------- pick_sql_file: Python ----------
__author__ = "tmendeze"


import studio2021
import os


files = []
for f in os.listdir(os.path.join(studio2021.TEMP)):
    if f.endswith('.csv'):
        files.append(f)
        
file = files[i]

folder = os.path.splitext(file)[0]
filepath =os.path.join(studio2021.TEMP, folder)
filepath = os.path.join(filepath, 'OpenStudio')
filepath = os.path.join(filepath, 'run')
filepath = os.path.join(filepath, 'eplusout.sql')
print(file)
# ---------- end pick_sql_file ----------
list = ItemSelector(
    data_2,
    {"Cooling", "Heating", "Lighting", "Equipment", "Hot Water", "People Gain", "Solar Gain", "Total Energy"}, selected="Heating")
cluster = Cluster(sql=pick_sql_file.filepath)  # -> data_11, data_9, data_12, data_13, data_16, data_14, data_15, data_10
cluster_2 = Cluster_2(
    D=list,
    S=panel_7,
    _0=cluster.data_11,
    _1=cluster.data_9,
    _2=cluster.data_12,
    _3=cluster.data_13,
    _4=cluster.data_16,
    _5=cluster.data_14,
    _6=cluster.data_15,
    _7=cluster.data_10)  # -> E, s_1
vec = VectorXYZ(XComponent=Slider(472, range=0..1000), YComponent=0, ZComponent=0)  # -> Vector, Length
legendpar = LBLegendParameters(min=0, max=cluster_2.E)  # -> leg_par; plug-in component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
move = Move(Geometry=area.Centroid, Motion=vec.Vector)  # -> Geometry, Transform
# CHECK FILE!
hourlyplot = LBHourlyPlot(data=flatten(cluster_2.s_1), base_pt=move.Geometry, legend_par=legendpar)  # -> report, mesh, legend, borders, labels, title; plug-in component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

make_sure_this_is_the_right_file = Panel(pick_sql_file.out)

# ----
# Set Zone Program
bldgprograms = HBBuildingPrograms({"LargeOffice", "MediumOffice", "SmallOffice", "MidriseApartment", "HighriseApartment", "Retail", "StripMall", "PrimarySchool", "SecondarySchool", "SmallHotel", "LargeHotel", "Hospital", "Outpatient", "Laboratory", "Warehouse", "SuperMarket", "FullServiceRestaurant", "QuickServiceRestaurant", "Courthouse", "LargeDataCenterHighITE", "LargeDataCenterLowITE", "SmallDataCenterHighITE", "SmallDataCenterLowITE"}, selected="Retail")

searchprog = HBSearchPrograms(bldg_prog=bldgprograms)  # -> room_prog; plug-in component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

list_2 = ItemSelector(
    searchprog,
    {"2013::Retail::Back_Space", "2013::Retail::Core_Retail", "2013::Retail::Entry", "2013::Retail::Front_Retail", "2013::Retail::Point_of_Sale", "2013::Retail::Retail"}, selected="2013::Retail::Back_Space")

cluster_3 = Cluster_3(
    _0_0_2="1_zonename",
    _0_1_2="2_zonename",
    _0_2_2="3_zonename",
    _0_3_2="4_zonename",
    _0_4_2="5_zonename",
    _0_0="clever_name",
    _0_1=height_ft,
    _0_2=outsidecrvfromrhino_2,
    _0_3=adiabaticcrvfromrhino_4,
    _0_4=outsidecrvfromrhino_4,
    _0_5=adiabaticcrvfromrhino,
    _0_6=outsidecrvfromrhino_3,
    _0_7=adiabaticcrvfromrhino_2,
    _0_8=outsidecrvfromrhino,
    _0_9=adiabaticcrvfromrhino_3,
    _0_10=adiabaticcrvfromrhino_5,
    _0_13=north_wwr,
    _0_14=south_wwr,
    _0_15=east_wwr,
    _0_16=west_wwr,
    _0_29=list_2)  # -> T, T_2, T_3, T_5, T_4
join_2 = JoinCurves(Curves=cluster_3.T_5, Preserve=False)

# ---- group: Create Faces
face = HBFace(geo=join_2, name="RoofCeiling", type="RoofCeiling", bc="Outdoors")  # -> report, faces; plug-in component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
face_2 = HBFace(name="Floor", type="Floor", bc="Ground")  # -> report, faces; plug-in component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
face_3 = HBFace(name="Adiabatic Wall", type="AirBoundary", bc="Adiabatic")  # -> report, faces; plug-in component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
match = MatchTree(Tree=face_2.faces)
match_2 = MatchTree(Tree=face_3.faces)
match_3 = MatchTree(Tree=face.faces, Guide=match)

# ---- group: Create Room
clean_2 = CleanTree(RemoveNulls=True, RemoveInvalid=True, RemoveEmpty=True, Tree=[match_2, match, match_3])
tstat = TreeStatistics(Tree=clean_2)  # -> Paths, Length, Count
zone_names = TreeBranch(Path=tstat.Paths, MaintainPaths=True)
room = HBRoom(faces=clean_2, name=zone_names, conditioned=True)  # -> report, room; plug-in component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

# ----
clean_3 = CleanTree(RemoveNulls=True, RemoveInvalid=True, RemoveEmpty=True, Tree=cluster_3.T_3)
clean_4 = CleanTree(RemoveNulls=True, RemoveInvalid=True, RemoveEmpty=True, Tree=cluster_3.T_4)
clean_5 = CleanTree(RemoveNulls=True, RemoveInvalid=True, RemoveEmpty=True, Tree=cluster_3.T_2)
clean_6 = CleanTree(RemoveNulls=True, RemoveInvalid=True, RemoveEmpty=True, Tree=cluster_3.T)

# ---- group: Apply Con Set
clean_7 = CleanTree(RemoveNulls=True, RemoveInvalid=True, RemoveEmpty=False, Tree=room.room)  # -> flatten(Tree)
applyconstrset = HBApplyConstructionSet(rooms=clean_7, constr_set=constructionset)  # -> rooms; plug-in component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

# ----
model = HBModel(rooms=flatten(applyconstrset))  # -> report, model; plug-in component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

face_4 = HBFace(geo=clean_4, name="Exposed Wall", type="Wall", bc="Outdoors")  # -> report, simplify(faces); plug-in component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
windowmat = HBWindowMaterial(name=item_21, u_factor=flatten(multiplication_2), shgc=flatten(number_slider), t_vis=flatten(item_19))  # -> mat; plug-in component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
windowconstr = HBWindowConstruction(name="WGlass", materials=flatten(windowmat))  # -> constr; plug-in component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

match_4 = MatchTree(Tree=face_4.faces, Guide=clean_4)

aperturesbyratio = HBAperturesByRatio(hb_objs=match_4, ratio=flatten(wwr_n_s_e_w.Branch3), win_height=subtraction, sill_height=number_slider_4)  # -> report, hb_objs; plug-in component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
applywindowconstr = HBApplyWindowConstruction(hb_objs=aperturesbyratio.hb_objs, constr=windowconstr)  # -> hb_objs; plug-in component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

face_5 = HBFace(geo=clean_3, name="Exposed Wall", type="Wall", bc="Outdoors")  # -> report, simplify(faces); plug-in component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
windowmat_2 = HBWindowMaterial(name=item_21, u_factor=flatten(multiplication_2), shgc=flatten(number_slider), t_vis=flatten(item_19))  # -> mat; plug-in component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
windowconstr_2 = HBWindowConstruction(name="EGlass", materials=flatten(windowmat_2))  # -> constr; plug-in component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

match_5 = MatchTree(Tree=face_5.faces, Guide=clean_3)

aperturesbyratio_2 = HBAperturesByRatio(hb_objs=match_5, ratio=flatten(wwr_n_s_e_w.Branch2), win_height=subtraction, sill_height=number_slider_4)  # -> report, hb_objs; plug-in component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
applywindowconstr_2 = HBApplyWindowConstruction(hb_objs=aperturesbyratio_2.hb_objs, constr=windowconstr_2)  # -> hb_objs; plug-in component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

face_6 = HBFace(geo=clean_6, name="Exposed Wall", type="Wall", bc="Outdoors")  # -> report, simplify(faces); plug-in component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
windowmat_3 = HBWindowMaterial(name=item_21, u_factor=flatten(multiplication_2), shgc=flatten(number_slider), t_vis=flatten(item_19))  # -> mat; plug-in component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
windowconstr_3 = HBWindowConstruction(name="NGlass", materials=flatten(windowmat_3))  # -> constr; plug-in component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

match_6 = MatchTree(Tree=face_6.faces, Guide=clean_6)

aperturesbyratio_3 = HBAperturesByRatio(hb_objs=match_6, ratio=flatten(wwr_n_s_e_w.Branch0), win_height=subtraction, sill_height=number_slider_4)  # -> report, hb_objs; plug-in component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
applywindowconstr_3 = HBApplyWindowConstruction(hb_objs=aperturesbyratio_3.hb_objs, constr=windowconstr_3)  # -> hb_objs; plug-in component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

decnstrconstr_2 = HBDeconstructConstruction(constr=windowconstr_3)  # -> materials, layers, r_val_si, r_val_ip, u_fac_si, u_fac_ip, t_sol, t_vis; plug-in component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

face_7 = HBFace(geo=clean_5, name="Exposed Wall", type="Wall", bc="Outdoors")  # -> report, simplify(faces); plug-in component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
windowmat_4 = HBWindowMaterial(name=item_21, u_factor=flatten(multiplication_2), shgc=flatten(number_slider), t_vis=flatten(item_19))  # -> mat; plug-in component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
windowconstr_4 = HBWindowConstruction(name="SGlass", materials=flatten(windowmat_4))  # -> constr; plug-in component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

match_7 = MatchTree(Tree=face_7.faces, Guide=clean_5)

aperturesbyratio_4 = HBAperturesByRatio(hb_objs=match_7, ratio=flatten(wwr_n_s_e_w.Branch1), win_height=subtraction, sill_height=number_slider_4)  # -> report, hb_objs; plug-in component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
applywindowconstr_4 = HBApplyWindowConstruction(hb_objs=aperturesbyratio_4.hb_objs, constr=windowconstr_4)  # -> hb_objs; plug-in component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

n_s_e_w_exterior_walls = Merge(Data1=applywindowconstr_3, Data2=applywindowconstr_4, Data3=applywindowconstr_2, Data4=applywindowconstr)
remove_empy_zones = CleanTree(RemoveNulls=True, RemoveInvalid=True, RemoveEmpty=True, Tree=n_s_e_w_exterior_walls)

# ----
# Energy Simulation
toggle = BooleanToggle(True)
simoutput = HBSimulationOutput(zone_energy_use=toggle, gains_and_losses=toggle)  # -> report, sim_output; plug-in component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
simpar = HBSimulationParameter(output=simoutput.sim_output, timestep=6)  # -> sim_par; plug-in component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
model_2 = HBModel(rooms=flatten(applyconstrset), shades=flatten(shade.shades))  # -> report, model; plug-in component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

null = NullItem(Item=model_2.model)  # -> NullFlags, InvalidFlags, Description
filter = StreamFilter(Gate=null.InvalidFlags, Stream0=model_2.model, Stream1=model.model)

modeltoosm = HBModelToOSM(model=filter, epw_file=downloadepw.epw_file, sim_par=simpar, write=run_write, run=run_write)  # -> report, jsons, osw, osm, idf, sql, zsz, rdd, html; plug-in component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
roomenergyresult = HBReadRoomEnergyResult(sql=modeltoosm.sql)  # -> cooling, heating, lighting, electric_equip, gas_equip, hot_water, fan_electric, pump_electric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; plug-in component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

panel_8 = Panel(roomenergyresult.hot_water)
add_euis = GhPythonScript(
    cooling=roomenergyresult.cooling,
    heating=roomenergyresult.heating,
    lighting=roomenergyresult.lighting,
    equipment=roomenergyresult.electric_equip,
    hot_water=roomenergyresult.hot_water,
    wall_r=one_over_x,
    window_u=decnstrconstr_2.u_fac_ip)  # -> out, building; inputs cooling: list, heating: list, lighting: list, equipment: list, hot_water: list
# ---------- add_euis: Python ----------
__author__ = "tmendeze"

building.add_eui_results(cooling,
                         heating,
                         lighting,
                         equipment,
                         hot_water,
                         wall_r,
                         window_u)
# ---------- end add_euis ----------
panel_9 = Panel(add_euis.out)

# ----
# Label Rooms
faceenergyattr = HBFaceEnergyAttributes({"Construction": "properties.energy.construction.display_name", "Materials": "properties.energy.construction.layers", "R-Value": "properties.energy.construction.r_value", "U-Value": "properties.energy.construction.u_value", "U-Factor": "properties.energy.construction.u_factor", "Solar Transmitance [Unshaded]": "properties.energy.construction.solar_transmittance", "Solar Reflectance [Outside]": "properties.energy.construction.outside_solar_reflectance", "Solar Reflectance [Inside]": "properties.energy.construction.inside_solar_reflectance", "Fraction Area Operable": "properties.energy.vent_opening.fraction_area_operable", "Fraction Height Operable": "properties.energy.vent_opening.fraction_height_operable", "Discharge Coefficient": "properties.energy.vent_opening.discharge_coefficient", "Cross Ventilation": "properties.energy.vent_opening.wind_cross_vent"}, selected="Construction")  # disabled
roomenergyattr = HBRoomEnergyAttributes({"Program": "properties.energy.program_type.display_name", "Construction Set": "properties.energy.construction_set.display_name", "Is Conditioned": "properties.energy.is_conditioned", "People per Area [ppl/m2]": "properties.energy.people.people_per_area", "Area per Person [m2/ppl]": "properties.energy.people.area_per_person", "Lighting per Area [W/m2]": "properties.energy.lighting.watts_per_area", "Electric Equipment per Area [W/m2]": "properties.energy.electric_equipment.watts_per_area", "Gas Equipment per Area [W/m2]": "properties.energy.gas_equipment.watts_per_area", "Infiltration per Exterior Area [m3/s-m2]": "properties.energy.infiltration.flow_per_exterior_area", "Ventilation per Person [m3/s-ppl]": "properties.energy.ventilation.flow_per_person"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}, selected="Ventilation per Person [m3/s-ppl]")  # disabled
allzones = Data(filter)  # disabled
labelrooms = HBLabelRooms(rooms_model=flatten(allzones), attribute=roomenergyattr)  # -> label_text, base_pts, labels, wire_frame; disabled; plug-in component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
lablefaces = HBLabelFaces(hb_objs=flatten(allzones), attribute=faceenergyattr)  # -> label_text, base_pts, labels, wire_frame; disabled; plug-in component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

# ----
# View Zones
allzones_2 = Data(filter)
vizbytype = HBVisualizeByType(hb_objs=allzones_2)  # -> walls, interior_walls, roofs, ceilings, exterior_floors, interior_floors, air_walls, apertures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; plug-in component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

# ----
# Write To Excel
write_results = GhPythonScript(building=add_euis.building)  # -> out
# ---------- write_results: Python ----------
__author__ = "tmendeze"

building.write_results()
# ---------- end write_results ----------
panel_10 = Panel(write_results)

# ==== cluster Cluster
sql = ClusterInput()
roomenergyresult = HBReadRoomEnergyResult(sql=sql)  # -> cooling, heating, lighting, electric_equip, gas_equip, hot_water, fan_electric, pump_electric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; plug-in component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
toip = LBToIP(data_si=roomenergyresult.hot_water)  # -> data_ip; plug-in component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
toip_2 = LBToIP(data_si=roomenergyresult.electric_equip)  # -> data_ip; plug-in component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
toip_3 = LBToIP(data_si=roomenergyresult.people_gain)  # -> data_ip; plug-in component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
toip_4 = LBToIP(data_si=roomenergyresult.solar_gain)  # -> data_ip; plug-in component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
toip_5 = LBToIP(data_si=roomenergyresult.heating)  # -> data_ip; plug-in component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
toip_6 = LBToIP(data_si=roomenergyresult.lighting)  # -> data_ip; plug-in component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
toip_7 = LBToIP(data_si=roomenergyresult.cooling)  # -> data_ip; plug-in component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
xdata = LBDeconstructData(data=toip)  # -> header, values; plug-in component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
xdata_2 = LBDeconstructData(data=toip_2)  # -> header, values; plug-in component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
xdata_3 = LBDeconstructData(data=toip_4)  # -> header, values; plug-in component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
xdata_4 = LBDeconstructData(data=toip_3)  # -> header, values; plug-in component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
xdata_5 = LBDeconstructData(data=toip_5)  # -> header, values; plug-in component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
xdata_6 = LBDeconstructData(data=toip_6)  # -> header, values; plug-in component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
xdata_7 = LBDeconstructData(data=toip_7)  # -> header, values; plug-in component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
addition = Addition(A=xdata_7.values, B=xdata_5.values, C=xdata_6.values, D=xdata_2.values, E=xdata.values)
constrtype = LBConstructDataType(name="Heating", unit="kBtu")  # -> type; plug-in component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
constrtype_2 = LBConstructDataType(name="Cooling", unit="kBtu")  # -> type; plug-in component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
constrtype_3 = LBConstructDataType(name="Lighting", unit="kBtu")  # -> type; plug-in component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
constrtype_4 = LBConstructDataType(name="Equipment", unit="kBtu")  # -> type; plug-in component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
constrtype_5 = LBConstructDataType(name="Total Energy", unit="kBtu")  # -> type; plug-in component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
constrtype_6 = LBConstructDataType(name="People Gain", unit="kBtu")  # -> type; plug-in component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
constrtype_7 = LBConstructDataType(name="Solar Gain", unit="kBtu")  # -> type; plug-in component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
constrtype_8 = LBConstructDataType(name="Hot Water", unit="kBtu")  # -> type; plug-in component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
constrheader = LBConstructHeader(data_type=constrtype)  # -> header; plug-in component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
constrheader_2 = LBConstructHeader(data_type=constrtype_2)  # -> header; plug-in component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
constrheader_3 = LBConstructHeader(data_type=constrtype_4)  # -> header; plug-in component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
constrheader_4 = LBConstructHeader(data_type=constrtype_5)  # -> header; plug-in component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
constrheader_5 = LBConstructHeader(data_type=constrtype_3)  # -> header; plug-in component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
constrheader_6 = LBConstructHeader(data_type=constrtype_6)  # -> header; plug-in component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
constrheader_7 = LBConstructHeader(data_type=constrtype_7)  # -> header; plug-in component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
constrheader_8 = LBConstructHeader(data_type=constrtype_8)  # -> header; plug-in component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
data = LBConstructData(header=constrheader, values=xdata_5.values)  # -> data; plug-in component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
data_2 = LBConstructData(header=constrheader_2, values=xdata_7.values)  # -> data; plug-in component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
data_3 = LBConstructData(header=constrheader_4, values=addition)  # -> data; plug-in component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
data_4 = LBConstructData(header=constrheader_5, values=xdata_6.values)  # -> data; plug-in component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
data_5 = LBConstructData(header=constrheader_3, values=xdata_2.values)  # -> data; plug-in component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
data_6 = LBConstructData(header=constrheader_6, values=xdata_4.values)  # -> data; plug-in component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
data_7 = LBConstructData(header=constrheader_7, values=xdata_3.values)  # -> data; plug-in component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
data_8 = LBConstructData(header=constrheader_8, values=xdata.values)  # -> data; plug-in component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
data_9 = ClusterOutput(data)
data_10 = ClusterOutput(data_3)
data_11 = ClusterOutput(data_2)
data_12 = ClusterOutput(data_4)
data_13 = ClusterOutput(data_5)
data_14 = ClusterOutput(data_6)
data_15 = ClusterOutput(data_7)
data_16 = ClusterOutput(data_8)

# ==== cluster Cluster_2
D = ClusterInput()
S = ClusterInput()
fsim = FindSimilarMember(Data=D, Set=S)  # -> Hit, Index
_0 = ClusterInput()
_1 = ClusterInput()
_2 = ClusterInput()
_3 = ClusterInput()
_4 = ClusterInput()
_5 = ClusterInput()
_6 = ClusterInput()
_7 = ClusterInput()
filter = StreamFilter(Gate=fsim.Index, Stream0=_0, Stream1=_1, Stream2=_2, Stream3=_3, Stream4=_4, Stream5=_5, Stream6=_6, Stream7=_7)
s_1 = ClusterOutput(filter)
xdata = LBDeconstructData(data=filter)  # -> header, values; plug-in component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
bnd = Bounds(Numbers=flatten(xdata.values))
dedomain = DeconstructDomain(Domain=bnd)  # -> Start, End
E = ClusterOutput(dedomain.End)

# ==== cluster FindBuildableArea
C = ClusterInput()
explode = Explode(Curve=C, Recursive=True)  # -> Segments, Vertices
brep = Brep(<brep referenced from the Rhino model>)
item = ListItem(List=explode.Segments, Index=Slider(1, range=0..3), Wrap=True)
edges = BrepEdges(Brep=brep)  # -> Naked, Interior, NonManifold
item_2 = ListItem(List=explode.Segments, Index=Slider(0, range=0..3), Wrap=True)
item_3 = ListItem(List=explode.Segments, Index=Slider(2, range=0..3), Wrap=True)
item_4 = ListItem(List=explode.Segments, Index=Slider(3, range=0..3), Wrap=True)
item_5 = ListItem(List=edges.Interior, Index=0, Wrap=True)
midpt = CurveMiddle(Curve=item_5)
midpt_2 = CurveMiddle(Curve=item_4)
X = UnitX(Factor=Slider(8, range=0..100))
X_2 = UnitX(Factor=Slider(20, range=0..100))  # -> expr("-x", UnitVector)
Y = UnitY(Factor=Slider(5, range=0..100))  # -> expr("-x", UnitVector)
Y_2 = UnitY(Factor=Slider(5, range=0..100))
move = Move(Geometry=item_4, Motion=X)  # -> Geometry, Transform
move_2 = Move(Geometry=item, Motion=X_2)  # -> Geometry, Transform
move_3 = Move(Geometry=item_2, Motion=Y_2)  # -> Geometry, Transform
move_4 = Move(Geometry=item_3, Motion=Y)  # -> Geometry, Transform
pdecon = Deconstruct(Point=midpt)  # -> XComponent, YComponent, ZComponent
pdecon_2 = Deconstruct(Point=midpt_2)  # -> XComponent, YComponent, ZComponent
pt = ConstructPoint(XCoordinate=pdecon.XComponent, YCoordinate=pdecon_2.YComponent, ZCoordinate=0)
ptuvcrvs = IntersectCurves(CU=[move_2.Geometry, move.Geometry], CV=[move_4.Geometry, move_3.Geometry])
dist = Distance(PointA=pt, PointB=midpt_2)
subtraction = Subtraction(A=dist, B=Slider(5, range=0..10))
X_3 = UnitX(Factor=subtraction)
item_6 = ListItem(List=flatten(ptuvcrvs), Index=Slider(3, range=0..4), Wrap=True)
item_7 = ListItem(List=flatten(ptuvcrvs), Index=Slider(0, range=0..4), Wrap=True)
move_5 = Move(Geometry=item_4, Motion=X_3)  # -> Geometry, Transform
end = EndPoints(Curve=move_5.Geometry)  # -> Start, End
pdecon_3 = Deconstruct(Point=end.Start)  # -> XComponent, YComponent, ZComponent
pdecon_4 = Deconstruct(Point=item_7)  # -> XComponent, YComponent, ZComponent
rec_2pt = Rectangle2Pt(Plane=PlaneXY(0, 0, 0), PointA=item_6, PointB=item_7, Radius=0)  # -> Rectangle, Length
pt_2 = ConstructPoint(XCoordinate=pdecon_3.XComponent, YCoordinate=pdecon_4.YComponent, ZCoordinate=0)
rec_2pt_2 = Rectangle2Pt(Plane=PlaneXY(0, 0, 0), PointA=pt_2, PointB=item_6, Radius=0)  # -> Rectangle, Length
R = ClusterOutput(rec_2pt_2.Rectangle)

# ==== cluster Cluster_3
_0_0 = ClusterInput()
_0_1 = ClusterInput()
_0_2 = ClusterInput()
_0_3 = ClusterInput()
_0_4 = ClusterInput()
_0_5 = ClusterInput()
_0_6 = ClusterInput()
_0_7 = ClusterInput()
_0_8 = ClusterInput()
_0_9 = ClusterInput()
_0_10 = ClusterInput()
_0_11 = ClusterInput()
_0_12 = ClusterInput()
_0_13 = ClusterInput()
_0_14 = ClusterInput()
_0_15 = ClusterInput()
_0_16 = ClusterInput()
_0_17 = ClusterInput()
_0_18 = ClusterInput()
_0_19 = ClusterInput()
_0_20 = ClusterInput()
_0_21 = ClusterInput()
_0_22 = ClusterInput()
_0_23 = ClusterInput()
_0_24 = ClusterInput()
_0_25 = ClusterInput()
_0_26 = ClusterInput()
_0_27 = ClusterInput()
_0_28 = ClusterInput()
_0_29 = ClusterInput()
_0_30 = ClusterInput()
_0_31 = ClusterInput()
_0_32 = ClusterInput()
_0_33 = ClusterInput()
_0_34 = ClusterInput()
gather_all_info_from_scenario = Entwine(
    Branch00=_0_0,
    Branch01=_0_1,
    Branch02=_0_2,
    Branch03=_0_3,
    Branch04=_0_4,
    Branch05=_0_5,
    Branch06=_0_6,
    Branch07=_0_7,
    Branch08=_0_8,
    Branch09=_0_9,
    Branch010=_0_10,
    Branch011=_0_11,
    Branch012=_0_12,
    Branch013=_0_13,
    Branch014=_0_14,
    Branch015=_0_15,
    Branch016=_0_16,
    Branch017=_0_17,
    Branch018=_0_18,
    Branch019=_0_19,
    Branch020=_0_20,
    Branch021=_0_21,
    Branch022=_0_22,
    Branch023=_0_23,
    Branch024=_0_24,
    Branch025=_0_25,
    Branch026=_0_26,
    Branch027=_0_27,
    Branch028=_0_28,
    Branch029=_0_29,
    Branch030=_0_30,
    Branch031=_0_31,
    Branch032=_0_32,
    Branch033=_0_33,
    Branch034=_0_34,
    FlattenInputs=True)  # -> simplify(Result)
filter = StreamFilter(Gate=Toggle(True), Stream1=gather_all_info_from_scenario)
merge = Merge(Data2=filter)
bang = ExplodeTree(Data=merge)  # -> Branch0, Branch1, Branch2, Branch3, Branch4, Branch5, Branch6, Branch7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
_0_0_2 = ClusterInput()
_0_1_2 = ClusterInput()
_0_2_2 = ClusterInput()
_0_3_2 = ClusterInput()
_0_4_2 = ClusterInput()
adiabaticcrv = Entwine(
    Branch00=bang.Branch3,
    Branch01=bang.Branch5,
    Branch02=bang.Branch7,
    Branch03=bang.Branch9,
    Branch04=bang.Branch10,
    FlattenInputs=True)  # -> simplify(Result)
outsidecrv = Entwine(Branch00=bang.Branch2, Branch01=bang.Branch4, Branch02=bang.Branch6, Branch03=bang.Branch8, FlattenInputs=True)  # -> simplify(Result)
zone = Entwine(Branch00=_0_0_2, Branch01=_0_1_2, Branch02=_0_2_2, Branch03=_0_3_2, Branch04=_0_4_2, FlattenInputs=True)  # -> simplify(Result)
wwr = Entwine(Branch00=bang.Branch13, Branch01=bang.Branch14, Branch02=bang.Branch15, Branch03=bang.Branch16, FlattenInputs=True)  # -> simplify(Result)
boundary = BoundarySurfaces(FloorCrvs=flatten([outsidecrv, adiabaticcrv]))  # -> simplify(Surfaces)
Z = UnitZ(Factor=bang.Branch1)
extr = Extrude(Base=boundary, Direction=Z)
extr_2 = Extrude(OutsideCrv=outsidecrv, Direction=Z)  # -> simplify(OutsideSrf)
debrep = DeconstructBrep(Brep=extr)  # -> simplify(Faces), Edges, Vertices
area = Area(Geometry=debrep.Faces)  # -> Area, Centroid
brep = Brep(debrep.Faces)
area_2 = Area(Geometry=extr_2)  # -> Area, Centroid
srf = Surface([brep, extr_2])
mindex = MemberIndex(Set=area.Centroid, Member=area_2.Centroid)  # -> Index, Count
join = JoinCurves(Curves=[outsidecrv, adiabaticcrv], Preserve=False)  # -> simplify(Curves)
trim = TrimTree(Tree=mindex.Index, Depth=1)
item = ListItem(List=srf, Index=trim, Wrap=True)
extr_3 = Extrude(AdiabaticCrv=adiabaticcrv, Direction=Z)  # -> simplify(AdiabaticSrf)
move = Move(Geometry=join, Motion=Z)  # -> Geometry, Transform
clean = CleanTree(RemoveNulls=True, RemoveInvalid=True, RemoveEmpty=True, Tree=item)  # -> simplify(Tree)
facen = FaceNormals(Mesh=clean)  # -> Centers, Normals
debrep_2 = DeconstructBrep(Brep=extr_3)  # -> Faces, Edges, Vertices
cullpt = CullDuplicates(Points=facen.Normals, Tolerance=0.1, CullMode=3)  # -> Points, Indices, Valence
join_2 = JoinCurves(Curves=debrep_2.Edges, Preserve=False)
devec = DeconstructVector(Vector=cullpt.Points)  # -> XComponent, YComponent, ZComponent
trim_2 = TrimTree(Tree=join_2, Depth=Slider(2, range=0..10))
larger = LargerThan(FirstNumber=devec.XComponent, SecondNumber="-0.707")  # -> LargerThan, OrEqualTo
smaller = SmallerThan(FirstNumber=devec.YComponent, SecondNumber="-0.707")  # -> SmallerThan, OrEqualTo
larger_2 = LargerThan(FirstNumber=devec.YComponent, SecondNumber="-1")  # -> LargerThan, OrEqualTo
smaller_2 = SmallerThan(FirstNumber=devec.YComponent, SecondNumber="1")  # -> SmallerThan, OrEqualTo
larger_3 = LargerThan(FirstNumber=devec.YComponent, SecondNumber="0.707")  # -> LargerThan, OrEqualTo
smaller_3 = SmallerThan(FirstNumber=devec.XComponent, SecondNumber="1")  # -> SmallerThan, OrEqualTo
smaller_4 = SmallerThan(FirstNumber=devec.XComponent, SecondNumber="0.707")  # -> SmallerThan, OrEqualTo
smaller_5 = SmallerThan(FirstNumber=devec.YComponent, SecondNumber="0.707")  # -> SmallerThan, OrEqualTo
larger_4 = LargerThan(FirstNumber=devec.YComponent, SecondNumber="-0.707")  # -> LargerThan, OrEqualTo
larger_5 = LargerThan(FirstNumber=devec.XComponent, SecondNumber="0.707")  # -> LargerThan, OrEqualTo
larger_6 = LargerThan(FirstNumber=devec.XComponent, SecondNumber="-1")  # -> LargerThan, OrEqualTo
smaller_6 = SmallerThan(FirstNumber=devec.XComponent, SecondNumber="-0.707")  # -> SmallerThan, OrEqualTo
and = GateAnd(A=larger.LargerThan, B=smaller_4.SmallerThan)
and_2 = GateAnd(A=larger_2.OrEqualTo, B=smaller.SmallerThan)
and_3 = GateAnd(A=larger_3.LargerThan, B=smaller_2.OrEqualTo)
and_4 = GateAnd(A=larger_5.LargerThan, B=smaller_3.OrEqualTo)
and_5 = GateAnd(A=larger_4.OrEqualTo, B=smaller_5.SmallerThan)
and_6 = GateAnd(A=larger_6.OrEqualTo, B=smaller_6.SmallerThan)
and_7 = GateAnd(A=and, B=and_3)
and_8 = GateAnd(A=and, B=and_2)
and_9 = GateAnd(A=and_5, B=and_6)
and_10 = GateAnd(A=and_4, B=and_5)
cull = CullPattern(List=graft(clean), CullPattern=and_8)
cull_2 = CullPattern(List=graft(clean), CullPattern=and_9)
cull_3 = CullPattern(List=graft(clean), CullPattern=and_10)
cull_4 = CullPattern(List=graft(clean), CullPattern=and_7)
pshift = ShiftPaths(Data=cull, Offset=-2)
pshift_2 = ShiftPaths(Data=cull_4, Offset=-2)
pshift_3 = ShiftPaths(Data=cull_2, Offset=-2)
pshift_4 = ShiftPaths(Data=cull_3, Offset=-2)
debrep_3 = DeconstructBrep(Brep=pshift_2)  # -> Faces, Edges, Vertices
debrep_4 = DeconstructBrep(Brep=pshift)  # -> Faces, Edges, Vertices
debrep_5 = DeconstructBrep(Brep=pshift_4)  # -> Faces, Edges, Vertices
debrep_6 = DeconstructBrep(Brep=pshift_3)  # -> Faces, Edges, Vertices
join_3 = JoinCurves(Curves=debrep_3.Edges, Preserve=False)
join_4 = JoinCurves(Curves=debrep_4.Edges, Preserve=False)
join_5 = JoinCurves(Curves=debrep_5.Edges, Preserve=False)
join_6 = JoinCurves(Curves=debrep_6.Edges, Preserve=False)
trim_3 = TrimTree(Tree=join_3, Depth=Slider(2, range=0..10))
trim_4 = TrimTree(Tree=join_4, Depth=Slider(2, range=0..10))
trim_5 = TrimTree(Tree=join_5, Depth=Slider(2, range=0..10))
trim_6 = TrimTree(Tree=join_6, Depth=Slider(2, range=0..10))
clean_2 = CleanTree(RemoveNulls=True, RemoveInvalid=True, RemoveEmpty=False, Tree=move.Geometry)
T = ClusterOutput(trim_3)
T_2 = ClusterOutput(trim_4)
T_3 = ClusterOutput(trim_5)
T_4 = ClusterOutput(trim_6)
T_5 = ClusterOutput(clean_2)
