# Grasshopper definition plan_optimization.gh (Grasshopper 1.0.7)
# plug-ins: Bifocals

curve = Curve([<curve referenced from the Rhino model> x5])
galapagos = Galapagos(
    fitness=number_2,
    gene=[number_slider_9, number_slider_10, number_slider_7, number_slider_8, number_slider_5, number_slider_6, number_slider_4, number_slider_3, number_slider, number_slider_2])
list_item = ListItem(List=curve, Index=Slider(0, range=0..5), Wrap=True)
list_item_2 = ListItem(List=curve, Index=Slider(1, range=0..5), Wrap=True)
list_item_3 = ListItem(List=curve, Index=Slider(2, range=0..5), Wrap=True)
list_item_4 = ListItem(List=curve, Index=Slider(3, range=0..5), Wrap=True)
list_item_5 = ListItem(List=curve, Index=Slider(4, range=0..5), Wrap=True)
surface = Surface(<surface referenced from the Rhino model>)
area = Area(Geometry=surface)  # -> Area, Centroid
end_points = EndPoints(Curve=list_item_3)  # -> Start, End
end_points_2 = EndPoints(Curve=list_item_4)  # -> Start, End
end_points_3 = EndPoints(Curve=list_item)  # -> Start, End
end_points_4 = EndPoints(Curve=list_item_2)  # -> Start, End
end_points_5 = EndPoints(Curve=list_item_5)  # -> Start, End
line = Line(StartPoint=end_points_5.End, EndPoint=area.Centroid)
line_2 = Line(StartPoint=end_points_3.Start, EndPoint=area.Centroid)
line_3 = Line(StartPoint=end_points_4.Start, EndPoint=area.Centroid)
line_4 = Line(StartPoint=end_points.Start, EndPoint=area.Centroid)
line_5 = Line(StartPoint=end_points_2.Start, EndPoint=area.Centroid)
end_points_6 = EndPoints(Curve=line_5)  # -> Start, End
end_points_7 = EndPoints(Curve=line)  # -> Start, End
end_points_8 = EndPoints(Curve=line_2)  # -> Start, End
end_points_9 = EndPoints(Curve=line_4)  # -> Start, End
end_points_10 = EndPoints(Curve=line_3)  # -> Start, End
number_slider = Slider(0.541, range=0..25)
number_slider_2 = Slider(12.283, range=0..25)
number_slider_3 = Slider(0.621, range=0..25)
number_slider_4 = Slider(12.398, range=0..25)
number_slider_5 = Slider(24.647, range=0..25)
number_slider_6 = Slider(11.186, range=0..25)
number_slider_7 = Slider(17.853, range=0..25)
number_slider_8 = Slider(21.168, range=0..25)
number_slider_9 = Slider(5.343, range=0..25)
number_slider_10 = Slider(24.39, range=0..25)
_4point_surface = _4PointSurface(CornerA=end_points_7.Start, CornerB=end_points_7.End, CornerC=end_points_5.Start)
_4point_surface_2 = _4PointSurface(CornerA=end_points_9.Start, CornerB=end_points_9.End, CornerC=end_points.End)
_4point_surface_3 = _4PointSurface(CornerA=end_points_8.Start, CornerB=end_points_8.End, CornerC=end_points_3.End)
_4point_surface_4 = _4PointSurface(CornerA=end_points_10.Start, CornerB=end_points_10.End, CornerC=end_points_4.End)
_4point_surface_5 = _4PointSurface(CornerA=end_points_6.Start, CornerB=end_points_6.End, CornerC=end_points_2.End)
construct_point = ConstructPoint(XCoordinate=number_slider, YCoordinate=number_slider_2, ZCoordinate=0)
brep_edges = BrepEdges(Brep=_4point_surface_5)  # -> Naked, Interior, NonManifold
brep_edges_2 = BrepEdges(Brep=_4point_surface)  # -> Naked, Interior, NonManifold
brep_edges_3 = BrepEdges(Brep=_4point_surface_3)  # -> Naked, Interior, NonManifold
construct_point_2 = ConstructPoint(XCoordinate=number_slider_4, YCoordinate=number_slider_3, ZCoordinate=0)
brep_edges_4 = BrepEdges(Brep=_4point_surface_2)  # -> Naked, Interior, NonManifold
brep_edges_5 = BrepEdges(Brep=_4point_surface_4)  # -> Naked, Interior, NonManifold
construct_point_3 = ConstructPoint(XCoordinate=number_slider_5, YCoordinate=number_slider_6, ZCoordinate=0)
construct_point_4 = ConstructPoint(XCoordinate=number_slider_7, YCoordinate=number_slider_8, ZCoordinate=0)
construct_point_5 = ConstructPoint(XCoordinate=number_slider_9, YCoordinate=number_slider_10, ZCoordinate=0)
join_curves = JoinCurves(Curves=brep_edges_2.Naked, Preserve=False)
join_curves_2 = JoinCurves(Curves=brep_edges.Naked, Preserve=False)
join_curves_3 = JoinCurves(Curves=brep_edges_4.Naked, Preserve=False)
join_curves_4 = JoinCurves(Curves=brep_edges_5.Naked, Preserve=False)
join_curves_5 = JoinCurves(Curves=brep_edges_3.Naked, Preserve=False)
curve_2 = Curve(join_curves)
curve_3 = Curve(join_curves_2)
curve_4 = Curve(join_curves_3)
curve_5 = Curve(join_curves_4)
curve_6 = Curve(join_curves_5)
point_in_curve = PointInCurve(Point=construct_point, Curve=curve_2)  # -> Relationship, Point
point_in_curve_2 = PointInCurve(Point=construct_point_2, Curve=curve_3)  # -> Relationship, Point
point_in_curve_3 = PointInCurve(Point=construct_point_3, Curve=curve_4)  # -> Relationship, Point
point_in_curve_4 = PointInCurve(Point=construct_point_5, Curve=curve_6)  # -> Relationship, Point
point_in_curve_5 = PointInCurve(Point=construct_point_4, Curve=curve_5)  # -> Relationship, Point
number = Number([point_in_curve_4.Relationship, point_in_curve_5.Relationship, point_in_curve_3.Relationship, point_in_curve_2.Relationship, point_in_curve.Relationship])
point = Point([point_in_curve_4.Point, point_in_curve_5.Point, point_in_curve_3.Point, point_in_curve_2.Point, point_in_curve.Point])
ghpython_script = GhPythonScript(
    bools=number,
    rel1=point_in_curve_4.Relationship,
    rel2=point_in_curve_5.Relationship,
    rel3=point_in_curve_3.Relationship,
    rel4=point_in_curve_2.Relationship,
    rel5=point_in_curve.Relationship,
    pts=point,
    pt1=point_in_curve_4.Point,
    pt2=point_in_curve_5.Point,
    pt3=point_in_curve_3.Point,
    pt4=point_in_curve_2.Point,
    pt5=point_in_curve.Point)  # -> out, polygon; inputs bools: list
# ---------- ghpython_script: Python ----------
import rhinoscriptsyntax as rs

def CreatePolygon(rel1, rel2, rel3, rel4, rel5, pt1, pt2, pt3, pt4, pt5):
    bool_list = [rel1, rel2, rel3, rel4, rel5]
    pt_list = [pt1, pt2, pt3, pt4, pt5]
    good_points = []
    
    for i in range(len(bool_list)):
        if bool_list[i] > 0:
            good_points.append(pt_list[i])
    if len(good_points) < 2:
        return 
    else:
        good_points.append(good_points[0])
        polygon = rs.AddPolyline(good_points)
        return polygon
        
polygon = CreatePolygon(rel1, rel2, rel3, rel4, rel5, pt1, pt2, pt3, pt4, pt5)
# ---------- end ghpython_script ----------
panel = Panel(ghpython_script.out)
list_item_6 = ListItem(List=ghpython_script.polygon, Index=Slider(1, range=0..1), Wrap=True)
area_2 = Area(Geometry=list_item_6)  # -> Area, Centroid
number_2 = Number(area_2.Area)
