# Grasshopper definition practice_energy_script.gh (Grasshopper 1.0.7)
# plug-ins: Human

crv = Curve([<curve referenced from the Rhino model> x5])
Z = UnitZ(Factor=Slider(10, range=0..10))
extr = Extrude(Base=crv, Direction=Z)
cap = CapHoles(Brep=extr)
roomsolid = HBRoomFromSolid(geo=flatten(cap), conditioned=True)  # -> report, rooms; plug-in component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
solveadj = HBSolveAdjacency(rooms=flatten(roomsolid.rooms), air_boundary=Toggle(True), run=Toggle(True))  # -> report, adj_rooms; plug-in component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
bldgprograms = HBBuildingPrograms({"LargeOffice", "MediumOffice", "SmallOffice", "MidriseApartment", "HighriseApartment", "Retail", "StripMall", "PrimarySchool", "SecondarySchool", "SmallHotel", "LargeHotel", "Hospital", "Outpatient", "Laboratory", "Warehouse", "SuperMarket", "FullServiceRestaurant", "QuickServiceRestaurant", "Courthouse", "LargeDataCenterHighITE", "LargeDataCenterLowITE", "SmallDataCenterHighITE", "SmallDataCenterLowITE"}, selected="MidriseApartment")
searchmats = HBSearchMaterials(keywords="Concrete")  # -> opaque_mats, window_mats; plug-in component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
searchprog = HBSearchPrograms(bldg_prog=bldgprograms)  # -> room_prog; plug-in component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
list = ItemSelector(
    searchmats.opaque_mats,
    {"100mm Normalweight concrete floor", "12 in. Normalweight Concrete Floor", "4 in. Normalweight Concrete Floor", "4 in. Normalweight Concrete Wall", "6 in. Heavyweight Concrete Roof", "6 in. Normalweight Concrete Floor", "8 in. Concrete Block Basement Wall", "8 in. Concrete Block Wall", "8 in. Normalweight Concrete Floor", "8 in. Normalweight Concrete Wall", "8IN CONCRETE HW RefBldg", "8IN Concrete HW", "Generic HW Concrete", "Generic LW Concrete", "HW CONCRETE", "HW CONCRETE 8 in", "M11 100mm lightweight concrete", "M15 200mm heavyweight concrete", "MAT-CC05 4 HW CONCRETE", "MAT-CC05 8 HW CONCRETE", "NACM_Concrete 4in_140lb/ft3"}, selected="100mm Normalweight concrete floor")
list_2 = ItemSelector(
    searchprog,
    {"2013::MidriseApartment::Apartment", "2013::MidriseApartment::Corridor", "2013::MidriseApartment::Office"}, selected="2013::MidriseApartment::Apartment")
opaqueconstr = HBOpaqueConstruction(materials=list)  # -> constr; plug-in component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
deconstrprogram = HBDeconstructProgramType(program=list_2)  # -> people, lighting, electric_equip, gas_equip, hot_water, infiltration, ventilation, setpoint; plug-in component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
exteriorsubset = HBExteriorConstructionSubset(exposed_floor=opaqueconstr)  # -> exterior_set; plug-in component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
decnstrequipment = HBDeconstructEquipment(equip=deconstrprogram.electric_equip)  # -> name, watts_per_area, schedule, radiant_fract, latent_fract, lost_fract, is_gas; plug-in component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
constructionset = HBConstructionSet(exterior_subset=exteriorsubset)  # -> constr_set; plug-in component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
equipment = HBEquipment(
    name="NewEQ",
    watts_per_area=Slider(3, range=0..10),
    schedule=decnstrequipment.schedule,
    radiant_fract=decnstrequipment.radiant_fract,
    latent_fract=decnstrequipment.latent_fract,
    lost_fract=decnstrequipment.lost_fract,
    gas=decnstrequipment.is_gas)  # -> equip; plug-in component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
programtype = HBProgramType(name="NewProgram", base_program=list_2, electric_equip=equipment)  # -> program; plug-in component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
applyprogram = HBApplyProgramType(rooms=flatten(solveadj.adj_rooms), program=list_2)  # -> report, rooms; plug-in component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
panel = Panel("http://climate.onebuilding.org/WMO_Region_4_North_and_Central_America/USA_United_States_of_America/WA_Washington/USA_WA_Seattle-King.County.Intl.AP-Boeing.Field.727935_TMY3.zip")
aperturesbyratio = HBAperturesByRatio(
    hb_objs=flatten(applyprogram.rooms),
    ratio=[Slider(0.5, range=0..1), Slider(0.2, range=0..1), Slider(0.4, range=0..1), Slider(0.4, range=0..1)])  # -> report, hb_objs; plug-in component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
downloadepw = LBDownloadWeather(weather_URL=panel)  # -> epw_file, stat_file, ddy_file; plug-in component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
vizbytype = HBVisualizeByType(hb_objs=aperturesbyratio.hb_objs)  # -> walls, interior_walls, roofs, ceilings, exterior_floors, interior_floors, air_walls, apertures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; plug-in component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
annualloads = HBAnnualLoads(rooms=aperturesbyratio.hb_objs, epw_file=downloadepw.epw_file, run=Toggle(True))  # -> report, total_load, cooling, heating, lighting, equip, hot_water, balance; plug-in component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
model = HBModel(rooms=flatten(aperturesbyratio.hb_objs))  # -> report, model; plug-in component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
toggle = BooleanToggle(True)
modeltoosm = HBModelToOSM(model=model.model, epw_file=downloadepw.epw_file, write=toggle, run=toggle)  # -> report, jsons, osw, osm, idf, sql, zsz, rdd, html; plug-in component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
faceenergyattr = HBFaceEnergyAttributes({"Construction": "properties.energy.construction.display_name", "Materials": "properties.energy.construction.layers", "R-Value": "properties.energy.construction.r_value", "U-Value": "properties.energy.construction.u_value", "U-Factor": "properties.energy.construction.u_factor", "Solar Transmitance [Unshaded]": "properties.energy.construction.solar_transmittance", "Solar Reflectance [Outside]": "properties.energy.construction.outside_solar_reflectance", "Solar Reflectance [Inside]": "properties.energy.construction.inside_solar_reflectance", "Fraction Area Operable": "properties.energy.vent_opening.fraction_area_operable", "Fraction Height Operable": "properties.energy.vent_opening.fraction_height_operable", "Discharge Coefficient": "properties.energy.vent_opening.discharge_coefficient", "Cross Ventilation": "properties.energy.vent_opening.wind_cross_vent"}, selected="U-Factor")
faceattr = HBFaceAttributes({"Display Name": "display_name", "Simulation Name (Identifier)": "identifier", "Boundary Condition": "boundary_condition", "Has Parent": "has_parent", "Parent": "parent", "Area": "area", "Perimeter": "perimeter", "Face Type": "type", "Aperture Is Operable": "is_operable", "Door Is Glass": "is_glass"}, selected="Boundary Condition")
eui = HBEndUseIntensity(sql=modeltoosm.sql, ip=Toggle(True))  # -> eui, eui_end_use, end_uses, gross_floor; plug-in component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
lablefaces = HBLabelFaces(hb_objs=flatten(model.model), attribute=faceattr)  # -> label_text, base_pts, labels, wire_frame; plug-in component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
panel_2 = Panel(eui.eui)
panel_3 = Panel(modeltoosm.report)
